# Grasshopper definition FEM_03_Civil_Trave.ghx (Grasshopper 1.0.8)
# plug-ins: Rhino2Midas
# Modifica L, b, h e q. Unita: kN / m. G = peso proprio; Q = carico verticale distribuito.
# La combinazione ULS = 1.35 G + 1.50 Q e inclusa nel Model. Nessuna connessione API serve per questa definizione.

# ---- group: 01 PARAMETRI
l_m = Slider(6, range=2..15)
h_m = Slider(0.5, range=0.2..1.2)
b_m = Slider(0.3, range=0.15..0.8)
q_gz_kn_m = Slider(-8, range=-40..0)

# ---- group: 02 GEOMETRIA E PROPRIETA
# 03 / CIVIL NX - Trave, peso proprio e combinazione: Modifica L, b, h e q. Unita: kN / m. G = peso proprio; Q = carico verticale distribuito.
# La combinazione ULS = 1.35 G + 1.50 Q e inclusa nel Model. Nessuna connessione API serve per questa definizione.
A = ConstructPoint(XCoordinate=0, YCoordinate=0, ZCoordinate=0)
B = ConstructPoint(XCoordinate=l_m, YCoordinate=0, ZCoordinate=0)
material = MidasIsotropicMaterial(ID=1, Name="C30", E=30000000, Poisson=0.2, WeightDensity=25, Thermal=1.2e-05, Type="CONC")
rectangle = MidasRectangleSection(ID=1, Name="R300x500", Insertion="CC", Height=h_m, Width=b_m)
node = MidasNode(Point=[A, B], ID=[1, 2])
beam = MidasBeam(ID=1, Points=[A, B], Material=material, Property=rectangle, Angle=0, Nodes=node)

# ---- group: 03 VINCOLI E CARICHI
node_2 = MidasNode(Point=A, ID=1)
support = MidasNodeSupport(Nodes=node_2, Mask="1111110")
load_case = MidasStaticLoadCase(ID=1, Name="G", Type="D")  # -> Case, Name
load_case_2 = MidasStaticLoadCase(ID=2, Name="Q", Type="L")  # -> Case, Name
self_weight = MidasSelfWeight(ID=1, Case=load_case.Name, Factors=Vector(0, 0, -1))
beam_distributed_load = MidasBeamDistributedLoad(
    Beam=beam,
    Case=load_case_2.Name,
    Direction="GZ",
    StartValue=q_gz_kn_m,
    EndValue=q_gz_kn_m,
    StartPosition=0,
    EndPosition=1,
    Projected=False)

# ---- group: 04 MODELLO E COMBINAZIONE
combination = MidasLoadCombination(ID=1, Name="ULS", Cases=[load_case.Name, load_case_2.Name], Factors=[1.35, 1.5], Type=0)
units = MidasModelUnits(Force="KN", Length="M", Temperature="C", Heat="KJ")
model = BuildMidasModel(
    Definitions=[beam_distributed_load, support, load_case.Case, load_case_2.Case, self_weight, combination],
    Units=units,
    Tolerance=1e-06)  # -> Model, Issues

# ---- group: 05 CONTROLLI, PREVIEW E GEOMETRIA
validate = ValidateMidasModel(Model=model.Model)  # -> Valid, Issues, Fingerprint
summary = MidasModelSummary(Model=model.Model)
display_settings = MidasDisplaySettings(
    Enabled=True,
    Geometry=True,
    Sections=True,
    Loads=True,
    Supports=True,
    Springs=True,
    Masses=True,
    Releases=True,
    Offsets=True,
    OtherAttributes=True,
    Axes=False,
    Labels=False,
    Values=True,
    SymbolScale=0.2,
    LoadScale=0.05)
preview = PreviewMidasModel(Model=model.Model, Settings=display_settings)  # -> Status, Issues, Breps, Names
physical = MidasPhysicalGeometry(Model=model.Model)  # -> Breps, Names, Issues
decompose = DecomposeMidasModel(Model=model.Model)  # -> Node, Beam, Plate, Solid, Truss, Tension, Compression, ElasticLink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
element_info = DecomposeMidasBeam(Element=decompose.Beam)  # -> ID, Geometry, Material, Property, Results, Angle, Nodes
validazione = Panel(validate.Valid)
riepilogo_modello = Panel(summary)
