# Grasshopper definition 04_Solidi.ghx (Grasshopper 1.0.8)
# plug-ins: Rhino2Midas
# Un cubo di lato 1 m, otto vertici ordinati, materiale elastico e base incastrata. Il Brep fisico deve essere chiuso. La connettivita conta: non riordinare casualmente i vertici.

# ---- group: 02 | PROPRIETA / GEOMETRIA
# Solidi Hexa8: Rhino2Midas | Solidi Hexa8
# Un cubo di lato 1 m, otto vertici ordinati, materiale elastico e base incastrata. Il Brep fisico deve essere chiuso. La connettivita conta: non riordinare casualmente i vertici.
# Unita: kN / m / C. Geometrie incorporate. Le combinazioni sono didattiche.
# COME USARE: Un cubo di lato 1 m, otto vertici ordinati, materiale elastico e base incastrata. Il Brep fisico deve essere chiuso. La connettivita conta: non riordinare casualmente i vertici.
material = MidasIsotropicMaterial(ID=1, Name="C30_DEMO", E=30000000, Poisson=0.2, WeightDensity=25, Thermal=1.2e-05, Type="CONC")
node = MidasNode(
    Point=[Point(0, 0, 0), Point(1, 0, 0), Point(1, 1, 0), Point(0, 1, 0), Point(0, 0, 1), Point(1, 0, 1), Point(1, 1, 1), Point(0, 1, 1)],
    ID=[1, 2, 3, 4, 5, 6, 7, 8])
node_2 = MidasNode(Point=[Point(0, 0, 0), Point(1, 0, 0), Point(1, 1, 0), Point(0, 1, 0)], ID=[1, 2, 3, 4])

# ---- group: 03 | ATTRIBUTI / CARICHI
support = MidasNodeSupport(Nodes=node_2, Mask="1111110")
solid = MidasSolid(
    ID=1,
    Points=[Point(0, 0, 0), Point(1, 0, 0), Point(1, 1, 0), Point(0, 1, 0), Point(0, 0, 1), Point(1, 0, 1), Point(1, 1, 1), Point(0, 1, 1)],
    Material=material,
    Angle=0,
    Nodes=node)

# ---- group: 04 | MODEL / OPERAZIONI
model = BuildMidasModel(Definitions=flatten([solid, support]), Tolerance=1e-06)  # -> Model, Issues

# ---- group: 05 | VERIFICA / LETTURA
validate = ValidateMidasModel(Model=model.Model)  # -> Valid, Issues, Fingerprint
summary = MidasModelSummary(Model=model.Model)
preview = PreviewMidasModel(Model=model.Model)  # -> Status, Issues, Breps, Names
decompose = DecomposeMidasModel(Model=model.Model)  # -> Node, Beam, Plate, Solid, Truss, Tension, Compression, ElasticLink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
physical = MidasPhysicalGeometry(Model=model.Model)  # -> Breps, Names, Issues
valido_dati_e_riferimenti = Panel(validate.Valid)
riepilogo = Panel(summary)
