# Grasshopper definition 05_Link_elastico.ghx (Grasshopper 1.0.8)
# plug-ins: Rhino2Midas
# Due nodi distinti collegati da un link elastico. Il primo e vincolato, il secondo e libero. Le prime tre rigidezze sono kN/m, le ultime tre kN m/rad.

# ---- group: 02 | PROPRIETA / GEOMETRIA
# Link e rigidezze: Rhino2Midas | Link e rigidezze
# Due nodi distinti collegati da un link elastico. Il primo e vincolato, il secondo e libero. Le prime tre rigidezze sono kN/m, le ultime tre kN m/rad.
# Unita: kN / m / C. Geometrie incorporate. Le combinazioni sono didattiche.
node = MidasNode(Point=Point(0, 0, 0), ID=1)
node_2 = MidasNode(Point=Point(0, 0, 1), ID=2)

# ---- group: 01 | INPUT E ISTRUZIONI
# COME USARE: Due nodi distinti collegati da un link elastico. Il primo e vincolato, il secondo e libero. Le prime tre rigidezze sono kN/m, le ultime tre kN m/rad.
# LETTURA: Il link e rappresentato dall'asse. Non equivale a una trave con volume fisico. Per un collegamento rigido usare il tipo dedicato o l'opzione Rigid in MIDAS.
k_tx_ty_tz_rx_ry_rz = Panel("""100000
100000
100000
1000
1000
1000""")

# ---- group: 03 | ATTRIBUTI / CARICHI
support = MidasNodeSupport(Nodes=node, Mask="1111110")
elastic_link = MidasElasticLink(ID=1, Nodes=[node, node_2], Stiffness=k_tx_ty_tz_rx_ry_rz, Rigid=False)

# ---- group: 04 | MODEL / OPERAZIONI
model = BuildMidasModel(Definitions=flatten([elastic_link, support, node_2]), Tolerance=1e-06)  # -> Model, Issues

# ---- group: 05 | VERIFICA / LETTURA
validate = ValidateMidasModel(Model=model.Model)  # -> Valid, Issues, Fingerprint
summary = MidasModelSummary(Model=model.Model)
preview = PreviewMidasModel(Model=model.Model)  # -> Status, Issues, Breps, Names
decompose = DecomposeMidasModel(Model=model.Model)  # -> Node, Beam, Plate, Solid, Truss, Tension, Compression, ElasticLink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
valido_dati_e_riferimenti = Panel(validate.Valid)
riepilogo = Panel(summary)
