# Grasshopper definition 08_Carichi_combinazioni.ghx (Grasshopper 1.0.8)
# plug-ins: Rhino2Midas
# Peso proprio G, carico Q e ULS_DEMO = 1.35 G + 1.50 Q. Coefficienti didattici; non sommare copie intermedie dello stesso carico.

# ---- group: 01 | INPUT E ISTRUZIONI
# COME USARE: Peso proprio G, carico Q e ULS_DEMO = 1.35 G + 1.50 Q. Coefficienti didattici; non sommare copie intermedie dello stesso carico.
asse_trave = Curve(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)
h_m = Slider(0.3, range=0.1..0.8)
b_m = Slider(0.2, range=0.05..0.6)

# ---- group: 02 | PROPRIETA / GEOMETRIA
# Casi e combinazioni: Rhino2Midas | Casi e combinazioni
# Peso proprio G, carico Q e ULS_DEMO = 1.35 G + 1.50 Q. Coefficienti didattici; non sommare copie intermedie dello stesso carico.
# Unita: kN / m / C. Geometrie incorporate. Le combinazioni sono didattiche.
material = MidasIsotropicMaterial(ID=1, Name="S355_DEMO", E=210000000, Poisson=0.3, WeightDensity=78.5, Thermal=1.2e-05, Type="STEEL")
rectangle = MidasRectangleSection(ID=1, Name="R200x300", Insertion="CC", Height=h_m, Width=b_m)
node = MidasNode(Point=Point(0, 0, 0), ID=100)
node_2 = MidasNode(Point=Point(3, 0, 0), ID=101)
load_case = MidasStaticLoadCase(ID=1, Name="Q", Type="L")  # -> Case, Name
load_case_2 = MidasStaticLoadCase(ID=2, Name="G", Type="L")  # -> Case, Name

# ---- group: 03 | ATTRIBUTI / CARICHI
beam = MidasBeam(ID=1, Points=[Point(0, 0, 0), Point(3, 0, 0)], Material=material, Property=rectangle, Angle=0)
support = MidasNodeSupport(Nodes=node, Mask="1111110")
nodal_load = MidasNodalLoad(Nodes=node_2, Case=load_case.Name, Loads=[0, 0, -10, 0, 0, 0])
self_weight = MidasSelfWeight(ID=1, Case=load_case_2.Name, Factors=Vector(0, 0, -1))
combination = MidasLoadCombination(ID=1, Name="ULS_DEMO", Cases=["G", "Q"], Factors=[1.35, 1.5], Type=0)

# ---- group: 04 | MODEL / OPERAZIONI
model = BuildMidasModel(
    Definitions=flatten([beam, support, nodal_load, load_case.Case, self_weight, load_case_2.Case, combination]),
    Tolerance=1e-06)  # -> Model, Issues

# ---- group: 05 | VERIFICA / LETTURA
validate = ValidateMidasModel(Model=model.Model)  # -> Valid, Issues, Fingerprint
summary = MidasModelSummary(Model=model.Model)
preview = PreviewMidasModel(Model=model.Model)  # -> Status, Issues, Breps, Names
decompose = DecomposeMidasModel(Model=model.Model)  # -> Node, Beam, Plate, Solid, Truss, Tension, Compression, ElasticLink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
physical = MidasPhysicalGeometry(Model=model.Model)  # -> Breps, Names, Issues
valido_dati_e_riferimenti = Panel(validate.Valid)
riepilogo = Panel(summary)
