# Grasshopper definition 09_Unione_filtri.ghx (Grasshopper 1.0.8)
# plug-ins: Rhino2Midas
# Due mensole indipendenti, con ID coordinati, confluiscono in un Model. Decomposizione e filtro recuperano un sottoinsieme.

# ---- group: 01 | INPUT E ISTRUZIONI
# COME USARE: Due mensole indipendenti, con ID coordinati, confluiscono in un Model. Decomposizione e filtro recuperano un sottoinsieme.
# ID E DIPENDENZE: I due modelli condividono materiale e sezione; gli elementi hanno ID distinti. Straus puo rinumerare, SAP/MIDAS richiedono riferimenti coordinati. Il merge invalida risultati precedenti.
asse_trave = Curve(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)
asse_trave_2 = Curve(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)
h_m = Slider(0.3, range=0.1..0.8)
b_m = Slider(0.2, range=0.05..0.6)

# ---- group: 02 | PROPRIETA / GEOMETRIA
# Unione, decomposizione e filtri: Rhino2Midas | Unione, decomposizione e filtri
# Due mensole indipendenti, con ID coordinati, confluiscono in un Model. Decomposizione e filtro recuperano un sottoinsieme.
# Unita: kN / m / C. Geometrie incorporate. Le combinazioni sono didattiche.
material = MidasIsotropicMaterial(ID=1, Name="S355_DEMO", E=210000000, Poisson=0.3, WeightDensity=78.5, Thermal=1.2e-05, Type="STEEL")
rectangle = MidasRectangleSection(ID=1, Name="R200x300", Insertion="CC", Height=h_m, Width=b_m)
node = MidasNode(Point=Point(0, 0, 0), ID=100)
node_2 = MidasNode(Point=Point(3, 0, 0), ID=101)
node_3 = MidasNode(Point=Point(4, 0, 0), ID=200)
node_4 = MidasNode(Point=Point(7, 0, 0), ID=201)

# ---- group: 03 | ATTRIBUTI / CARICHI
beam = MidasBeam(ID=1, Points=[Point(0, 0, 0), Point(3, 0, 0)], Material=material, Property=rectangle, Angle=0)
support = MidasNodeSupport(Nodes=node, Mask="1111110")
beam_2 = MidasBeam(ID=2, Points=[Point(4, 0, 0), Point(7, 0, 0)], Material=material, Property=rectangle, Angle=0)
support_2 = MidasNodeSupport(Nodes=node_3, Mask="1111110")

# ---- group: 04 | MODEL / OPERAZIONI
model = BuildMidasModel(Definitions=flatten([beam, support, node_2]), Tolerance=1e-06)  # -> Model, Issues
model_2 = BuildMidasModel(Definitions=flatten([beam_2, support_2, node_4]), Tolerance=1e-06)  # -> Model, Issues
merge = MergeMidasModels(Models=[model.Model, model_2.Model])

# ---- group: 05 | VERIFICA / LETTURA
validate = ValidateMidasModel(Model=merge)  # -> Valid, Issues, Fingerprint
summary = MidasModelSummary(Model=merge)
preview = PreviewMidasModel(Model=merge)  # -> Status, Issues, Breps, Names
decompose = DecomposeMidasModel(Model=merge)  # -> Node, Beam, Plate, Solid, Truss, Tension, Compression, ElasticLink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
physical = MidasPhysicalGeometry(Model=merge)  # -> Breps, Names, Issues
valido_dati_e_riferimenti = Panel(validate.Valid)
riepilogo = Panel(summary)

# ---- group: 06 | RISULTATI
filter = FilterMidasElements(Model=merge, Kind="Beam", IDs=1, Property=0)  # -> Elements, IDs
elementi_filtrati = Panel(filter.Elements)
