# Grasshopper definition 10_Export.ghx (Grasshopper 1.0.8)
# plug-ins: Rhino2Midas
# Valida il Model, scegli una destinazione nuova e abilita RUN EXPORT. MIDAS richiede anche Replace active document e API configurata.

# ---- group: 01 | INPUT E ISTRUZIONI
# COME USARE: Valida il Model, scegli una destinazione nuova e abilita RUN EXPORT. MIDAS richiede anche Replace active document e API configurata.
asse_trave = Curve(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)
# Esportare un modello: Rhino2Midas | Esportare un modello
# Valida il Model, scegli una destinazione nuova e abilita RUN EXPORT. MIDAS richiede anche Replace active document e API configurata.
# Unita: kN / m / C. Geometrie incorporate. Le combinazioni sono didattiche.
run_export = BooleanToggle(False)
overwrite_sostituisci_file = BooleanToggle(False)
replace_documento_attivo_salvato = BooleanToggle(False)
path_percorso_locale_modificabile = Panel("C:\Users\g.pacini\Documents\Rhino2FEM_Examples\Rhino2Midas\10_Export.mcb")
h_m = Slider(0.3, range=0.1..0.8)
b_m = Slider(0.2, range=0.05..0.6)

# ---- group: 02 | PROPRIETA / GEOMETRIA
material = MidasIsotropicMaterial(ID=1, Name="S355_DEMO", E=210000000, Poisson=0.3, WeightDensity=78.5, Thermal=1.2e-05, Type="STEEL")
rectangle = MidasRectangleSection(ID=1, Name="R200x300", Insertion="CC", Height=h_m, Width=b_m)
node = MidasNode(Point=Point(0, 0, 0), ID=100)
node_2 = MidasNode(Point=Point(3, 0, 0), ID=101)
load_case = MidasStaticLoadCase(ID=1, Name="Q", Type="L")  # -> Case, Name
connection = MidasAPIConnection()
configurazione_api = Panel(connection)

# ---- group: 03 | ATTRIBUTI / CARICHI
beam = MidasBeam(ID=1, Points=[Point(0, 0, 0), Point(3, 0, 0)], Material=material, Property=rectangle, Angle=0)
support = MidasNodeSupport(Nodes=node, Mask="1111110")
nodal_load = MidasNodalLoad(Nodes=node_2, Case=load_case.Name, Loads=[0, 0, -10, 0, 0, 0])

# ---- group: 04 | MODEL / OPERAZIONI
model = BuildMidasModel(Definitions=flatten([beam, support, nodal_load, load_case.Case]), Tolerance=1e-06)  # -> Model, Issues
export_midas_civil_model = ExportMidasCivilModel(
    Model=model.Model,
    Path=path_percorso_locale_modificabile,
    Run=run_export,
    ReplaceActiveDocument=replace_documento_attivo_salvato,
    Overwrite=overwrite_sostituisci_file)  # -> Model, Beams, Plates, Path, Issues
esito_operazione = Panel(export_midas_civil_model.Issues)

# ---- group: 05 | VERIFICA / LETTURA
validate = ValidateMidasModel(Model=model.Model)  # -> Valid, Issues, Fingerprint
summary = MidasModelSummary(Model=model.Model)
preview = PreviewMidasModel(Model=model.Model)  # -> Status, Issues, Breps, Names
decompose = DecomposeMidasModel(Model=model.Model)  # -> Node, Beam, Plate, Solid, Truss, Tension, Compression, ElasticLink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
physical = MidasPhysicalGeometry(Model=model.Model)  # -> Breps, Names, Issues
valido_dati_e_riferimenti = Panel(validate.Valid)
riepilogo = Panel(summary)
