# Grasshopper definition 11_Import_model.ghx (Grasshopper 1.0.8)
# plug-ins: Rhino2Midas
# Leggi il modello nativo e ottieni il Model associato. Controlla Issues per conoscere dati importati e limiti.

# ---- group: 01 | INPUT E ISTRUZIONI
# Modello esistente verso Grasshopper: Rhino2Midas | Modello esistente verso Grasshopper
# Leggi il modello nativo e ottieni il Model associato. Controlla Issues per conoscere dati importati e limiti.
# Unita: quelle restituite dal lettore; vedere Summary.
# COME USARE: Leggi il modello nativo e ottieni il Model associato. Controlla Issues per conoscere dati importati e limiti.
# DOCUMENTO ATTIVO: Apri il file nel prodotto corretto e attiva l'API. READ legge il documento attivo senza sostituirlo. Le tabelle aggiuntive sono opzionali.
# UNITA DEL MODELLO: Il Model mantiene le unita del documento nativo. Controllare Summary e non forzare kN/m su dati in altre unita.
read_model = BooleanToggle(False)

# ---- group: 03 | ATTRIBUTI / CARICHI
read_civil = ReadActiveMidasModel(Run=read_model)  # -> Model, Issues, Tables

# ---- group: 02 | PROPRIETA / GEOMETRIA
connection = MidasAPIConnection()
connessione = Panel(connection)

# ---- group: 04 | MODEL / OPERAZIONI
gate = StreamGate(Stream=read_civil.Model, Gate=read_model)  # -> Target0, Target1
import_limiti = Panel(read_civil.Issues)
tabelle_lette = Panel(read_civil.Tables)

# ---- group: 05 | VERIFICA / LETTURA
validate = ValidateMidasModel(Model=gate.Target1)  # -> Valid, Issues, Fingerprint
summary = MidasModelSummary(Model=gate.Target1)
preview = PreviewMidasModel(Model=gate.Target1)  # -> Status, Issues, Breps, Names
decompose = DecomposeMidasModel(Model=gate.Target1)  # -> Node, Beam, Plate, Solid, Truss, Tension, Compression, ElasticLink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
physical = MidasPhysicalGeometry(Model=gate.Target1)  # -> Breps, Names, Issues
valido_dati_e_riferimenti = Panel(validate.Valid)
riepilogo = Panel(summary)
