# Grasshopper definition 12_Analisi_frame.ghx (Grasshopper 1.0.8)
# plug-ins: Rhino2Midas
# Model -> analisi -> Model con risultati -> casi, azioni, deformata e diagramma. I lettori attendono risultati reali del solver.

# ---- group: 01 | INPUT E ISTRUZIONI
# COME USARE: Model -> analisi -> Model con risultati -> casi, azioni, deformata e diagramma. I lettori attendono risultati reali del solver.
# LETTORI IN ATTESA: Stream Gate chiude il ramo finche RUN/READ=false. Dopo il calcolo scegli un caso reale. MIDAS usa etichette come Q(ST): controlla quelle restituite. Gli inviluppi non sono una deformata simultanea.
asse_trave = Curve(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)
# Analisi e risultati delle travi: Rhino2Midas | Analisi e risultati delle travi
# Model -> analisi -> Model con risultati -> casi, azioni, deformata e diagramma. I lettori attendono risultati reali del solver.
# Unita: kN / m / C. Geometrie incorporate. Le combinazioni sono didattiche.
run_analisi = BooleanToggle(False)
overwrite_sostituisci_file = BooleanToggle(False)
replace_documento_attivo_salvato = BooleanToggle(False)
path_percorso_locale_modificabile = Panel("C:\Users\g.pacini\Documents\Rhino2FEM_Examples\Rhino2Midas\12_Analisi_frame.mcb")
h_m = Slider(0.3, range=0.1..0.8)
b_m = Slider(0.2, range=0.05..0.6)

# ---- group: 02 | PROPRIETA / GEOMETRIA
material = MidasIsotropicMaterial(ID=1, Name="S355_DEMO", E=210000000, Poisson=0.3, WeightDensity=78.5, Thermal=1.2e-05, Type="STEEL")
rectangle = MidasRectangleSection(ID=1, Name="R200x300", Insertion="CC", Height=h_m, Width=b_m)
node = MidasNode(Point=Point(0, 0, 0), ID=100)
node_2 = MidasNode(Point=Point(3, 0, 0), ID=101)
load_case = MidasStaticLoadCase(ID=1, Name="Q", Type="L")  # -> Case, Name
connection = MidasAPIConnection()
configurazione_api = Panel(connection)

# ---- group: 03 | ATTRIBUTI / CARICHI
beam = MidasBeam(ID=1, Points=[Point(0, 0, 0), Point(3, 0, 0)], Material=material, Property=rectangle, Angle=0)
support = MidasNodeSupport(Nodes=node, Mask="1111110")
nodal_load = MidasNodalLoad(Nodes=node_2, Case=load_case.Name, Loads=[0, 0, -10, 0, 0, 0])

# ---- group: 04 | MODEL / OPERAZIONI
model = BuildMidasModel(Definitions=flatten([beam, support, nodal_load, load_case.Case]), Tolerance=1e-06)  # -> Model, Issues
midas_analyze_and_embed_results = MidasAnalyzeAndEmbedResults(
    Model=model.Model,
    Path=path_percorso_locale_modificabile,
    Run=run_analisi,
    ReplaceActiveDocument=replace_documento_attivo_salvato,
    Overwrite=overwrite_sostituisci_file)  # -> Model, Beams, Plates, Path, Issues
esito_operazione = Panel(midas_analyze_and_embed_results.Issues)

# ---- group: 05 | VERIFICA / LETTURA
validate = ValidateMidasModel(Model=model.Model)  # -> Valid, Issues, Fingerprint
summary = MidasModelSummary(Model=model.Model)
preview = PreviewMidasModel(Model=model.Model)  # -> Status, Issues, Breps, Names
decompose = DecomposeMidasModel(Model=model.Model)  # -> Node, Beam, Plate, Solid, Truss, Tension, Compression, ElasticLink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
physical = MidasPhysicalGeometry(Model=model.Model)  # -> Breps, Names, Issues
gate = StreamGate(Stream=midas_analyze_and_embed_results.Model, Gate=run_analisi)  # -> Target0, Target1
valido_dati_e_riferimenti = Panel(validate.Valid)
riepilogo = Panel(summary)

# ---- group: 06 | RISULTATI
result_cases = MidasModelResultCases(Model=gate.Target1)  # -> States, Quantities, Issues
decompose_2 = DecomposeMidasModel(Model=gate.Target1)  # -> Node, Beam, Plate, Solid, Truss, Tension, Compression, ElasticLink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
actions = MidasBeamActions(Source=gate.Target1)  # -> Axial, ShearY, ShearZ, Torsion, MomentY, MomentZ, States, Table
casi_stati = Panel(result_cases.States)
azioni_di_trave = Panel(actions.Axial)

# ---- group: 07 | APPROFONDIMENTI
deformed = MidasDeformedGeometry(Model=gate.Target1, Case="Q(ST)", Scale=100)  # -> Geometry, Translations, NodeIDs
actions_2 = MidasNodeReactions(Source=gate.Target1)  # -> FX, FY, FZ, MX, MY, MZ, States, Table
extrema = MidasResultExtrema(Table=actions.Table, Column="Moment-y")  # -> Minimum, Maximum, GoverningRows
diagram = MidasBeamForceDiagram(Beam=decompose_2.Beam, Table=actions.Table, Column="Moment-y", Direction=Vector(0, 0, 1), Scale=0.01)  # -> Diagram, Ordinates, Values
reazioni = Panel(actions_2.FX)
estremi_firmati = Panel(extrema.Minimum)
