# Grasshopper definition 13_Analisi_mesh.ghx (Grasshopper 1.0.8)
# plug-ins: Rhino2Midas
# Piastra Quad4 con pressione: Model -> solver -> azioni di piastra, spostamenti e reazioni. Nessun risultato e simulato.

# ---- group: 01 | INPUT E ISTRUZIONI
# COME USARE: Piastra Quad4 con pressione: Model -> solver -> azioni di piastra, spostamenti e reazioni. Nessun risultato e simulato.
# LETTORI IN ATTESA: Stream Gate chiude il ramo finche RUN/READ=false. Dopo il calcolo scegli un caso reale. MIDAS usa etichette come Q(ST): controlla quelle restituite. Gli inviluppi non sono una deformata simultanea.
mesh_incorporata = Mesh(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)
# Analisi e risultati delle piastre: Rhino2Midas | Analisi e risultati delle piastre
# Piastra Quad4 con pressione: Model -> solver -> azioni di piastra, spostamenti e reazioni. Nessun risultato e simulato.
# Unita: kN / m / C. Geometrie incorporate. Le combinazioni sono didattiche.
run_analisi = BooleanToggle(False)
overwrite_sostituisci_file = BooleanToggle(False)
replace_documento_attivo_salvato = BooleanToggle(False)
path_percorso_locale_modificabile = Panel("C:\Users\g.pacini\Documents\Rhino2FEM_Examples\Rhino2Midas\13_Analisi_mesh.mcb")
spessore_t_m = Slider(0.2, range=0.05..0.5)

# ---- group: 02 | PROPRIETA / GEOMETRIA
material = MidasIsotropicMaterial(ID=1, Name="C30_DEMO", E=30000000, Poisson=0.2, WeightDensity=25, Thermal=1.2e-05, Type="CONC")
thickness = MidasPlateThickness(ID=1, Thickness=spessore_t_m, BendingThickness=0, Offset=0)
node = MidasNode(
    Point=[Point(0, 0, 0), Point(2, 0, 0), Point(4, 0, 0), Point(0, 1.5, 0), Point(4, 1.5, 0), Point(0, 3, 0), Point(2, 3, 0), Point(4, 3, 0)],
    ID=[100, 101, 102, 103, 104, 105, 106, 107])
load_case = MidasStaticLoadCase(ID=1, Name="Q", Type="L")  # -> Case, Name
connection = MidasAPIConnection()
configurazione_api = Panel(connection)

# ---- group: 03 | ATTRIBUTI / CARICHI
mesh_plates = MidasMeshToPlates(Mesh=mesh_incorporata, FirstID=1, Material=material, Thickness=thickness)
support = MidasNodeSupport(Nodes=node, Mask="1111110")
pressure = MidasPlatePressure(Plate=mesh_plates, Case=load_case.Name, Pressure=-5, Direction="GZ")

# ---- group: 04 | MODEL / OPERAZIONI
model = BuildMidasModel(Definitions=flatten([pressure, support, load_case.Case]), Tolerance=1e-06)  # -> Model, Issues
midas_analyze_and_embed_results = MidasAnalyzeAndEmbedResults(
    Model=model.Model,
    Path=path_percorso_locale_modificabile,
    Run=run_analisi,
    ReplaceActiveDocument=replace_documento_attivo_salvato,
    Overwrite=overwrite_sostituisci_file)  # -> Model, Beams, Plates, Path, Issues
esito_operazione = Panel(midas_analyze_and_embed_results.Issues)

# ---- group: 05 | VERIFICA / LETTURA
validate = ValidateMidasModel(Model=model.Model)  # -> Valid, Issues, Fingerprint
summary = MidasModelSummary(Model=model.Model)
preview = PreviewMidasModel(Model=model.Model)  # -> Status, Issues, Breps, Names
decompose = DecomposeMidasModel(Model=model.Model)  # -> Node, Beam, Plate, Solid, Truss, Tension, Compression, ElasticLink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
physical = MidasPhysicalGeometry(Model=model.Model)  # -> Breps, Names, Issues
gate = StreamGate(Stream=midas_analyze_and_embed_results.Model, Gate=run_analisi)  # -> Target0, Target1
valido_dati_e_riferimenti = Panel(validate.Valid)
riepilogo = Panel(summary)

# ---- group: 06 | RISULTATI
result_cases = MidasModelResultCases(Model=gate.Target1)  # -> States, Quantities, Issues
decompose_2 = DecomposeMidasModel(Model=gate.Target1)  # -> Node, Beam, Plate, Solid, Truss, Tension, Compression, ElasticLink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
actions = MidasPlateActions(Source=gate.Target1)  # -> Fxx, Fyy, Fxy, Mxx, Myy, Mxy, Vxx, Vyy, States, Table
casi_stati = Panel(result_cases.States)
azioni_di_piastra = Panel(actions.Fxx)

# ---- group: 07 | APPROFONDIMENTI
deformed = MidasDeformedGeometry(Model=gate.Target1, Case="Q(ST)", Scale=100)  # -> Geometry, Translations, NodeIDs
actions_2 = MidasNodeReactions(Source=gate.Target1)  # -> FX, FY, FZ, MX, MY, MZ, States, Table
extrema = MidasResultExtrema(Table=actions.Table, Column="Mxx")  # -> Minimum, Maximum, GoverningRows
reazioni = Panel(actions_2.FX)
estremi_firmati = Panel(extrema.Minimum)
