# Grasshopper definition FEM_04_GEN_Parete.ghx (Grasshopper 1.0.8)
# plug-ins: Rhino2MidasGen
# Parete 4 x 3 m, spessore 0.20 m, base incastrata. Carico FX = 5 kN per nodo superiore: totale 10 kN.
# Modifica larghezza, altezza e spessore. Il piano Roof segue h; il toggle abilita il diaframma del piano.

# ---- group: 01 PARAMETRI
# 04 / GEN NX - Parete, piani e diaframma: Parete 4 x 3 m, spessore 0.20 m, base incastrata. Carico FX = 5 kN per nodo superiore: totale 10 kN.
# Modifica larghezza, altezza e spessore. Il piano Roof segue h; il toggle abilita il diaframma del piano.
diaframma_roof = BooleanToggle(True)
l_m = Slider(4, range=1..10)
h_m = Slider(3, range=1..6)
t_m = Slider(0.2, range=0.1..0.6)

# ---- group: 02 GEOMETRIA E PROPRIETA
A = ConstructPoint(XCoordinate=0, YCoordinate=0, ZCoordinate=0)
B = ConstructPoint(XCoordinate=l_m, YCoordinate=0, ZCoordinate=0)
C = ConstructPoint(XCoordinate=l_m, YCoordinate=0, ZCoordinate=h_m)
D = ConstructPoint(XCoordinate=0, YCoordinate=0, ZCoordinate=h_m)
node = MidasGENNode(Point=[A, B], ID=[1, 2])
node_2 = MidasGENNode(Point=[C, D], ID=[3, 4])
material = MidasGENIsotropicMaterial(ID=1, Name="C30", E=30000000, Poisson=0.2, WeightDensity=25, Thermal=1.2e-05, Type="CONC")
thickness = MidasGENPlateThickness(ID=1, Thickness=t_m, BendingThickness=0, Offset=0)
wall = MidasGENWall(
    ID=1,
    Points=[A, B, C, D],
    Material=material,
    Property=thickness,
    Angle=0,
    Nodes=[node, node_2],
    WallID=1,
    Subtype=2,
    Formulation=0)

# ---- group: 03 VINCOLI, CARICO E PIANI
support = MidasGENNodeSupport(Nodes=node, Mask="1111110")
load_case = MidasGENStaticLoadCase(ID=1, Name="WIND", Type="USER")  # -> Case, Name
nodal_load = MidasGENNodalLoad(Nodes=node_2, Case=load_case.Name, Loads=[5, 0, 0, 0, 0, 0])
story = MidasGENStory(ID=1, Name="Base", Level=0, RigidDiaphragm=False)
story_2 = MidasGENStory(ID=2, Name="Roof", Level=h_m, RigidDiaphragm=diaframma_roof)

# ---- group: 04 MODELLO
units = MidasGENModelUnits(Force="KN", Length="M", Temperature="C", Heat="KJ")
model = BuildMidasGENModel(Definitions=[wall, support, nodal_load, load_case.Case, story, story_2], Units=units, Tolerance=1e-06)  # -> Model, Issues

# ---- group: 05 CONTROLLI, PREVIEW E GEOMETRIA
validate = ValidateMidasGENModel(Model=model.Model)  # -> Valid, Issues, Fingerprint
summary = MidasGENModelSummary(Model=model.Model)
display_settings = MidasGENDisplaySettings(
    Enabled=True,
    Geometry=True,
    Sections=True,
    Loads=True,
    Supports=True,
    Springs=True,
    Masses=True,
    Releases=True,
    Offsets=True,
    OtherAttributes=True,
    Axes=False,
    Labels=False,
    Values=True,
    SymbolScale=0.2,
    LoadScale=0.05)
preview = PreviewMidasGENModel(Model=model.Model, Settings=display_settings)  # -> Status, Issues, Breps, Names
physical = MidasGENPhysicalGeometry(Model=model.Model)  # -> Breps, Names, Issues
decompose = DecomposeMidasGENModel(Model=model.Model)  # -> Node, Beam, Plate, Solid, Truss, Tension, Compression, ElasticLink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
element_info = DecomposeMidasGENWall(Element=decompose.Wall)  # -> ID, Geometry, Material, Property, Results, Angle, Nodes, WallID
validazione = Panel(validate.Valid)
riepilogo_modello = Panel(summary)
