# Grasshopper definition 01_Frame_polilinea.ghx (Grasshopper 1.0.8)
# plug-ins: Rhino2MidasGen
# Una polilinea genera tre elementi di un portale 4 x 3 m. Materiale e sezione si propagano agli elementi. Cambia b e h e controlla nodi, elementi e solidi.

# ---- group: 01 | INPUT E ISTRUZIONI
# COME USARE: Una polilinea genera tre elementi di un portale 4 x 3 m. Materiale e sezione si propagano agli elementi. Cambia b e h e controlla nodi, elementi e solidi.
polilinea_portale = Curve(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)
h_m = Slider(0.3, range=0.1..0.8)
b_m = Slider(0.2, range=0.05..0.6)

# ---- group: 02 | PROPRIETA / GEOMETRIA
# Frame, materiali e sezioni: Rhino2MidasGen | Frame, materiali e sezioni
# Una polilinea genera tre elementi di un portale 4 x 3 m. Materiale e sezione si propagano agli elementi. Cambia b e h e controlla nodi, elementi e solidi.
# Unita: kN / m / C. Geometrie incorporate. Le combinazioni sono didattiche.
material = MidasGENIsotropicMaterial(ID=1, Name="S355_DEMO", E=210000000, Poisson=0.3, WeightDensity=78.5, Thermal=1.2e-05, Type="STEEL")
rectangle = MidasGENRectangleSection(ID=1, Name="R200x300", Insertion="CC", Height=h_m, Width=b_m)
node = MidasGENNode(Point=Point(0, 0, 0), ID=100)
node_2 = MidasGENNode(Point=Point(4, 0, 0), ID=101)

# ---- group: 03 | ATTRIBUTI / CARICHI
polyline_beams = MidasGENPolylineToBeams(Polyline=polilinea_portale, FirstID=1, Material=material, Section=rectangle)
support = MidasGENNodeSupport(Nodes=node, Mask="1111110")
support_2 = MidasGENNodeSupport(Nodes=node_2, Mask="1111110")

# ---- group: 04 | MODEL / OPERAZIONI
model = BuildMidasGENModel(Definitions=flatten([polyline_beams, support, node_2, support_2]), Tolerance=1e-06)  # -> Model, Issues

# ---- group: 05 | VERIFICA / LETTURA
validate = ValidateMidasGENModel(Model=model.Model)  # -> Valid, Issues, Fingerprint
summary = MidasGENModelSummary(Model=model.Model)
preview = PreviewMidasGENModel(Model=model.Model)  # -> Status, Issues, Breps, Names
decompose = DecomposeMidasGENModel(Model=model.Model)  # -> Node, Beam, Plate, Solid, Truss, Tension, Compression, ElasticLink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
physical = MidasGENPhysicalGeometry(Model=model.Model)  # -> Breps, Names, Issues
valido_dati_e_riferimenti = Panel(validate.Valid)
riepilogo = Panel(summary)
