# Grasshopper definition 02_Mesh_quad.ghx (Grasshopper 1.0.8)
# plug-ins: Rhino2MidasGen
# Piastra 4 x 3 m: 9 nodi, 4 facce Quad4, spessore 0.20 m. Pressione -5 kN/m2 in Z globale e bordo incastrato. La discretizzazione serve a illustrare il flusso.

# ---- group: 01 | INPUT E ISTRUZIONI
# COME USARE: Piastra 4 x 3 m: 9 nodi, 4 facce Quad4, spessore 0.20 m. Pressione -5 kN/m2 in Z globale e bordo incastrato. La discretizzazione serve a illustrare il flusso.
mesh_incorporata = Mesh(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)
spessore_t_m = Slider(0.2, range=0.05..0.5)

# ---- group: 02 | PROPRIETA / GEOMETRIA
# Mesh quadrangolare e pressione: Rhino2MidasGen | Mesh quadrangolare e pressione
# Piastra 4 x 3 m: 9 nodi, 4 facce Quad4, spessore 0.20 m. Pressione -5 kN/m2 in Z globale e bordo incastrato. La discretizzazione serve a illustrare il flusso.
# Unita: kN / m / C. Geometrie incorporate. Le combinazioni sono didattiche.
material = MidasGENIsotropicMaterial(ID=1, Name="C30_DEMO", E=30000000, Poisson=0.2, WeightDensity=25, Thermal=1.2e-05, Type="CONC")
thickness = MidasGENPlateThickness(ID=1, Thickness=spessore_t_m, BendingThickness=0, Offset=0)
node = MidasGENNode(
    Point=[Point(0, 0, 0), Point(2, 0, 0), Point(4, 0, 0), Point(0, 1.5, 0), Point(4, 1.5, 0), Point(0, 3, 0), Point(2, 3, 0), Point(4, 3, 0)],
    ID=[100, 101, 102, 103, 104, 105, 106, 107])
load_case = MidasGENStaticLoadCase(ID=1, Name="Q", Type="L")  # -> Case, Name

# ---- group: 03 | ATTRIBUTI / CARICHI
mesh_plates = MidasGENMeshToPlates(Mesh=mesh_incorporata, FirstID=1, Material=material, Thickness=thickness)
support = MidasGENNodeSupport(Nodes=node, Mask="1111110")
pressure = MidasGENPlatePressure(Plate=mesh_plates, Case=load_case.Name, Pressure=-5, Direction="GZ")

# ---- group: 04 | MODEL / OPERAZIONI
model = BuildMidasGENModel(Definitions=flatten([pressure, support, load_case.Case]), Tolerance=1e-06)  # -> Model, Issues

# ---- group: 05 | VERIFICA / LETTURA
validate = ValidateMidasGENModel(Model=model.Model)  # -> Valid, Issues, Fingerprint
summary = MidasGENModelSummary(Model=model.Model)
preview = PreviewMidasGENModel(Model=model.Model)  # -> Status, Issues, Breps, Names
decompose = DecomposeMidasGENModel(Model=model.Model)  # -> Node, Beam, Plate, Solid, Truss, Tension, Compression, ElasticLink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
physical = MidasGENPhysicalGeometry(Model=model.Model)  # -> Breps, Names, Issues
valido_dati_e_riferimenti = Panel(validate.Valid)
riepilogo = Panel(summary)
