# Grasshopper definition 04_Solidi.ghx (Grasshopper 1.0.8)
# plug-ins: Rhino2MidasGen
# Un cubo di lato 1 m, otto vertici ordinati, materiale elastico e base incastrata. Il Brep fisico deve essere chiuso. La connettivita conta: non riordinare casualmente i vertici.

# ---- group: 02 | PROPRIETA / GEOMETRIA
# Solidi Hexa8: Rhino2MidasGen | Solidi Hexa8
# Un cubo di lato 1 m, otto vertici ordinati, materiale elastico e base incastrata. Il Brep fisico deve essere chiuso. La connettivita conta: non riordinare casualmente i vertici.
# Unita: kN / m / C. Geometrie incorporate. Le combinazioni sono didattiche.
# COME USARE: Un cubo di lato 1 m, otto vertici ordinati, materiale elastico e base incastrata. Il Brep fisico deve essere chiuso. La connettivita conta: non riordinare casualmente i vertici.
material = MidasGENIsotropicMaterial(ID=1, Name="C30_DEMO", E=30000000, Poisson=0.2, WeightDensity=25, Thermal=1.2e-05, Type="CONC")
node = MidasGENNode(
    Point=[Point(0, 0, 0), Point(1, 0, 0), Point(1, 1, 0), Point(0, 1, 0), Point(0, 0, 1), Point(1, 0, 1), Point(1, 1, 1), Point(0, 1, 1)],
    ID=[1, 2, 3, 4, 5, 6, 7, 8])
node_2 = MidasGENNode(Point=[Point(0, 0, 0), Point(1, 0, 0), Point(1, 1, 0), Point(0, 1, 0)], ID=[1, 2, 3, 4])

# ---- group: 03 | ATTRIBUTI / CARICHI
support = MidasGENNodeSupport(Nodes=node_2, Mask="1111110")
solid = MidasGENSolid(
    ID=1,
    Points=[Point(0, 0, 0), Point(1, 0, 0), Point(1, 1, 0), Point(0, 1, 0), Point(0, 0, 1), Point(1, 0, 1), Point(1, 1, 1), Point(0, 1, 1)],
    Material=material,
    Angle=0,
    Nodes=node)

# ---- group: 04 | MODEL / OPERAZIONI
model = BuildMidasGENModel(Definitions=flatten([solid, support]), Tolerance=1e-06)  # -> Model, Issues

# ---- group: 05 | VERIFICA / LETTURA
validate = ValidateMidasGENModel(Model=model.Model)  # -> Valid, Issues, Fingerprint
summary = MidasGENModelSummary(Model=model.Model)
preview = PreviewMidasGENModel(Model=model.Model)  # -> Status, Issues, Breps, Names
decompose = DecomposeMidasGENModel(Model=model.Model)  # -> Node, Beam, Plate, Solid, Truss, Tension, Compression, ElasticLink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
physical = MidasGENPhysicalGeometry(Model=model.Model)  # -> Breps, Names, Issues
valido_dati_e_riferimenti = Panel(validate.Valid)
riepilogo = Panel(summary)
