# Grasshopper definition 07_Assi_offset_svincoli.ghx (Grasshopper 1.0.8)
# plug-ins: Rhino2MidasGen
# Una catena modifica lo stesso elemento: orientamento, eccentricita, rilascio terminale. Build riceve soltanto l'ultima versione.

# ---- group: 01 | INPUT E ISTRUZIONI
# COME USARE: Una catena modifica lo stesso elemento: orientamento, eccentricita, rilascio terminale. Build riceve soltanto l'ultima versione.
# SVINCOLO DIDATTICO: Prima dell'analisi verificare che non introduca gradi di liberta isolati. Gli offset spostano la sezione fisica rispetto all'asse.
asse_trave = Curve(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)
h_m = Slider(0.3, range=0.1..0.8)
b_m = Slider(0.2, range=0.05..0.6)

# ---- group: 02 | PROPRIETA / GEOMETRIA
# Assi locali, offset e svincoli: Rhino2MidasGen | Assi locali, offset e svincoli
# Una catena modifica lo stesso elemento: orientamento, eccentricita, rilascio terminale. Build riceve soltanto l'ultima versione.
# Unita: kN / m / C. Geometrie incorporate. Le combinazioni sono didattiche.
material = MidasGENIsotropicMaterial(ID=1, Name="S355_DEMO", E=210000000, Poisson=0.3, WeightDensity=78.5, Thermal=1.2e-05, Type="STEEL")
rectangle = MidasGENRectangleSection(ID=1, Name="R200x300", Insertion="CC", Height=h_m, Width=b_m)
node = MidasGENNode(Point=Point(0, 0, 0), ID=100)
node_2 = MidasGENNode(Point=Point(3, 0, 0), ID=101)

# ---- group: 03 | ATTRIBUTI / CARICHI
beam = MidasGENBeam(ID=1, Points=[Point(0, 0, 0), Point(3, 0, 0)], Material=material, Property=rectangle, Angle=0)
support = MidasGENNodeSupport(Nodes=node, Mask="1111110")
align = AlignMidasGENBeamAxis(Definition=beam, Direction=Vector(0, 0, 1))
offset = MidasGENBeamEndOffset(Beam=align, IOffset=Vector(0, 0, 0.05), JOffset=Vector(0, 0, 0.05))
releases = MidasGENBeamReleases(Beam=offset, IMask="000000", JMask="000001")

# ---- group: 04 | MODEL / OPERAZIONI
model = BuildMidasGENModel(Definitions=flatten([support, node_2, releases]), Tolerance=1e-06)  # -> Model, Issues

# ---- group: 05 | VERIFICA / LETTURA
validate = ValidateMidasGENModel(Model=model.Model)  # -> Valid, Issues, Fingerprint
summary = MidasGENModelSummary(Model=model.Model)
preview = PreviewMidasGENModel(Model=model.Model)  # -> Status, Issues, Breps, Names
decompose = DecomposeMidasGENModel(Model=model.Model)  # -> Node, Beam, Plate, Solid, Truss, Tension, Compression, ElasticLink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
physical = MidasGENPhysicalGeometry(Model=model.Model)  # -> Breps, Names, Issues
valido_dati_e_riferimenti = Panel(validate.Valid)
riepilogo = Panel(summary)
