# Grasshopper definition 11_Import_model.ghx (Grasshopper 1.0.8)
# plug-ins: Rhino2MidasGen
# Leggi il modello nativo e ottieni il Model associato. Controlla Issues per conoscere dati importati e limiti.

# ---- group: 01 | INPUT E ISTRUZIONI
# Modello esistente verso Grasshopper: Rhino2MidasGen | Modello esistente verso Grasshopper
# Leggi il modello nativo e ottieni il Model associato. Controlla Issues per conoscere dati importati e limiti.
# Unita: quelle restituite dal lettore; vedere Summary.
# COME USARE: Leggi il modello nativo e ottieni il Model associato. Controlla Issues per conoscere dati importati e limiti.
# DOCUMENTO ATTIVO: Apri il file nel prodotto corretto e attiva l'API. READ legge il documento attivo senza sostituirlo. Le tabelle aggiuntive sono opzionali.
# UNITA DEL MODELLO: Il Model mantiene le unita del documento nativo. Controllare Summary e non forzare kN/m su dati in altre unita.
read_model = BooleanToggle(False)

# ---- group: 03 | ATTRIBUTI / CARICHI
read_gen = ReadActiveMidasGENModel(Run=read_model)  # -> Model, Issues, Tables

# ---- group: 02 | PROPRIETA / GEOMETRIA
connection = MidasGENAPIConnection()
connessione = Panel(connection)

# ---- group: 04 | MODEL / OPERAZIONI
gate = StreamGate(Stream=read_gen.Model, Gate=read_model)  # -> Target0, Target1
import_limiti = Panel(read_gen.Issues)
tabelle_lette = Panel(read_gen.Tables)

# ---- group: 05 | VERIFICA / LETTURA
validate = ValidateMidasGENModel(Model=gate.Target1)  # -> Valid, Issues, Fingerprint
summary = MidasGENModelSummary(Model=gate.Target1)
preview = PreviewMidasGENModel(Model=gate.Target1)  # -> Status, Issues, Breps, Names
decompose = DecomposeMidasGENModel(Model=gate.Target1)  # -> Node, Beam, Plate, Solid, Truss, Tension, Compression, ElasticLink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
physical = MidasGENPhysicalGeometry(Model=gate.Target1)  # -> Breps, Names, Issues
valido_dati_e_riferimenti = Panel(validate.Valid)
riepilogo = Panel(summary)
