# Grasshopper definition 14_Rilettura_risultati.ghx (Grasshopper 1.0.8)
# plug-ins: Rhino2MidasGen
# Seleziona il risultato/archivio dell'esempio 12. Il Model deve essere identico a quello dell'analisi; READ legge senza rilanciare il solver.

# ---- group: 01 | INPUT E ISTRUZIONI
# COME USARE: Seleziona il risultato/archivio dell'esempio 12. Il Model deve essere identico a quello dell'analisi; READ legge senza rilanciare il solver.
# LETTORI IN ATTESA: Stream Gate chiude il ramo finche RUN/READ=false. Dopo il calcolo scegli un caso reale. MIDAS usa etichette come Q(ST): controlla quelle restituite. Gli inviluppi non sono una deformata simultanea.
# PROVENIENZA: Gli archivi verificano impronta e file sorgente. In caso di mismatch ripristinare il Model corretto o ricalcolare; non disattivare la verifica per attribuire risultati a geometrie diverse.
asse_trave = Curve(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)
# Risultati gia calcolati: Rhino2MidasGen | Risultati gia calcolati
# Seleziona il risultato/archivio dell'esempio 12. Il Model deve essere identico a quello dell'analisi; READ legge senza rilanciare il solver.
# Unita: kN / m / C. Geometrie incorporate. Le combinazioni sono didattiche.
read_risultati = BooleanToggle(False)
path_percorso_locale_modificabile = Panel("C:\Users\g.pacini\Documents\Rhino2FEM_Examples\Rhino2MidasGen\12_Analisi_frame.mgb.results.json")
h_m = Slider(0.3, range=0.1..0.8)
b_m = Slider(0.2, range=0.05..0.6)

# ---- group: 02 | PROPRIETA / GEOMETRIA
material = MidasGENIsotropicMaterial(ID=1, Name="S355_DEMO", E=210000000, Poisson=0.3, WeightDensity=78.5, Thermal=1.2e-05, Type="STEEL")
rectangle = MidasGENRectangleSection(ID=1, Name="R200x300", Insertion="CC", Height=h_m, Width=b_m)
node = MidasGENNode(Point=Point(0, 0, 0), ID=100)
node_2 = MidasGENNode(Point=Point(3, 0, 0), ID=101)
load_case = MidasGENStaticLoadCase(ID=1, Name="Q", Type="L")  # -> Case, Name

# ---- group: 03 | ATTRIBUTI / CARICHI
beam = MidasGENBeam(ID=1, Points=[Point(0, 0, 0), Point(3, 0, 0)], Material=material, Property=rectangle, Angle=0)
support = MidasGENNodeSupport(Nodes=node, Mask="1111110")
nodal_load = MidasGENNodalLoad(Nodes=node_2, Case=load_case.Name, Loads=[0, 0, -10, 0, 0, 0])
gate = StreamGate(Stream=path_percorso_locale_modificabile, Gate=read_risultati)  # -> Target0, Target1

# ---- group: 04 | MODEL / OPERAZIONI
model = BuildMidasGENModel(Definitions=flatten([beam, support, nodal_load, load_case.Case]), Tolerance=1e-06)  # -> Model, Issues
read_results = ReadMidasGENResultsIntoModel(Model=model.Model, Archive=gate.Target1)

# ---- group: 05 | VERIFICA / LETTURA
validate = ValidateMidasGENModel(Model=model.Model)  # -> Valid, Issues, Fingerprint
summary = MidasGENModelSummary(Model=model.Model)
preview = PreviewMidasGENModel(Model=model.Model)  # -> Status, Issues, Breps, Names
decompose = DecomposeMidasGENModel(Model=model.Model)  # -> Node, Beam, Plate, Solid, Truss, Tension, Compression, ElasticLink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
physical = MidasGENPhysicalGeometry(Model=model.Model)  # -> Breps, Names, Issues
gate_2 = StreamGate(Stream=read_results, Gate=read_risultati)  # -> Target0, Target1
valido_dati_e_riferimenti = Panel(validate.Valid)
riepilogo = Panel(summary)

# ---- group: 06 | RISULTATI
result_cases = MidasGENModelResultCases(Model=gate_2.Target1)  # -> States, Quantities, Issues
decompose_2 = DecomposeMidasGENModel(Model=gate_2.Target1)  # -> Node, Beam, Plate, Solid, Truss, Tension, Compression, ElasticLink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
actions = MidasGENBeamActions(Source=gate_2.Target1)  # -> Axial, ShearY, ShearZ, Torsion, MomentY, MomentZ, States, Table
casi_stati = Panel(result_cases.States)
azioni_di_trave = Panel(actions.Axial)

# ---- group: 07 | APPROFONDIMENTI
deformed = MidasGENDeformedGeometry(Model=gate_2.Target1, Case="Q(ST)", Scale=100)  # -> Geometry, Translations, NodeIDs
actions_2 = MidasGENNodeReactions(Source=gate_2.Target1)  # -> FX, FY, FZ, MX, MY, MZ, States, Table
extrema = MidasGENResultExtrema(Table=actions.Table, Column="Moment-y")  # -> Minimum, Maximum, GoverningRows
diagram = MidasGENBeamForceDiagram(Beam=decompose_2.Beam, Table=actions.Table, Column="Moment-y", Direction=Vector(0, 0, 1), Scale=0.01)  # -> Diagram, Ordinates, Values
reazioni = Panel(actions_2.FX)
estremi_firmati = Panel(extrema.Minimum)
