# Grasshopper definition 15_Preview_bake.ghx (Grasshopper 1.0.8)
# plug-ins: Rhino2MidasGen
# Confronta assi e solidi fisici. La preview e temporanea; il bake crea oggetti nel documento Rhino. BAKE parte spento.

# ---- group: 01 | INPUT E ISTRUZIONI
# COME USARE: Confronta assi e solidi fisici. La preview e temporanea; il bake crea oggetti nel documento Rhino. BAKE parte spento.
asse_trave = Curve(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)
# Preview, impostazioni e bake: Rhino2MidasGen | Preview, impostazioni e bake
# Confronta assi e solidi fisici. La preview e temporanea; il bake crea oggetti nel documento Rhino. BAKE parte spento.
# Unita: kN / m / C. Geometrie incorporate. Le combinazioni sono didattiche.
etichette = BooleanToggle(True)
bake_solidi = BooleanToggle(False)
h_m = Slider(0.3, range=0.1..0.8)
b_m = Slider(0.2, range=0.05..0.6)

# ---- group: 02 | PROPRIETA / GEOMETRIA
material = MidasGENIsotropicMaterial(ID=1, Name="S355_DEMO", E=210000000, Poisson=0.3, WeightDensity=78.5, Thermal=1.2e-05, Type="STEEL")
rectangle = MidasGENRectangleSection(ID=1, Name="R200x300", Insertion="CC", Height=h_m, Width=b_m)
node = MidasGENNode(Point=Point(0, 0, 0), ID=100)
node_2 = MidasGENNode(Point=Point(3, 0, 0), ID=101)
load_case = MidasGENStaticLoadCase(ID=1, Name="Q", Type="L")  # -> Case, Name

# ---- group: 03 | ATTRIBUTI / CARICHI
beam = MidasGENBeam(ID=1, Points=[Point(0, 0, 0), Point(3, 0, 0)], Material=material, Property=rectangle, Angle=0)
support = MidasGENNodeSupport(Nodes=node, Mask="1111110")
nodal_load = MidasGENNodalLoad(Nodes=node_2, Case=load_case.Name, Loads=[0, 0, -10, 0, 0, 0])

# ---- group: 04 | MODEL / OPERAZIONI
model = BuildMidasGENModel(Definitions=flatten([beam, support, nodal_load, load_case.Case]), Tolerance=1e-06)  # -> Model, Issues

# ---- group: 05 | VERIFICA / LETTURA
validate = ValidateMidasGENModel(Model=model.Model)  # -> Valid, Issues, Fingerprint
summary = MidasGENModelSummary(Model=model.Model)
preview = PreviewMidasGENModel(Model=model.Model)  # -> Status, Issues, Breps, Names
decompose = DecomposeMidasGENModel(Model=model.Model)  # -> Node, Beam, Plate, Solid, Truss, Tension, Compression, ElasticLink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
physical = MidasGENPhysicalGeometry(Model=model.Model)  # -> Breps, Names, Issues
valido_dati_e_riferimenti = Panel(validate.Valid)
riepilogo = Panel(summary)

# ---- group: 06 | RISULTATI
display_settings = MidasGENDisplaySettings(
    Enabled=True,
    Geometry=True,
    Sections=True,
    Loads=True,
    Supports=True,
    Springs=True,
    Masses=True,
    Releases=True,
    Offsets=True,
    OtherAttributes=True,
    Axes=False,
    Labels=etichette,
    Values=True,
    SymbolScale=0.2,
    LoadScale=0.05)
preview_2 = PreviewMidasGENModel(Model=model.Model, Settings=display_settings)  # -> Status, Issues, Breps, Names
physical_2 = MidasGENPhysicalGeometry(Model=model.Model)  # -> Breps, Names, Issues
bake = BakeMidasGENGeometry(Model=model.Model, Physical=True, Bake=bake_solidi)  # -> ObjectIDs, Issues
