# Grasshopper definition 16_JSON_trasformazioni.ghx (Grasshopper 1.0.8)
# plug-ins: Rhino2MidasGen
# Il Model passa a JSON e ritorna senza file. Sposta e ruota una copia: le trasformazioni invalidano eventuali risultati.

# ---- group: 01 | INPUT E ISTRUZIONI
# COME USARE: Il Model passa a JSON e ritorna senza file. Sposta e ruota una copia: le trasformazioni invalidano eventuali risultati.
asse_trave = Curve(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)
h_m = Slider(0.3, range=0.1..0.8)
b_m = Slider(0.2, range=0.05..0.6)

# ---- group: 02 | PROPRIETA / GEOMETRIA
# JSON, spostamento e rotazione: Rhino2MidasGen | JSON, spostamento e rotazione
# Il Model passa a JSON e ritorna senza file. Sposta e ruota una copia: le trasformazioni invalidano eventuali risultati.
# Unita: kN / m / C. Geometrie incorporate. Le combinazioni sono didattiche.
material = MidasGENIsotropicMaterial(ID=1, Name="S355_DEMO", E=210000000, Poisson=0.3, WeightDensity=78.5, Thermal=1.2e-05, Type="STEEL")
rectangle = MidasGENRectangleSection(ID=1, Name="R200x300", Insertion="CC", Height=h_m, Width=b_m)
node = MidasGENNode(Point=Point(0, 0, 0), ID=100)
node_2 = MidasGENNode(Point=Point(3, 0, 0), ID=101)
load_case = MidasGENStaticLoadCase(ID=1, Name="Q", Type="L")  # -> Case, Name

# ---- group: 03 | ATTRIBUTI / CARICHI
beam = MidasGENBeam(ID=1, Points=[Point(0, 0, 0), Point(3, 0, 0)], Material=material, Property=rectangle, Angle=0)
support = MidasGENNodeSupport(Nodes=node, Mask="1111110")
nodal_load = MidasGENNodalLoad(Nodes=node_2, Case=load_case.Name, Loads=[0, 0, -10, 0, 0, 0])

# ---- group: 04 | MODEL / OPERAZIONI
model = BuildMidasGENModel(Definitions=flatten([beam, support, nodal_load, load_case.Case]), Tolerance=1e-06)  # -> Model, Issues
model_json = MidasGENModelToJSON(Model=model.Model)
read_json = MidasGENModelFromJSON(JSON=model_json)

# ---- group: 05 | VERIFICA / LETTURA
validate = ValidateMidasGENModel(Model=read_json)  # -> Valid, Issues, Fingerprint
summary = MidasGENModelSummary(Model=read_json)
preview = PreviewMidasGENModel(Model=read_json)  # -> Status, Issues, Breps, Names
decompose = DecomposeMidasGENModel(Model=read_json)  # -> Node, Beam, Plate, Solid, Truss, Tension, Compression, ElasticLink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
physical = MidasGENPhysicalGeometry(Model=read_json)  # -> Breps, Names, Issues
valido_dati_e_riferimenti = Panel(validate.Valid)
riepilogo = Panel(summary)

# ---- group: 06 | RISULTATI
move = MoveMidasGENModel(Definition=read_json, Translation=Vector(0, 2, 0))
rotate = RotateMidasGENModel(Definition=move, Angle=30, Axis=Vector(0, 0, 1), Center=Point(0, 0, 0))
model_2 = BuildMidasGENModel(Definitions=flatten(rotate), Tolerance=1e-06)  # -> Model, Issues

# ---- group: 07 | APPROFONDIMENTI
validate_2 = ValidateMidasGENModel(Model=model_2.Model)  # -> Valid, Issues, Fingerprint
summary_2 = MidasGENModelSummary(Model=model_2.Model)
preview_2 = PreviewMidasGENModel(Model=model_2.Model)  # -> Status, Issues, Breps, Names
decompose_2 = DecomposeMidasGENModel(Model=model_2.Model)  # -> Node, Beam, Plate, Solid, Truss, Tension, Compression, ElasticLink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
physical_2 = MidasGENPhysicalGeometry(Model=model_2.Model)  # -> Breps, Names, Issues
valido_dati_e_riferimenti_2 = Panel(validate_2.Valid)
riepilogo_2 = Panel(summary_2)
