# Grasshopper definition 17_Pareti_piani.ghx (Grasshopper 1.0.8)
# plug-ins: Rhino2MidasGen
# Modello GEN con parete, piani e diaframma. Il gruppo parete ha identita distinta dall'elemento. Aggiunta di un piano dimostrativo.

# ---- group: 02 | PROPRIETA / GEOMETRIA
# Pareti, piani e diaframmi: Rhino2MidasGen | Pareti, piani e diaframmi
# Modello GEN con parete, piani e diaframma. Il gruppo parete ha identita distinta dall'elemento. Aggiunta di un piano dimostrativo.
# Unita: kN / m / C. Geometrie incorporate. Le combinazioni sono didattiche.
# COME USARE: Modello GEN con parete, piani e diaframma. Il gruppo parete ha identita distinta dall'elemento. Aggiunta di un piano dimostrativo.
# PIANI: Story aggiunge i dati del piano, non crea automaticamente la geometria della struttura. Il piano aggiuntivo in questo esempio non ha elementi associati.
wall_example = MidasGENWallAndStoryExample()
story = MidasGENStory(ID=3, Name="Piano_demo", Level=6, RigidDiaphragm=False)

# ---- group: 05 | VERIFICA / LETTURA
validate = ValidateMidasGENModel(Model=wall_example)  # -> Valid, Issues, Fingerprint
summary = MidasGENModelSummary(Model=wall_example)
preview = PreviewMidasGENModel(Model=wall_example)  # -> Status, Issues, Breps, Names
decompose = DecomposeMidasGENModel(Model=wall_example)  # -> Node, Beam, Plate, Solid, Truss, Tension, Compression, ElasticLink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
physical = MidasGENPhysicalGeometry(Model=wall_example)  # -> Breps, Names, Issues
valido_dati_e_riferimenti = Panel(validate.Valid)
riepilogo = Panel(summary)

# ---- group: 06 | RISULTATI
element_info = DecomposeMidasGENWall(Element=decompose.Wall)  # -> ID, Geometry, Material, Property, Results, Angle, Nodes, WallID
dati_parete = Panel(element_info.ID)

# ---- group: 04 | MODEL / OPERAZIONI
model = BuildMidasGENModel(Definitions=flatten([wall_example, story]), Tolerance=1e-06)  # -> Model, Issues

# ---- group: 07 | APPROFONDIMENTI
validate_2 = ValidateMidasGENModel(Model=model.Model)  # -> Valid, Issues, Fingerprint
summary_2 = MidasGENModelSummary(Model=model.Model)
preview_2 = PreviewMidasGENModel(Model=model.Model)  # -> Status, Issues, Breps, Names
decompose_2 = DecomposeMidasGENModel(Model=model.Model)  # -> Node, Beam, Plate, Solid, Truss, Tension, Compression, ElasticLink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
physical_2 = MidasGENPhysicalGeometry(Model=model.Model)  # -> Breps, Names, Issues
valido_dati_e_riferimenti_2 = Panel(validate_2.Valid)
riepilogo_2 = Panel(summary_2)
