# Grasshopper definition 01_Trave_carico_preview_bake.ghx (Grasshopper 1.0.8)
# plug-ins: Rhino2SAP

# ---- group: 01 MATERIALE / SEZIONE
# RHINO2SAP / 01 TRAVE / PREVIEW / BREP: Unita: kN, m, C. Trave a mensola lunga 3 m, sezione 0.20 x 0.10 m.
# F = -10 kN lungo Z; incastro al nodo BASE.
# Prova a modificare altezza, larghezza o vettore del carico. Spegni Mostra carichi.
# Le coordinate di asse e nodi sono incorporate; se le cambi, mantienile coerenti.
acciaio = SAPIsotropicMaterial(Name="S355", Type=1, E=210000000, Poisson=0.3, Alpha=1.2e-05, WeightDensity=78.5)
altezza_h_m = Slider(0.2, range=0.05..1)
larghezza_b_m = Slider(0.1, range=0.03..0.8)
rettangolo = SAPFrameSectionRectangle(Name="R20x10", MatProp=acciaio, T3=altezza_h_m, T2=larghezza_b_m, Color=-1)  # -> Definition, Name

# ---- group: 02 ELEMENTO / NODI / VINCOLO
beam_f1 = SAPFrameElement(Name="F1", Line=Line((0, 0, 0), (3, 0, 0)), Property=rettangolo.Definition)  # -> Element, Name
nodo_base = SAPNodeElement(Name="BASE", Point=Point(0, 0, 0))  # -> Element, Name
nodo_tip = SAPNodeElement(Name="TIP", Point=Point(3, 0, 0))  # -> Element, Name
incastro = SAPNodeRestraint(Name=nodo_base.Element, Value=[True, True, True, True, True, True], ItemType=0)  # -> Definition, Name

# ---- group: 03 PATTERN / CARICO NODALE
pattern_q = SAPLoadPattern(Name="Q", Type=8, SelfWeight=0)
carico_fx_fy_fz_mx_my_mz = Panel("""0
0
-10
0
0
0""")
forza_al_tip = SAPNodeLoadForce(Name=nodo_tip.Element, LoadPat=pattern_q, Value=carico_fx_fy_fz_mx_my_mz, Replace=False, CSys="Global", ItemType=0)  # -> Definition, Name

# ----
build_model = BuildSAPModel(Definitions=[beam_f1.Element, incastro.Definition, forza_al_tip.Definition], Units=6, Tolerance=1e-06)  # -> Model, Issues

# ---- group: 04 CONTROLLO / PREVIEW / BREP / BAKE
# Preview e bake: B = Brep chiusi, N = nomi SAP.
# Brep: tasto destro > Bake.
# Oppure BAKE SOLIDI: False > True.
# La geometria non richiede SAP.
# Modificare gli switch nel componente Display.
mostra_carichi = BooleanToggle(True)
display = SAPDisplaySettings(
    Enabled=True,
    Geometry=True,
    Sections=True,
    Loads=mostra_carichi,
    Supports=True,
    Springs=True,
    Masses=True,
    Releases=True,
    Offsets=True,
    OtherAttributes=True,
    Axes=True,
    Labels=True,
    Values=True,
    SymbolScale=0.2,
    LoadScale=0.05)
preview_brep = PreviewSAPModel(Model=build_model.Model, Settings=display)  # -> Status, Issues, Breps, BrepNames
solidi_brep = Brep(preview_brep.Breps)
controllo_modello = ValidateSAPModel(Model=build_model.Model)  # -> Valid, Errors, Fingerprint
riepilogo = SAPModelSummary(Model=build_model.Model)
bake_solidi = BooleanToggle(False)
bake_solidi_2 = BakeSAPGeometry(Model=build_model.Model, Physical=True, Bake=bake_solidi, SolidOnly=True)  # -> ObjectIDs, Issues
modello_valido = Panel(controllo_modello.Valid)
riepilogo_modello = Panel(riepilogo)
preview_limiti_issues = Panel(preview_brep.Issues)
