# Grasshopper definition 02_Piastra_mesh_pressione.ghx (Grasshopper 1.0.8)
# plug-ins: Rhino2SAP

# ---- group: 01 MATERIALE / PROPRIETA SHELL
# RHINO2SAP / 02 PIASTRA DISCRETIZZATA: Unita: kN, m, C. Piastra 4 x 4 m; 4 shell quadrangolari, spessore 0.20 m.
# 8 nodi di bordo incastrati; nodo centrale libero. Pressione -5 kN/m2 lungo Z globale.
# Mesh e coordinate sono incorporate: non serve un file Rhino.
# Mesh volutamente grossolana per illustrare i collegamenti; raffinarla prima di un uso progettuale.
calcestruzzo = SAPIsotropicMaterial(Name="C30_DEMO", Type=2, E=30000000, Poisson=0.2, Alpha=1.2e-05, WeightDensity=25)
spessore_t_m = Slider(0.2, range=0.05..0.5)
shell_sottile = SAPAreaPropertyShell1(
    Name="SHELL20",
    ShellType=1,
    IncludeDrillingDOF=True,
    MatProp=calcestruzzo,
    MatAng=0,
    Thickness=spessore_t_m,
    Bending=spessore_t_m,
    Color=-1)  # -> Definition, Name

# ---- group: 02 MESH / ELEMENTI / BORDO
mesh_2x2 = Mesh(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)
_4_plate_a1_a4 = MeshToSAPAreas(Mesh=mesh_2x2, Prefix="A", Property=shell_sottile.Definition)
nodi_di_bordo = SAPNodeElement(
    Name=["B1", "B2", "B3", "B4", "B5", "B6", "B7", "B8"],
    Point=[Point(0, 0, 0), Point(2, 0, 0), Point(4, 0, 0), Point(0, 2, 0), Point(4, 2, 0), Point(0, 4, 0), Point(2, 4, 0), Point(4, 4, 0)])  # -> Element, Name
incastri_bordo = SAPNodeRestraint(Name=nodi_di_bordo.Element, Value=[True, True, True, True, True, True], ItemType=0)  # -> Definition, Name

# ---- group: 03 CARICO UNIFORME / GRUPPO
# Assegnazione a tutte le shell: Name=ALL, ItemType=1: gruppo ALL.
# Dir=6: Z Global; Value<0: verso -Z.
# Self weight=0: solo carico assegnato.
pattern_q = SAPLoadPattern(Name="Q", Type=8, SelfWeight=0)
pressione_z_kn_m2 = Slider(-5, range=-20..0)
pressione_sulle_shell = SAPAreaLoadUniform(
    Definitions=_4_plate_a1_a4,
    Name="ALL",
    LoadPat=pattern_q,
    Value=pressione_z_kn_m2,
    Dir=6,
    Replace=True,
    CSys="Global",
    ItemType=1)  # -> Definition, Name

# ----
build_model = BuildSAPModel(Definitions=[pressione_sulle_shell.Definition, incastri_bordo.Definition], Units=6, Tolerance=1e-06)  # -> Model, Issues

# ---- group: 04 CONTROLLO / PREVIEW / BREP / BAKE
# Preview e bake: B = Brep chiusi, N = nomi SAP.
# Brep: tasto destro > Bake.
# Oppure BAKE SOLIDI: False > True.
# La geometria non richiede SAP.
# Modificare gli switch nel componente Display.
mostra_carichi = BooleanToggle(True)
display = SAPDisplaySettings(
    Enabled=True,
    Geometry=True,
    Sections=True,
    Loads=mostra_carichi,
    Supports=True,
    Springs=True,
    Masses=True,
    Releases=True,
    Offsets=True,
    OtherAttributes=True,
    Axes=True,
    Labels=True,
    Values=True,
    SymbolScale=0.2,
    LoadScale=0.05)
preview_brep = PreviewSAPModel(Model=build_model.Model, Settings=display)  # -> Status, Issues, Breps, BrepNames
solidi_brep = Brep(preview_brep.Breps)
controllo_modello = ValidateSAPModel(Model=build_model.Model)  # -> Valid, Errors, Fingerprint
riepilogo = SAPModelSummary(Model=build_model.Model)
bake_solidi = BooleanToggle(False)
bake_solidi_2 = BakeSAPGeometry(Model=build_model.Model, Physical=True, Bake=bake_solidi, SolidOnly=True)  # -> ObjectIDs, Issues
modello_valido = Panel(controllo_modello.Valid)
riepilogo_modello = Panel(riepilogo)
preview_limiti_issues = Panel(preview_brep.Issues)

# ---- group: 05 DECOMPOSIZIONE / INTERROGAZIONE
decomponi_modello = DecomposeSAPModel(Model=build_model.Model)  # -> Node, Frame, Area, Solid, Link, Cable, Operations, Units, Results
nomi_delle_plate = SAPElementInfo(Definition=decomponi_modello.Area)  # -> Names, Kinds, Properties, Elements
plate_del_modello = Panel(nomi_delle_plate.Names)
