# Grasshopper definition 03_Analisi_assiale_risultati.ghx (Grasshopper 1.0.8)
# plug-ins: Rhino2SAP

# ---- group: 01 MATERIALE / SEZIONE
# RHINO2SAP / 03 ANALISI E RISULTATI: Unita: kN, m, C. Trave a mensola lunga 3 m, sezione 0.20 x 0.10 m.
# F = +1 kN lungo X. E = 210e6 kN/m2. Atteso Ux = FL/EA = 7.142857e-7 m.
# Il ramo di analisi e sotto: RUN SAP parte da False.
acciaio = SAPIsotropicMaterial(Name="S355", Type=1, E=210000000, Poisson=0.3, Alpha=1.2e-05, WeightDensity=78.5)
altezza_h_m = Slider(0.2, range=0.05..1)
# 05 ESEGUIRE L'ANALISI: 1. Scegli un nuovo percorso .sdb nel pannello Path.
# 2. Porta RUN SAP da False a True. Per rilanciare, torna prima a False.
# 3. I componenti dei risultati si popolano dopo il completamento dell'analisi.
# Prima del run restano in attesa: non contengono risultati simulati.
# SLS e ULS_DEMO sono nomi didattici; il fattore 1.5 non rappresenta una combinazione normativa.
larghezza_b_m = Slider(0.1, range=0.03..0.8)
rettangolo = SAPFrameSectionRectangle(Name="R20x10", MatProp=acciaio, T3=altezza_h_m, T2=larghezza_b_m, Color=-1)  # -> Definition, Name

# ---- group: 02 ELEMENTO / NODI / VINCOLO
beam_f1 = SAPFrameElement(Name="F1", Line=Line((0, 0, 0), (3, 0, 0)), Property=rettangolo.Definition)  # -> Element, Name
nodo_base = SAPNodeElement(Name="BASE", Point=Point(0, 0, 0))  # -> Element, Name
nodo_tip = SAPNodeElement(Name="TIP", Point=Point(3, 0, 0))  # -> Element, Name
incastro = SAPNodeRestraint(Name=nodo_base.Element, Value=[True, True, True, True, True, True], ItemType=0)  # -> Definition, Name

# ---- group: 03 PATTERN / CARICO NODALE
pattern_q = SAPLoadPattern(Name="Q", Type=8, SelfWeight=0)
carico_fx_fy_fz_mx_my_mz = Panel("""1
0
0
0
0
0""")
forza_al_tip = SAPNodeLoadForce(Name=nodo_tip.Element, LoadPat=pattern_q, Value=carico_fx_fy_fz_mx_my_mz, Replace=False, CSys="Global", ItemType=0)  # -> Definition, Name

# ---- group: 04 CONTROLLO / PREVIEW / BREP / BAKE
# Preview e bake: B = Brep chiusi, N = nomi SAP.
# Brep: tasto destro > Bake.
# Oppure BAKE SOLIDI: False > True.
# La geometria non richiede SAP.
# Modificare gli switch nel componente Display.
mostra_carichi = BooleanToggle(True)
display = SAPDisplaySettings(
    Enabled=True,
    Geometry=True,
    Sections=True,
    Loads=mostra_carichi,
    Supports=True,
    Springs=True,
    Masses=True,
    Releases=True,
    Offsets=True,
    OtherAttributes=True,
    Axes=True,
    Labels=True,
    Values=True,
    SymbolScale=0.2,
    LoadScale=0.05)
bake_solidi = BooleanToggle(False)

# ---- group: 05 CASO / COMBINAZIONE / ANALISI SAP
caso_sls = SAPLinearStaticCase(Name="SLS", Patterns="Q", Factors=1, Definitions=pattern_q)
uls_demo_1_5_sls = SAPLoadCombination(Name="ULS_DEMO", Type=0, Cases="SLS", Factors=1.5)
run_sap = BooleanToggle(False)
path_scegliere_un_file_sdb = Panel("C:\Users\Public\Documents\Rhino2SAP_03_assiale.sdb")

# ----
build_model = BuildSAPModel(
    Definitions=[beam_f1.Element, incastro.Definition, forza_al_tip.Definition, caso_sls, uls_demo_1_5_sls],
    Units=6,
    Tolerance=1e-06)  # -> Model, Issues

# ---- group: 04 CONTROLLO / PREVIEW / BREP / BAKE (continued)
preview_brep = PreviewSAPModel(Model=build_model.Model, Settings=display)  # -> Status, Issues, Breps, BrepNames
solidi_brep = Brep(preview_brep.Breps)
controllo_modello = ValidateSAPModel(Model=build_model.Model)  # -> Valid, Errors, Fingerprint
riepilogo = SAPModelSummary(Model=build_model.Model)
bake_solidi_2 = BakeSAPGeometry(Model=build_model.Model, Physical=True, Bake=bake_solidi, SolidOnly=True)  # -> ObjectIDs, Issues
modello_valido = Panel(controllo_modello.Valid)
riepilogo_modello = Panel(riepilogo)
preview_limiti_issues = Panel(preview_brep.Issues)

# ---- group: 05 CASO / COMBINAZIONE / ANALISI SAP (continued)
analizza_e_incorpora = SAPAnalyzeAndEmbedResults(
    Model=build_model.Model,
    Path=path_scegliere_un_file_sdb,
    Run=run_sap,
    Overwrite=False,
    Cases="SLS",
    Combinations="ULS_DEMO")  # -> Model, Path, Issues, Beams, Plates
issues_analisi = Panel(analizza_e_incorpora.Issues)

# ---- group: 06 RISULTATI BEAM / NODO / QUERY / DIAGRAMMA
n_v_t_m = SAPBeamResultsNVTM(Element=analizza_e_incorpora.Beams, Case="SLS", FilterStep=False, Step=0)  # -> NP, V2, V3, T, M2, M3, ObjSta, Cases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
spostamento_tip = SAPModelJointDispl(Model=analizza_e_incorpora.Model, Object="TIP", Case="SLS")  # -> NumberResults, Obj, Elm, LoadCase, StepType, StepNum, U1, U2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
interroga_elemento = QuerySAPElementResults(Element=analizza_e_incorpora.Beams, Quantity="Results.FrameForce", Case="ULS_DEMO", FilterStep=False, Step=0)  # -> Table, Columns, Rows
diagramma_n = SAPModelFrameForceDiagram(Model=analizza_e_incorpora.Model, Frame="F1", Case="SLS", Column="P", Step=0, Direction=Vector(0, 0, 1), Scale=0.2)  # -> Diagram, Ordinates, Stations, Values
n_kn_atteso_1_nel_caso_sls = Panel(n_v_t_m.NP)
u1_m_atteso_7_142857e_7 = Panel(spostamento_tip.U1)
righe_native_uls_demo = Panel(interroga_elemento.Rows)
