# Grasshopper definition 04_Creazione_unione_modelli.ghx (Grasshopper 1.0.8)
# plug-ins: Rhino2SAP

# ---- group: 01 PROPRIETA
# 01 PROPRIETA: Un materiale e una sezione comuni a entrambi i sottomodelli.
acciaio = SAPIsotropicMaterial(Name="STEEL", Type=1, E=210000000, Poisson=0.3, Alpha=1.2e-05, WeightDensity=78.5)
setrectangle = SAPFrameSectionRectangle(Name="R20x10", MatProp=acciaio, T3=0.2, T2=0.1, Color=-1)  # -> Definition, Name

# ---- group: 02 ELEMENTI
# 02 ELEMENTI: Due frame consecutivi; il nodo comune viene riconosciuto dalla tolleranza. Esempio geometrico senza analisi.
f1 = SAPFrameElement(Name="F1", Line=Line((0, 0, 0), (3, 0, 0)), Property=setrectangle.Definition)  # -> Element, Name
f2 = SAPFrameElement(Name="F2", Line=Line((3, 0, 0), (6, 0, 0)), Property=setrectangle.Definition)  # -> Element, Name

# ---- group: 03 MODELLO
# 03 MODELLO: Gli output Definition includono le dipendenze a monte. Collegare tutti i rami finali a Definitions; Build raccoglie una sola volta le dipendenze condivise.
build_model = BuildSAPModel(Definitions=f1.Element, Units=6, Tolerance=1e-06)  # -> Model, Issues

# ---- group: 04 MODELLO
# 04 MODELLO: Gli output Definition includono le dipendenze a monte. Collegare tutti i rami finali a Definitions; Build raccoglie una sola volta le dipendenze condivise.
build_model_2 = BuildSAPModel(Definitions=f2.Element, Units=6, Tolerance=1e-06)  # -> Model, Issues

# ---- group: 05 UNIONE
# 05 UNIONE: Merge mantiene i nomi e rifiuta geometrie diverse con lo stesso nome. Il modello risultante contiene due frame e tre nodi.
unisci = MergeSAPModels(Models=[build_model.Model, build_model_2.Model])
decomponi = DecomposeSAPModel(Model=unisci)  # -> Node, Frame, Area, Solid, Link, Cable, Operations, Units, Results
unita_sap = Panel(decomponi.Units)

# ---- group: 06 CONTROLLO / PREVIEW
# RHINO2SAP / 04 Creazione unione modelli: Creare due sottomodelli e unirli. Unita e tolleranza devono coincidere; gli elementi condivisi si raccolgono una volta.
# Unita: kN, m, C. Leggere le colonne da sinistra a destra. Input e geometria sono incorporati.
# I valori sono didattici. Run e Bake partono da False. Le analisi SAP non sono state eseguite dal generatore.
# 06 CONTROLLO / PREVIEW: Valid = controlli gestiti. Non certifica la stabilita strutturale. Preview espone i Brep disponibili anche quando la visualizzazione e spenta.
preview = BooleanToggle(True)
visualizzazione = SAPDisplaySettings(
    Enabled=preview,
    Geometry=True,
    Sections=True,
    Loads=True,
    Supports=True,
    Springs=True,
    Masses=True,
    Releases=True,
    Offsets=True,
    OtherAttributes=True,
    Axes=True,
    Labels=True,
    Values=True,
    SymbolScale=0.2,
    LoadScale=0.05)
valida = ValidateSAPModel(Model=unisci)  # -> Valid, Errors, Fingerprint
valid = Panel(valida.Valid)
preview_brep = PreviewSAPModel(Model=unisci, Settings=visualizzazione)  # -> Status, Issues, Breps, BrepNames
stato_brep = Panel(preview_brep.Status)
limiti_della_ricostruzione_geometrica = Panel(preview_brep.Issues)
