# Grasshopper definition 05_Polilinea_portale_frame.ghx (Grasshopper 1.0.8)
# plug-ins: Rhino2SAP

# ---- group: 01 PROPRIETA
# 01 PROPRIETA: Sezione 0.20 x 0.10 m; il materiale passa alla sezione e da questa a tutti i segmenti.
acciaio = SAPIsotropicMaterial(Name="STEEL", Type=1, E=210000000, Poisson=0.3, Alpha=1.2e-05, WeightDensity=78.5)
setrectangle = SAPFrameSectionRectangle(Name="R20x10", MatProp=acciaio, T3=0.2, T2=0.1, Color=-1)  # -> Definition, Name

# ---- group: 02 POLILINEA
# 02 POLILINEA: Portale largo 4 m e alto 3 m. Segmenti F1, F2 e F3. Le coordinate sono editabili negli input incorporati.
portale = PolylineToSAPFrames(Polyline=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, Prefix="F", Property=setrectangle.Definition)
basi = SAPNodeElement(Name=["B1", "B2"], Point=[Point(0, 0, 0), Point(4, 0, 0)])  # -> Element, Name
setrestraint = SAPNodeRestraint(Name=basi.Element, Value=[True, True, True, True, True, True], ItemType=0)  # -> Definition, Name

# ---- group: 03 MODELLO
# 03 MODELLO: Gli output Definition includono le dipendenze a monte. Collegare tutti i rami finali a Definitions; Build raccoglie una sola volta le dipendenze condivise.
build_model = BuildSAPModel(Definitions=[portale, setrestraint.Definition], Units=6, Tolerance=1e-06)  # -> Model, Issues

# ---- group: 05 CONTROLLO / PREVIEW
# RHINO2SAP / 05 Polilinea portale frame: Polilinea di un portale: un frame per segmento, selezione per nome e decomposizione beam.
# Unita: kN, m, C. Leggere le colonne da sinistra a destra. Input e geometria sono incorporati.
# I valori sono didattici. Run e Bake partono da False. Le analisi SAP non sono state eseguite dal generatore.
# 05 CONTROLLO / PREVIEW: Valid = controlli gestiti. Non certifica la stabilita strutturale. Preview espone i Brep disponibili anche quando la visualizzazione e spenta.
preview = BooleanToggle(True)
visualizzazione = SAPDisplaySettings(
    Enabled=preview,
    Geometry=True,
    Sections=True,
    Loads=True,
    Supports=True,
    Springs=True,
    Masses=True,
    Releases=True,
    Offsets=True,
    OtherAttributes=True,
    Axes=True,
    Labels=True,
    Values=True,
    SymbolScale=0.2,
    LoadScale=0.05)
valida = ValidateSAPModel(Model=build_model.Model)  # -> Valid, Errors, Fingerprint
valid = Panel(valida.Valid)
preview_brep = PreviewSAPModel(Model=build_model.Model, Settings=visualizzazione)  # -> Status, Issues, Breps, BrepNames
stato_brep = Panel(preview_brep.Status)
limiti_della_ricostruzione_geometrica = Panel(preview_brep.Issues)

# ---- group: 04 FILTRI
# 04 FILTRI: Filtrare prima di aggiungere nuovi carichi: Filter conserva le proprieta e rimuove le assegnazioni. Decompose Beam restituisce linea e vertici anche prima del calcolo.
traverso_f2 = FilterSAPElements(Definition=build_model.Model, Kind=1, Names="F2")
beam = DecomposeSAPBeam(Element=traverso_f2)  # -> Geometry, Name, Property, Vertices, Results, Quantities, Cases, Issues
estremi_del_traverso = Panel(beam.Vertices)
