# Grasshopper definition 07_Sezioni_rettangolo_I_tubo_pipe.ghx (Grasshopper 1.0.8)
# plug-ins: Rhino2SAP

# ---- group: 01 MATERIALE
# 01 MATERIALE: Acciaio isotropo, unita kN/m. Le dimensioni sotto sono in metri.
acciaio = SAPIsotropicMaterial(Name="STEEL", Type=1, E=210000000, Poisson=0.3, Alpha=1.2e-05, WeightDensity=78.5)

# ---- group: 02 SEZIONI
# 02 SEZIONI: R: 0.20 x 0.10. I: h=.30, b=.15, tf=.012, tw=.008. RHS: .25 x .15 x .01. CHS: diametro .20, t=.01.
setrectangle = SAPFrameSectionRectangle(Name="R20x10", MatProp=acciaio, T3=0.2, T2=0.1, Color=-1)  # -> Definition, Name
setisection = SAPFrameSectionISection(Name="I300", MatProp=acciaio, T3=0.3, T2=0.15, Tf=0.012, Tw=0.008, T2b=0.15, Tfb=0.012, Color=-1)  # -> Definition, Name
settube = SAPFrameSectionTube(Name="RHS", MatProp=acciaio, T3=0.25, T2=0.15, Tf=0.01, Tw=0.01, Color=-1)  # -> Definition, Name
setpipe = SAPFrameSectionPipe(Name="CHS", MatProp=acciaio, T3=0.2, TW=0.01, Color=-1)  # -> Definition, Name

# ---- group: 03 FRAME
# 03 FRAME: Quattro assi paralleli lunghi 3 m. Esempio geometrico: non contiene vincoli o carichi.
f1 = SAPFrameElement(Name="F1", Line=Line((0, 0, 0), (3, 0, 0)), Property=setrectangle.Definition)  # -> Element, Name
f2 = SAPFrameElement(Name="F2", Line=Line((0, 1, 0), (3, 1, 0)), Property=setisection.Definition)  # -> Element, Name
f3 = SAPFrameElement(Name="F3", Line=Line((0, 2, 0), (3, 2, 0)), Property=settube.Definition)  # -> Element, Name
f4 = SAPFrameElement(Name="F4", Line=Line((0, 3, 0), (3, 3, 0)), Property=setpipe.Definition)  # -> Element, Name

# ---- group: 04 MODELLO
# 04 MODELLO: Gli output Definition includono le dipendenze a monte. Collegare tutti i rami finali a Definitions; Build raccoglie una sola volta le dipendenze condivise.
build_model = BuildSAPModel(Definitions=[f1.Element, f2.Element, f3.Element, f4.Element], Units=6, Tolerance=1e-06)  # -> Model, Issues

# ---- group: 05 CONTROLLO / PREVIEW
# RHINO2SAP / 07 Sezioni rettangolo I tubo pipe: Quattro sezioni: rettangolare, doppio T, tubolare rettangolare e circolare cavo. Preview e solidi reali.
# Unita: kN, m, C. Leggere le colonne da sinistra a destra. Input e geometria sono incorporati.
# I valori sono didattici. Run e Bake partono da False. Le analisi SAP non sono state eseguite dal generatore.
# 05 CONTROLLO / PREVIEW: Valid = controlli gestiti. Non certifica la stabilita strutturale. Preview espone i Brep disponibili anche quando la visualizzazione e spenta.
preview = BooleanToggle(True)
visualizzazione = SAPDisplaySettings(
    Enabled=preview,
    Geometry=True,
    Sections=True,
    Loads=True,
    Supports=True,
    Springs=True,
    Masses=True,
    Releases=True,
    Offsets=True,
    OtherAttributes=True,
    Axes=True,
    Labels=True,
    Values=True,
    SymbolScale=0.2,
    LoadScale=0.05)
valida = ValidateSAPModel(Model=build_model.Model)  # -> Valid, Errors, Fingerprint
valid = Panel(valida.Valid)
preview_brep = PreviewSAPModel(Model=build_model.Model, Settings=visualizzazione)  # -> Status, Issues, Breps, BrepNames
stato_brep = Panel(preview_brep.Status)
limiti_della_ricostruzione_geometrica = Panel(preview_brep.Issues)
