# Grasshopper definition 08_Materiali_elastici_libreria_CSI.ghx (Grasshopper 1.0.8)
# plug-ins: Rhino2SAP

# ---- group: 01 ELASTICO
# 01 ELASTICO: Material definisce E, Poisson, dilatazione e peso specifico. Non aggiunge da solo dati normativi di progetto.
acciaio = SAPIsotropicMaterial(Name="STEEL", Type=1, E=210000000, Poisson=0.3, Alpha=1.2e-05, WeightDensity=78.5)
setrectangle = SAPFrameSectionRectangle(Name="R20x10", MatProp=acciaio, T3=0.2, T2=0.1, Color=-1)  # -> Definition, Name

# ---- group: 02 LIBRERIA CSI
# 02 LIBRERIA CSI: DB Material richiede SAP per risolvere le proprieta al momento dell'export. Standard e grado devono esistere nella libreria installata.
s355_da_database = SAPDatabaseMaterial(Name="S355_DB", Type=1, Region="Europe", Standard="EN 1993-1-1 per EN 10025-2", Grade="S355")
setrectangle_2 = SAPFrameSectionRectangle(Name="R_DB", MatProp=s355_da_database, T3=0.2, T2=0.1, Color=-1)  # -> Definition, Name
definizione_nativa = SAPDefinitionInfo(Definition=s355_da_database)  # -> Methods, Arguments
standard_grado_richiesti = Panel(definizione_nativa.Arguments)

# ---- group: 03 ELEMENTI
# 03 ELEMENTI: La forma geometrica delle due sezioni coincide. Il materiale di database verra completato da SAP.
elastico = SAPFrameElement(Name="F1", Line=Line((0, 0, 0), (3, 0, 0)), Property=setrectangle.Definition)  # -> Element, Name
database = SAPFrameElement(Name="F2", Line=Line((0, 1, 0), (3, 1, 0)), Property=setrectangle_2.Definition)  # -> Element, Name

# ---- group: 04 MODELLO
# 04 MODELLO: Gli output Definition includono le dipendenze a monte. Collegare tutti i rami finali a Definitions; Build raccoglie una sola volta le dipendenze condivise.
build_model = BuildSAPModel(Definitions=[elastico.Element, database.Element], Units=6, Tolerance=1e-06)  # -> Model, Issues

# ---- group: 05 CONTROLLO / PREVIEW
# RHINO2SAP / 08 Materiali elastici libreria CSI: Confronto fra materiale elastico esplicito e materiale dalla libreria europea CSI.
# Unita: kN, m, C. Leggere le colonne da sinistra a destra. Input e geometria sono incorporati.
# I valori sono didattici. Run e Bake partono da False. Le analisi SAP non sono state eseguite dal generatore.
# 05 CONTROLLO / PREVIEW: Valid = controlli gestiti. Non certifica la stabilita strutturale. Preview espone i Brep disponibili anche quando la visualizzazione e spenta.
preview = BooleanToggle(True)
visualizzazione = SAPDisplaySettings(
    Enabled=preview,
    Geometry=True,
    Sections=True,
    Loads=True,
    Supports=True,
    Springs=True,
    Masses=True,
    Releases=True,
    Offsets=True,
    OtherAttributes=True,
    Axes=True,
    Labels=True,
    Values=True,
    SymbolScale=0.2,
    LoadScale=0.05)
valida = ValidateSAPModel(Model=build_model.Model)  # -> Valid, Errors, Fingerprint
valid = Panel(valida.Valid)
preview_brep = PreviewSAPModel(Model=build_model.Model, Settings=visualizzazione)  # -> Status, Issues, Breps, BrepNames
stato_brep = Panel(preview_brep.Status)
limiti_della_ricostruzione_geometrica = Panel(preview_brep.Issues)
