# Grasshopper definition 09_Link_elastico.ghx (Grasshopper 1.0.8)
# plug-ins: Rhino2SAP

# ---- group: 01 PROPRIETA LINK
# 01 PROPRIETA LINK: DOF, Fixed, Ke e Ce hanno sei valori U1 U2 U3 R1 R2 R3. Solo U1 e elastico. Il link non ha un volume fisico da convertire in Brep.
setlinear = SAPLinkPropertyLinear(
    Name="K1000",
    DOF=[True, False, False, False, False, False],
    Fixed=[False, False, False, False, False, False],
    Ke=[1000, 0, 0, 0, 0, 0],
    Ce=[0, 0, 0, 0, 0, 0],
    DJ2=0,
    DJ3=0,
    KeCoupled=False,
    CeCoupled=False)  # -> Definition, Name

# ---- group: 02 LINK / NODI
# 02 LINK / NODI: Link L1 lungo X; nodo BASE incastrato, nodo TIP libero solo in X.
l1 = SAPLinkElement(Name="L1", Line=Line((0, 0, 0), (1, 0, 0)), Property=setlinear.Definition)  # -> Element, Name
base = SAPNodeElement(Name="BASE", Point=Point(0, 0, 0))  # -> Element, Name
setrestraint = SAPNodeRestraint(Name=base.Element, Value=[True, True, True, True, True, True], ItemType=0)  # -> Definition, Name
tip = SAPNodeElement(Name="TIP", Point=Point(1, 0, 0))  # -> Element, Name
setrestraint_2 = SAPNodeRestraint(Name=tip.Element, Value=[False, True, True, True, True, True], ItemType=0)  # -> Definition, Name

# ---- group: 03 CARICO
# 03 CARICO: Carico globale FX=1 kN al TIP.
Q = SAPLoadPattern(Name="Q", Type=8, SelfWeight=0)
setloadforce = SAPNodeLoadForce(Name=tip.Element, LoadPat=Q, Value=[1, 0, 0, 0, 0, 0], Replace=False, CSys="Global", ItemType=0)  # -> Definition, Name

# ---- group: 04 MODELLO
# 04 MODELLO: Gli output Definition includono le dipendenze a monte. Collegare tutti i rami finali a Definitions; Build raccoglie una sola volta le dipendenze condivise.
build_model = BuildSAPModel(
    Definitions=[l1.Element, setrestraint.Definition, setrestraint_2.Definition, setloadforce.Definition],
    Units=6,
    Tolerance=1e-06)  # -> Model, Issues

# ---- group: 05 CONTROLLO / PREVIEW
# RHINO2SAP / 09 Link elastico: Link assiale elastico: K1=1000 kN/m, forza +1 kN. Atteso spostamento assiale 0.001 m; gli altri gradi di liberta sono vincolati.
# Unita: kN, m, C. Leggere le colonne da sinistra a destra. Input e geometria sono incorporati.
# I valori sono didattici. Run e Bake partono da False. Le analisi SAP non sono state eseguite dal generatore.
# 05 CONTROLLO / PREVIEW: Valid = controlli gestiti. Non certifica la stabilita strutturale. Preview espone i Brep disponibili anche quando la visualizzazione e spenta.
preview = BooleanToggle(True)
visualizzazione = SAPDisplaySettings(
    Enabled=preview,
    Geometry=True,
    Sections=True,
    Loads=True,
    Supports=True,
    Springs=True,
    Masses=True,
    Releases=True,
    Offsets=True,
    OtherAttributes=True,
    Axes=True,
    Labels=True,
    Values=True,
    SymbolScale=0.2,
    LoadScale=0.05)
valida = ValidateSAPModel(Model=build_model.Model)  # -> Valid, Errors, Fingerprint
valid = Panel(valida.Valid)
preview_brep = PreviewSAPModel(Model=build_model.Model, Settings=visualizzazione)  # -> Status, Issues, Breps, BrepNames
stato_brep = Panel(preview_brep.Status)
limiti_della_ricostruzione_geometrica = Panel(preview_brep.Issues)
