# Grasshopper definition 10_Cavo_e_carico_distribuito.ghx (Grasshopper 1.0.8)
# plug-ins: Rhino2SAP

# ---- group: 01 MATERIALE / CAVO
# 01 MATERIALE / CAVO: Area di acciaio = .001 m2. La linea in GH identifica gli estremi; non simula la catenaria.
acciaio = SAPIsotropicMaterial(Name="STEEL", Type=1, E=210000000, Poisson=0.3, Alpha=1.2e-05, WeightDensity=78.5)
setprop = SAPPropCableProp(Name="CABLE", MatProp=acciaio, Area=0.001, Color=-1)  # -> Definition, Name

# ---- group: 02 ELEMENTI
# 02 ELEMENTI: Cavo tra (0,0,0) e (6,0,1), entrambi gli estremi vincolati. Il disegno mostra l'asse, non un solido di cavo.
c1 = SAPCableElement(Name="C1", Line=Line((0, 0, 0), (6, 0, 1)), Property=setprop.Definition)  # -> Element, Name
estremi = SAPNodeElement(Name=["B1", "B2"], Point=[Point(0, 0, 0), Point(6, 0, 1)])  # -> Element, Name
setrestraint = SAPNodeRestraint(Name=estremi.Element, Value=[True, True, True, True, True, True], ItemType=0)  # -> Definition, Name

# ---- group: 03 CARICO
# 03 CARICO: Carico verticale -0.2 kN/m, Dir=6 e sistema Global. Definire tensionamento e caso non lineare prima di un uso progettuale.
Q = SAPLoadPattern(Name="Q", Type=8, SelfWeight=0)
setloaddistributed = SAPCableObjLoadDistributed(Name=c1.Element, LoadPat=Q, MyType=1, Dir=6, Value=-0.2, CSys="Global", Replace=True, ItemType=0)  # -> Definition, Name

# ---- group: 04 MODELLO
# 04 MODELLO: Gli output Definition includono le dipendenze a monte. Collegare tutti i rami finali a Definitions; Build raccoglie una sola volta le dipendenze condivise.
build_model = BuildSAPModel(Definitions=[setloaddistributed.Definition, setrestraint.Definition], Units=6, Tolerance=1e-06)  # -> Model, Issues

# ---- group: 05 CONTROLLO / PREVIEW
# RHINO2SAP / 10 Cavo e carico distribuito: Proprieta di cavo, connettivita e carico distribuito. Il comportamento a fune richiede una configurazione non lineare in SAP.
# Unita: kN, m, C. Leggere le colonne da sinistra a destra. Input e geometria sono incorporati.
# I valori sono didattici. Run e Bake partono da False. Le analisi SAP non sono state eseguite dal generatore.
# 05 CONTROLLO / PREVIEW: Valid = controlli gestiti. Non certifica la stabilita strutturale. Preview espone i Brep disponibili anche quando la visualizzazione e spenta.
preview = BooleanToggle(True)
visualizzazione = SAPDisplaySettings(
    Enabled=preview,
    Geometry=True,
    Sections=True,
    Loads=True,
    Supports=True,
    Springs=True,
    Masses=True,
    Releases=True,
    Offsets=True,
    OtherAttributes=True,
    Axes=True,
    Labels=True,
    Values=True,
    SymbolScale=0.2,
    LoadScale=0.05)
valida = ValidateSAPModel(Model=build_model.Model)  # -> Valid, Errors, Fingerprint
valid = Panel(valida.Valid)
preview_brep = PreviewSAPModel(Model=build_model.Model, Settings=visualizzazione)  # -> Status, Issues, Breps, BrepNames
stato_brep = Panel(preview_brep.Status)
limiti_della_ricostruzione_geometrica = Panel(preview_brep.Issues)
