# Grasshopper definition 16_Pattern_peso_proprio.ghx (Grasshopper 1.0.8)
# plug-ins: Rhino2SAP

# ---- group: 01 MATERIALE / SEZIONE
# 01 MATERIALE / SEZIONE: Sezione rettangolare 0.20 x 0.10 m. E=210e6 kN/m2. I nomi delle definizioni devono essere univoci.
acciaio = SAPIsotropicMaterial(Name="STEEL", Type=1, E=210000000, Poisson=0.3, Alpha=1.2e-05, WeightDensity=78.5)
setrectangle = SAPFrameSectionRectangle(Name="R20x10", MatProp=acciaio, T3=0.2, T2=0.1, Color=-1)  # -> Definition, Name

# ---- group: 02 ELEMENTI / VINCOLO
# 02 ELEMENTI / VINCOLO: Mensola di 3 m. Incastro al nodo BASE. Il nodo TIP coincide con l'estremita del frame F1.
frame_f1 = SAPFrameElement(Name="F1", Line=Line((0, 0, 0), (3, 0, 0)), Property=setrectangle.Definition)  # -> Element, Name
base = SAPNodeElement(Name="BASE", Point=Point(0, 0, 0))  # -> Element, Name
setrestraint = SAPNodeRestraint(Name=base.Element, Value=[True, True, True, True, True, True], ItemType=0)  # -> Definition, Name
tip = SAPNodeElement(Name="TIP", Point=Point(3, 0, 0))  # -> Element, Name

# ---- group: 03 PATTERN / CARICO
# 03 PATTERN / CARICO: Pattern Q senza peso proprio. Forza al TIP: -1 kN lungo Z per la mensola orizzontale, +1 kN lungo X per quella verticale.
Q = SAPLoadPattern(Name="Q", Type=8, SelfWeight=0)
setloadforce = SAPNodeLoadForce(Name=tip.Element, LoadPat=Q, Value=[0, 0, -1, 0, 0, 0], Replace=False, CSys="Global", ItemType=0)  # -> Definition, Name

# ---- group: 04 DEAD
# 04 DEAD: Type=1 e Self weight=1. Q ha Self weight=0. SAP genera un caso statico omonimo per ciascun pattern.
dead = SAPLoadPattern(Name="DEAD", Type=1, SelfWeight=1)

# ---- group: 05 MODELLO
# 05 MODELLO: Gli output Definition includono le dipendenze a monte. Collegare tutti i rami finali a Definitions; Build raccoglie una sola volta le dipendenze condivise.
build_model = BuildSAPModel(Definitions=[frame_f1.Element, setrestraint.Definition, setloadforce.Definition, dead], Units=6, Tolerance=1e-06)  # -> Model, Issues

# ---- group: 06 CONTROLLO / PREVIEW
# RHINO2SAP / 16 Pattern peso proprio: Separare DEAD e Q: il peso proprio si attiva una sola volta, in DEAD.
# Unita: kN, m, C. Leggere le colonne da sinistra a destra. Input e geometria sono incorporati.
# I valori sono didattici. Run e Bake partono da False. Le analisi SAP non sono state eseguite dal generatore.
# 06 CONTROLLO / PREVIEW: Valid = controlli gestiti. Non certifica la stabilita strutturale. Preview espone i Brep disponibili anche quando la visualizzazione e spenta.
preview = BooleanToggle(True)
visualizzazione = SAPDisplaySettings(
    Enabled=preview,
    Geometry=True,
    Sections=True,
    Loads=True,
    Supports=True,
    Springs=True,
    Masses=True,
    Releases=True,
    Offsets=True,
    OtherAttributes=True,
    Axes=True,
    Labels=True,
    Values=True,
    SymbolScale=0.2,
    LoadScale=0.05)
valida = ValidateSAPModel(Model=build_model.Model)  # -> Valid, Errors, Fingerprint
valid = Panel(valida.Valid)
preview_brep = PreviewSAPModel(Model=build_model.Model, Settings=visualizzazione)  # -> Status, Issues, Breps, BrepNames
stato_brep = Panel(preview_brep.Status)
limiti_della_ricostruzione_geometrica = Panel(preview_brep.Issues)
