# Grasshopper definition 19_Plate_pressione_mesh_SAP.ghx (Grasshopper 1.0.8)
# plug-ins: Rhino2SAP

# ---- group: 01 MATERIALE / SHELL
# 01 MATERIALE / SHELL: Shell sottile, 20 cm; materiale elastico didattico. Spessore membranale e flessionale uguali.
calcestruzzo = SAPIsotropicMaterial(Name="C30_DEMO", Type=2, E=30000000, Poisson=0.2, Alpha=1.2e-05, WeightDensity=25)
setshell_1 = SAPAreaPropertyShell1(
    Name="SHELL20",
    ShellType=1,
    IncludeDrillingDOF=True,
    MatProp=calcestruzzo,
    MatAng=0,
    Thickness=0.2,
    Bending=0.2,
    Color=-1)  # -> Definition, Name

# ---- group: 02 MESH / APPOGGI
# 02 MESH / APPOGGI: Quadrato 4 x 4 m discretizzato 2 x 2. La mesh e incorporata; ogni faccia diventa un oggetto SAP. Gli otto nodi di bordo sono incastrati.
_4_quadrilateri = MeshToSAPAreas(Mesh=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, Prefix="A", Property=setshell_1.Definition)
bordo = SAPNodeElement(
    Name=["B1", "B2", "B3", "B4", "B5", "B6", "B7", "B8"],
    Point=[Point(0, 0, 0), Point(2, 0, 0), Point(4, 0, 0), Point(0, 2, 0), Point(4, 2, 0), Point(0, 4, 0), Point(2, 4, 0), Point(4, 4, 0)])  # -> Element, Name
setrestraint = SAPNodeRestraint(Name=bordo.Element, Value=[True, True, True, True, True, True], ItemType=0)  # -> Definition, Name

# ---- group: 03 PRESSIONE
# 03 PRESSIONE: -5 kN/m2 in Z globale (Dir=6). Name=ALL, ItemType=1 assegna il carico al gruppo ALL; Definitions porta la mesh nello stesso ramo.
Q = SAPLoadPattern(Name="Q", Type=8, SelfWeight=0)
setloaduniform = SAPAreaLoadUniform(Definitions=_4_quadrilateri, Name="ALL", LoadPat=Q, Value=-5, Dir=6, Replace=True, CSys="Global", ItemType=1)  # -> Definition, Name

# ---- group: 04 MODELLO
# 04 MODELLO: Gli output Definition includono le dipendenze a monte. Collegare tutti i rami finali a Definitions; Build raccoglie una sola volta le dipendenze condivise.
build_model = BuildSAPModel(Definitions=[setloaduniform.Definition, setrestraint.Definition], Units=6, Tolerance=1e-06)  # -> Model, Issues

# ---- group: 05 AUTOMESH SAP
# 05 AUTOMESH SAP: Ogni oggetto A1-A4 e suddiviso 2 x 2 dal solver (MeshType=1). La preview mostra le quattro shell GH, non la mesh interna generata da SAP.
setautomesh = SAPAreaAutoMesh(
    Definitions=build_model.Model,
    Name="ALL",
    MeshType=1,
    N1=2,
    N2=2,
    MaxSize1=0,
    MaxSize2=0,
    PointOnEdgeFromLine=False,
    PointOnEdgeFromPoint=False,
    ExtendCookieCutLines=False,
    Rotation=0,
    MaxSizeGeneral=0,
    LocalAxesOnEdge=False,
    LocalAxesOnFace=False,
    RestraintsOnEdge=False,
    RestraintsOnFace=False,
    Group="ALL",
    SubMesh=False,
    SubMeshSize=0,
    ItemType=1)  # -> Definition, Name

# ---- group: 06 MODELLO
# 06 MODELLO: Gli output Definition includono le dipendenze a monte. Collegare tutti i rami finali a Definitions; Build raccoglie una sola volta le dipendenze condivise.
build_model_2 = BuildSAPModel(Definitions=setautomesh.Definition, Units=6, Tolerance=1e-06)  # -> Model, Issues

# ---- group: 07 CONTROLLO / PREVIEW
# RHINO2SAP / 19 Plate pressione mesh SAP: Pressione uniforme sulle shell e automesh SAP. La mesh GH degli oggetti e la mesh di analisi SAP sono livelli diversi.
# Unita: kN, m, C. Leggere le colonne da sinistra a destra. Input e geometria sono incorporati.
# I valori sono didattici. Run e Bake partono da False. Le analisi SAP non sono state eseguite dal generatore.
# 07 CONTROLLO / PREVIEW: Valid = controlli gestiti. Non certifica la stabilita strutturale. Preview espone i Brep disponibili anche quando la visualizzazione e spenta.
preview = BooleanToggle(True)
visualizzazione = SAPDisplaySettings(
    Enabled=preview,
    Geometry=True,
    Sections=True,
    Loads=True,
    Supports=True,
    Springs=True,
    Masses=True,
    Releases=True,
    Offsets=True,
    OtherAttributes=True,
    Axes=True,
    Labels=True,
    Values=True,
    SymbolScale=0.2,
    LoadScale=0.05)
valida = ValidateSAPModel(Model=build_model_2.Model)  # -> Valid, Errors, Fingerprint
valid = Panel(valida.Valid)
preview_brep = PreviewSAPModel(Model=build_model_2.Model, Settings=visualizzazione)  # -> Status, Issues, Breps, BrepNames
stato_brep = Panel(preview_brep.Status)
limiti_della_ricostruzione_geometrica = Panel(preview_brep.Issues)
