# Grasshopper definition 26_Fasi_costruttive.ghx (Grasshopper 1.0.8)
# plug-ins: Rhino2SAP

# ---- group: 01 MATERIALE / SEZIONE
# 01 MATERIALE / SEZIONE: Sezione rettangolare 0.20 x 0.10 m. E=210e6 kN/m2. I nomi delle definizioni devono essere univoci.
acciaio = SAPIsotropicMaterial(Name="STEEL", Type=1, E=210000000, Poisson=0.3, Alpha=1.2e-05, WeightDensity=78.5)
setrectangle = SAPFrameSectionRectangle(Name="R20x10", MatProp=acciaio, T3=0.2, T2=0.1, Color=-1)  # -> Definition, Name

# ---- group: 02 ELEMENTI / VINCOLO
# 02 ELEMENTI / VINCOLO: Mensola di 3 m. Incastro al nodo BASE. Il nodo TIP coincide con l'estremita del frame F1.
frame_f1 = SAPFrameElement(Name="F1", Line=Line((0, 0, 0), (3, 0, 0)), Property=setrectangle.Definition)  # -> Element, Name
base = SAPNodeElement(Name="BASE", Point=Point(0, 0, 0))  # -> Element, Name
setrestraint = SAPNodeRestraint(Name=base.Element, Value=[True, True, True, True, True, True], ItemType=0)  # -> Definition, Name
tip = SAPNodeElement(Name="TIP", Point=Point(3, 0, 0))  # -> Element, Name

# ---- group: 03 PATTERN / CARICO
# 03 PATTERN / CARICO: Pattern Q senza peso proprio. Forza al TIP: -1 kN lungo Z per la mensola orizzontale, +1 kN lungo X per quella verticale.
Q = SAPLoadPattern(Name="Q", Type=8, SelfWeight=0)
setloadforce = SAPNodeLoadForce(Name=tip.Element, LoadPat=Q, Value=[0, 0, -1, 0, 0, 0], Replace=False, CSys="Global", ItemType=0)  # -> Definition, Name

# ---- group: 04 CASO / FASI
# 04 CASO / FASI: STAGED, due fasi con output. I componenti usano SetStageDefinitions_2 e SetStageData_2 dell'SDK locale.
setcase = SAPLoadCasesStaticNonlinearStagedCase(Name="STAGED")  # -> Definition, Name
setstagedefinitions_2 = SAPLoadCasesStaticNonlinearStagedStageDefinitions2(
    Name=setcase.Definition,
    NumberStages=2,
    Duration=[0, 0],
    Output=[True, True],
    OutputName=["BUILD", "LOAD"],
    Comment=["Attivazione", "Carico Q"])  # -> Definition, Name

# ---- group: 05 OPERAZIONI
# 05 OPERAZIONI: Fase 1: Operation=1 aggiunge il gruppo ALL, eta 28 giorni. Fase 2: Operation=4 applica Q agli oggetti del gruppo ALL, fattore 1.
setstagedata_2 = SAPLoadCasesStaticNonlinearStagedStageData2(
    Definitions=Q,
    Name=setstagedefinitions_2.Definition,
    Stage=1,
    NumberOperations=1,
    Operation=1,
    ObjectType="Group",
    ObjectName="ALL",
    Age=28,
    MyType="Load",
    MyName="Q",
    SF=0)  # -> Definition, Name
setstagedata_2_2 = SAPLoadCasesStaticNonlinearStagedStageData2(
    Name=setstagedata_2.Definition,
    Stage=2,
    NumberOperations=1,
    Operation=4,
    ObjectType="Group",
    ObjectName="ALL",
    Age=0,
    MyType="Load",
    MyName="Q",
    SF=1)  # -> Definition, Name

# ---- group: 06 MODELLO
# 06 MODELLO: Gli output Definition includono le dipendenze a monte. Collegare tutti i rami finali a Definitions; Build raccoglie una sola volta le dipendenze condivise.
build_model = BuildSAPModel(
    Definitions=[frame_f1.Element, setrestraint.Definition, setloadforce.Definition, setstagedata_2_2.Definition],
    Units=6,
    Tolerance=1e-06)  # -> Model, Issues

# ---- group: 07 CONTROLLO / PREVIEW
# RHINO2SAP / 26 Fasi costruttive: Due fasi: attivazione della struttura e applicazione del carico Q. Durate nulle, senza reologia.
# Unita: kN, m, C. Leggere le colonne da sinistra a destra. Input e geometria sono incorporati.
# I valori sono didattici. Run e Bake partono da False. Le analisi SAP non sono state eseguite dal generatore.
# 07 CONTROLLO / PREVIEW: Valid = controlli gestiti. Non certifica la stabilita strutturale. Preview espone i Brep disponibili anche quando la visualizzazione e spenta.
preview = BooleanToggle(True)
visualizzazione = SAPDisplaySettings(
    Enabled=preview,
    Geometry=True,
    Sections=True,
    Loads=True,
    Supports=True,
    Springs=True,
    Masses=True,
    Releases=True,
    Offsets=True,
    OtherAttributes=True,
    Axes=True,
    Labels=True,
    Values=True,
    SymbolScale=0.2,
    LoadScale=0.05)
valida = ValidateSAPModel(Model=build_model.Model)  # -> Valid, Errors, Fingerprint
valid = Panel(valida.Valid)
preview_brep = PreviewSAPModel(Model=build_model.Model, Settings=visualizzazione)  # -> Status, Issues, Breps, BrepNames
stato_brep = Panel(preview_brep.Status)
limiti_della_ricostruzione_geometrica = Panel(preview_brep.Issues)

# ---- group: 08 ANALISI SAP
# 08 ANALISI SAP: Scegliere un nuovo file .sdb nel pannello. Run: False > True. Per ripetere tornare prima a False. Overwrite=false. Occorre SAP2000 utilizzabile con API.
run_sap = BooleanToggle(False)
file_di_destinazione = Panel("C:\Users\Public\Documents\Rhino2SAP_26_Fasi_costruttive.sdb")
analisi_e_risultati = SAPAnalyzeAndEmbedResults(Model=build_model.Model, Path=file_di_destinazione, Run=run_sap, Overwrite=False, Cases="STAGED")  # -> Model, Path, Issues, Beams, Plates
esito_lettura_risultati = Panel(analisi_e_risultati.Issues)
