# Grasshopper definition 28_Time_history_funzione_utente.ghx (Grasshopper 1.0.8)
# plug-ins: Rhino2SAP

# ---- group: 01 MATERIALE / SEZIONE
# 01 MATERIALE / SEZIONE: Sezione rettangolare 0.20 x 0.10 m. E=210e6 kN/m2. I nomi delle definizioni devono essere univoci.
acciaio = SAPIsotropicMaterial(Name="STEEL", Type=1, E=210000000, Poisson=0.3, Alpha=1.2e-05, WeightDensity=78.5)
setrectangle = SAPFrameSectionRectangle(Name="R20x10", MatProp=acciaio, T3=0.2, T2=0.1, Color=-1)  # -> Definition, Name

# ---- group: 02 ELEMENTI / VINCOLO
# 02 ELEMENTI / VINCOLO: Mensola di 3 m. Incastro al nodo BASE. Il nodo TIP coincide con l'estremita del frame F1.
frame_f1 = SAPFrameElement(Name="F1", Line=Line((0, 0, 0), (0, 0, 3)), Property=setrectangle.Definition)  # -> Element, Name
base = SAPNodeElement(Name="BASE", Point=Point(0, 0, 0))  # -> Element, Name
setrestraint = SAPNodeRestraint(Name=base.Element, Value=[True, True, True, True, True, True], ItemType=0)  # -> Definition, Name
tip = SAPNodeElement(Name="TIP", Point=Point(0, 0, 3))  # -> Element, Name

# ---- group: 03 PATTERN / CARICO
# 03 PATTERN / CARICO: Pattern Q senza peso proprio. Forza al TIP: -1 kN lungo Z per la mensola orizzontale, +1 kN lungo X per quella verticale.
Q = SAPLoadPattern(Name="Q", Type=8, SelfWeight=0)
setloadforce = SAPNodeLoadForce(Name=tip.Element, LoadPat=Q, Value=[1, 0, 0, 0, 0, 0], Replace=False, CSys="Global", ItemType=0)  # -> Definition, Name

# ---- group: 04 MASSA / MODALE
# 04 MASSA / MODALE: Massa unitaria al TIP; caso MODAL con tre modi richiesti. La massa include anche gli elementi. Periodi e masse partecipanti vanno controllati dopo il run.
setmass = SAPNodeMass(Name=tip.Element, M=[1, 1, 1, 0, 0, 0], ItemType=0, IsLocalCSys=False, Replace=False)  # -> Definition, Name
setmasssource = SAPSourceMassMassSource(
    Definitions=setmass.Definition,
    Name="MASS",
    MassFromElements=True,
    MassFromMasses=True,
    MassFromLoads=False,
    IsDefault=True,
    NumberLoads=0,
    LoadPat="Q",
    SF=0)  # -> Definition, Name
setcase = SAPLoadCasesModalEigenCase(Definitions=setmasssource.Definition, Name="MODAL")  # -> Definition, Name
setnumbermodes = SAPLoadCasesModalEigenNumberModes(Name=setcase.Definition, MaxModes=3, MinModes=1)  # -> Definition, Name

# ---- group: 05 STORIA TEMPORALE
# 05 STORIA TEMPORALE: Funzione PULSE: (t, fattore) = (0,0), (.1,1), (.2,0), (2,0). Il fattore moltiplica il carico Q, non e un accelerogramma.
pulse = SAPTimeHistoryFunction(Name="PULSE", NumberItems=4, MyTime=[0, 0.1, 0.2, 2], Value=[0, 1, 0, 0])  # -> Definition, Name
setcase_2 = SAPLoadCasesModHistLinearCase(Definitions=[pulse.Definition, setnumbermodes.Definition], Name="TH")  # -> Definition, Name
setmodalcase = SAPLoadCasesModHistLinearModalCase(Name=setcase_2.Definition, ModalCase="MODAL")  # -> Definition, Name

# ---- group: 06 CARICO / PASSO
# 06 CARICO / PASSO: LoadType=Load, LoadName=Q. 200 passi da .01 s; scala temporale Tf=1 e arrivo At=0. Smorzamento modale 5%.
setloads = SAPLoadCasesModHistLinearLoads(
    Definitions=Q,
    Name=setmodalcase.Definition,
    NumberLoads=1,
    LoadType="Load",
    LoadName="Q",
    Func="PULSE",
    SF=1,
    Tf=1,
    At=0,
    CSys="Global",
    Ang=0)  # -> Definition, Name
settimestep = SAPLoadCasesModHistLinearTimeStep(Name=setloads.Definition, NStep=200, Dt=0.01)  # -> Definition, Name
setdampconstant = SAPLoadCasesModHistLinearDampConstant(Name=settimestep.Definition, Damp=0.05)  # -> Definition, Name

# ---- group: 07 MODELLO
# 07 MODELLO: Gli output Definition includono le dipendenze a monte. Collegare tutti i rami finali a Definitions; Build raccoglie una sola volta le dipendenze condivise.
build_model = BuildSAPModel(
    Definitions=[frame_f1.Element, setrestraint.Definition, setloadforce.Definition, setdampconstant.Definition],
    Units=6,
    Tolerance=1e-06)  # -> Model, Issues

# ---- group: 08 CONTROLLO / PREVIEW
# RHINO2SAP / 28 Time history funzione utente: Analisi dinamica modale lineare con impulso triangolare applicato al pattern Q.
# Unita: kN, m, C. Leggere le colonne da sinistra a destra. Input e geometria sono incorporati.
# I valori sono didattici. Run e Bake partono da False. Le analisi SAP non sono state eseguite dal generatore.
# 08 CONTROLLO / PREVIEW: Valid = controlli gestiti. Non certifica la stabilita strutturale. Preview espone i Brep disponibili anche quando la visualizzazione e spenta.
preview = BooleanToggle(True)
visualizzazione = SAPDisplaySettings(
    Enabled=preview,
    Geometry=True,
    Sections=True,
    Loads=True,
    Supports=True,
    Springs=True,
    Masses=True,
    Releases=True,
    Offsets=True,
    OtherAttributes=True,
    Axes=True,
    Labels=True,
    Values=True,
    SymbolScale=0.2,
    LoadScale=0.05)
valida = ValidateSAPModel(Model=build_model.Model)  # -> Valid, Errors, Fingerprint
valid = Panel(valida.Valid)
preview_brep = PreviewSAPModel(Model=build_model.Model, Settings=visualizzazione)  # -> Status, Issues, Breps, BrepNames
stato_brep = Panel(preview_brep.Status)
limiti_della_ricostruzione_geometrica = Panel(preview_brep.Issues)

# ---- group: 09 ANALISI SAP
# 09 ANALISI SAP: Scegliere un nuovo file .sdb nel pannello. Run: False > True. Per ripetere tornare prima a False. Overwrite=false. Occorre SAP2000 utilizzabile con API.
run_sap = BooleanToggle(False)
file_di_destinazione = Panel("C:\Users\Public\Documents\Rhino2SAP_28_Time_history_funzione_utente.sdb")
analisi_e_risultati = SAPAnalyzeAndEmbedResults(Model=build_model.Model, Path=file_di_destinazione, Run=run_sap, Overwrite=False, Cases=["MODAL", "TH"])  # -> Model, Path, Issues, Beams, Plates
esito_lettura_risultati = Panel(analisi_e_risultati.Issues)

# ---- group: 10 LETTURA
# 10 LETTURA: Usare Case e StepNum per distinguere gli istanti; non mescolare valori di passi diversi.
jointdispl = SAPModelJointDispl(Model=analisi_e_risultati.Model)  # -> NumberResults, Obj, Elm, LoadCase, StepType, StepNum, U1, U2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
u1_unita_del_modello = Panel(jointdispl.U1)
