# Grasshopper definition 31_Import_sola_geometria.ghx (Grasshopper 1.0.8)
# plug-ins: Rhino2SAP

# ---- group: 01 FILE ESISTENTE
# RHINO2SAP / 31 Import sola geometria: Importazione della sola geometria da un SDB. Questo output non comprende materiali, proprieta o carichi.
# Unita: kN, m, C. Leggere le colonne da sinistra a destra. Input e geometria sono incorporati.
# I valori sono didattici. Run e Bake partono da False. Le analisi SAP non sono state eseguite dal generatore.
# 01 FILE ESISTENTE: Sostituire il percorso con un .sdb reale. IMPORT SAP deve passare da False a True. Il sorgente viene aperto tramite una copia privata.
import_sap = BooleanToggle(False)
file_sap_esistente = Panel("C:\Users\Public\Documents\modello_esistente.sdb")
read_geometry = ReadSAPGeometry(Path=file_sap_esistente, Run=import_sap)  # -> Geometry, Names

# ---- group: 02 GEOMETRIA
# 02 GEOMETRIA: Element Info espone nomi e tipi. Per creare un modello nuovo occorre riassegnare le proprieta; usare Import Model se si vuole mantenere il modello SAP completo.
nomi_tipi = SAPElementInfo(Definition=read_geometry.Geometry)  # -> Names, Kinds, Properties, Elements
nomi_nativi = Panel(nomi_tipi.Names)
tipi_di_elemento = Panel(nomi_tipi.Kinds)
