# Grasshopper definition 32_Import_modello_SAP_associato.ghx (Grasshopper 1.0.8)
# plug-ins: Rhino2SAP

# ---- group: 01 FILE ESISTENTE
# RHINO2SAP / 32 Import modello SAP associato: Aprire un SDB esistente e ottenere il Model Grasshopper associato, con unita, nomi, casi, combinazioni e hash della sorgente.
# Unita: kN, m, C. Leggere le colonne da sinistra a destra. Input e geometria sono incorporati.
# I valori sono didattici. Run e Bake partono da False. Le analisi SAP non sono state eseguite dal generatore.
# 01 FILE ESISTENTE: Sostituire il percorso con un .sdb reale. IMPORT SAP deve passare da False a True. Il sorgente viene aperto tramite una copia privata.
import_sap = BooleanToggle(False)
file_sap_esistente = Panel("C:\Users\Public\Documents\modello_esistente.sdb")
import_model = ImportSAPModel(Path=file_sap_esistente, Run=import_sap)  # -> Model, Units, Cases, Combinations, Issues, SourceHash

# ---- group: 03 CONTROLLO / PREVIEW
# 03 CONTROLLO / PREVIEW: Valid = controlli gestiti. Non certifica la stabilita strutturale. Preview espone i Brep disponibili anche quando la visualizzazione e spenta.
preview = BooleanToggle(True)
visualizzazione = SAPDisplaySettings(
    Enabled=preview,
    Geometry=True,
    Sections=True,
    Loads=True,
    Supports=True,
    Springs=True,
    Masses=True,
    Releases=True,
    Offsets=True,
    OtherAttributes=True,
    Axes=True,
    Labels=True,
    Values=True,
    SymbolScale=0.2,
    LoadScale=0.05)
valida = ValidateSAPModel(Model=import_model.Model)  # -> Valid, Errors, Fingerprint
valid = Panel(valida.Valid)
preview_brep = PreviewSAPModel(Model=import_model.Model, Settings=visualizzazione)  # -> Status, Issues, Breps, BrepNames
stato_brep = Panel(preview_brep.Status)
limiti_della_ricostruzione_geometrica = Panel(preview_brep.Issues)

# ---- group: 04 EXPORT SDB
# 04 EXPORT SDB: Scegliere un nuovo file .sdb nel pannello. Run: False > True. Per ripetere tornare prima a False. Overwrite=false. Occorre SAP2000 utilizzabile con API.
export_sap = BooleanToggle(False)
file_di_destinazione = Panel("C:\Users\Public\Documents\Rhino2SAP_32_Import_modello_SAP_associato.sdb")
export = ExportSAP2000Model(Model=import_model.Model, Path=file_di_destinazione, Run=export_sap, Overwrite=False)  # -> Model, Path, Issues, Beams, Plates
esito_lettura_risultati = Panel(export.Issues)

# ---- group: 02 MODEL ASSOCIATO
# 02 MODEL ASSOCIATO: Il Model mantiene il file sorgente e il suo hash. La vista GH ricostruisce le parti supportate; tutte le definizioni native restano nel file. Modificare in SAP e reimportare per aggiornare.
casi_nel_file = Panel(import_model.Cases)
copertura_della_vista_gh = Panel(import_model.Issues)
decomponi = DecomposeSAPModel(Model=import_model.Model)  # -> Node, Frame, Area, Solid, Link, Cable, Operations, Units, Results
unita_originali = Panel(decomponi.Units)
