# Grasshopper definition 34_Risultati_beam_diagrammi_deformata.ghx (Grasshopper 1.0.8)
# plug-ins: Rhino2SAP

# ---- group: 01 MATERIALE / SEZIONE
# 01 MATERIALE / SEZIONE: Sezione rettangolare 0.20 x 0.10 m. E=210e6 kN/m2. I nomi delle definizioni devono essere univoci.
acciaio = SAPIsotropicMaterial(Name="STEEL", Type=1, E=210000000, Poisson=0.3, Alpha=1.2e-05, WeightDensity=78.5)
setrectangle = SAPFrameSectionRectangle(Name="R20x10", MatProp=acciaio, T3=0.2, T2=0.1, Color=-1)  # -> Definition, Name

# ---- group: 02 ELEMENTI / VINCOLO
# 02 ELEMENTI / VINCOLO: Mensola di 3 m. Incastro al nodo BASE. Il nodo TIP coincide con l'estremita del frame F1.
frame_f1 = SAPFrameElement(Name="F1", Line=Line((0, 0, 0), (3, 0, 0)), Property=setrectangle.Definition)  # -> Element, Name
base = SAPNodeElement(Name="BASE", Point=Point(0, 0, 0))  # -> Element, Name
setrestraint = SAPNodeRestraint(Name=base.Element, Value=[True, True, True, True, True, True], ItemType=0)  # -> Definition, Name
tip = SAPNodeElement(Name="TIP", Point=Point(3, 0, 0))  # -> Element, Name

# ---- group: 03 PATTERN / CARICO
# 03 PATTERN / CARICO: Pattern Q senza peso proprio. Forza al TIP: -1 kN lungo Z per la mensola orizzontale, +1 kN lungo X per quella verticale.
Q = SAPLoadPattern(Name="Q", Type=8, SelfWeight=0)
setloadforce = SAPNodeLoadForce(Name=tip.Element, LoadPat=Q, Value=[0, 0, -1, 0, 0, 0], Replace=False, CSys="Global", ItemType=0)  # -> Definition, Name

# ---- group: 04 MODELLO
# 04 MODELLO: Gli output Definition includono le dipendenze a monte. Collegare tutti i rami finali a Definitions; Build raccoglie una sola volta le dipendenze condivise.
build_model = BuildSAPModel(Definitions=[frame_f1.Element, setrestraint.Definition, setloadforce.Definition], Units=6, Tolerance=1e-06)  # -> Model, Issues

# ---- group: 05 CONTROLLO / PREVIEW
# RHINO2SAP / 34 Risultati beam diagrammi deformata: Risultati nel beam, interrogazione delle righe, estremi, diagramma M3 e deformata del modello.
# Unita: kN, m, C. Leggere le colonne da sinistra a destra. Input e geometria sono incorporati.
# I valori sono didattici. Run e Bake partono da False. Le analisi SAP non sono state eseguite dal generatore.
# 05 CONTROLLO / PREVIEW: Valid = controlli gestiti. Non certifica la stabilita strutturale. Preview espone i Brep disponibili anche quando la visualizzazione e spenta.
preview = BooleanToggle(True)
visualizzazione = SAPDisplaySettings(
    Enabled=preview,
    Geometry=True,
    Sections=True,
    Loads=True,
    Supports=True,
    Springs=True,
    Masses=True,
    Releases=True,
    Offsets=True,
    OtherAttributes=True,
    Axes=True,
    Labels=True,
    Values=True,
    SymbolScale=0.2,
    LoadScale=0.05)
valida = ValidateSAPModel(Model=build_model.Model)  # -> Valid, Errors, Fingerprint
valid = Panel(valida.Valid)
preview_brep = PreviewSAPModel(Model=build_model.Model, Settings=visualizzazione)  # -> Status, Issues, Breps, BrepNames
stato_brep = Panel(preview_brep.Status)
limiti_della_ricostruzione_geometrica = Panel(preview_brep.Issues)

# ---- group: 06 ANALISI SAP
# 06 ANALISI SAP: Scegliere un nuovo file .sdb nel pannello. Run: False > True. Per ripetere tornare prima a False. Overwrite=false. Occorre SAP2000 utilizzabile con API.
run_sap = BooleanToggle(False)
file_di_destinazione = Panel("C:\Users\Public\Documents\Rhino2SAP_34_Risultati_beam_diagrammi_deformata.sdb")
analisi_e_risultati = SAPAnalyzeAndEmbedResults(Model=build_model.Model, Path=file_di_destinazione, Run=run_sap, Overwrite=False, Cases="Q")  # -> Model, Path, Issues, Beams, Plates
esito_lettura_risultati = Panel(analisi_e_risultati.Issues)

# ---- group: 07 BEAM / QUERY
# 07 BEAM / QUERY: Collegare Beams, non il Model non risolto. N=P, V2, V3, T, M2, M3 negli assi locali. Le stazioni conservano l'ordine e gli identificativi del solver.
righe_beam = QuerySAPElementResults(Element=analisi_e_risultati.Beams, Quantity="Results.FrameForce", Case="Q", FilterStep=False, Step=0)  # -> Table, Columns, Rows
ordine_delle_colonne = Panel(righe_beam.Columns)
n_v_t_m = SAPBeamResultsNVTM(Element=analisi_e_risultati.Beams, Case="Q", FilterStep=False, Step=0)  # -> NP, V2, V3, T, M2, M3, ObjSta, Cases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
m3_knm = Panel(n_v_t_m.M3)
beam_risolto = DecomposeSAPBeam(Element=analisi_e_risultati.Beams)  # -> Geometry, Name, Property, Vertices, Results, Quantities, Cases, Issues
quantita_incorporate = Panel(beam_risolto.Quantities)

# ---- group: 08 DIAGRAMMA / ESTREMI
# 08 DIAGRAMMA / ESTREMI: Il diagramma usa M3 del caso Q; scala .1 m/kNm. Gli estremi mantengono caso, oggetto e riga governante.
diagramma_m3 = SAPModelFrameForceDiagram(Model=analisi_e_risultati.Model, Frame="F1", Case="Q", Column="M3", Step=0, Direction=Vector(0, 0, 1), Scale=0.1)  # -> Diagram, Ordinates, Stations, Values
estremi_m3 = SAPModelResultExtrema(Model=analisi_e_risultati.Model, Quantity="Results.FrameForce", Column="M3")  # -> Minimum, Maximum, GoverningRows
righe_governanti = Panel(estremi_m3.GoverningRows)

# ---- group: 09 DEFORMATA
# 09 DEFORMATA: Scala visiva 1000. La deformata interpola gli estremi dei frame, non la curvatura interna. Non usare uno step Max/Min per una forma simultanea.
deformata = SAPModelDeformedGeometry(Model=analisi_e_risultati.Model, Case="Q", Step=0, Scale=1000)  # -> Geometry, Translations
spostamenti_globali_reali_m = Panel(deformata.Translations)
