# Grasshopper definition 35_Risultati_plate_forze_tensioni_deformazioni.ghx (Grasshopper 1.0.8)
# plug-ins: Rhino2SAP

# ---- group: 01 MATERIALE / SHELL
# 01 MATERIALE / SHELL: Shell sottile, 20 cm; materiale elastico didattico. Spessore membranale e flessionale uguali.
calcestruzzo = SAPIsotropicMaterial(Name="C30_DEMO", Type=2, E=30000000, Poisson=0.2, Alpha=1.2e-05, WeightDensity=25)
setshell_1 = SAPAreaPropertyShell1(
    Name="SHELL20",
    ShellType=1,
    IncludeDrillingDOF=True,
    MatProp=calcestruzzo,
    MatAng=0,
    Thickness=0.2,
    Bending=0.2,
    Color=-1)  # -> Definition, Name

# ---- group: 02 MESH / APPOGGI
# 02 MESH / APPOGGI: Quadrato 4 x 4 m discretizzato 2 x 2. La mesh e incorporata; ogni faccia diventa un oggetto SAP. Gli otto nodi di bordo sono incastrati.
_4_quadrilateri = MeshToSAPAreas(Mesh=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, Prefix="A", Property=setshell_1.Definition)
bordo = SAPNodeElement(
    Name=["B1", "B2", "B3", "B4", "B5", "B6", "B7", "B8"],
    Point=[Point(0, 0, 0), Point(2, 0, 0), Point(4, 0, 0), Point(0, 2, 0), Point(4, 2, 0), Point(0, 4, 0), Point(2, 4, 0), Point(4, 4, 0)])  # -> Element, Name
setrestraint = SAPNodeRestraint(Name=bordo.Element, Value=[True, True, True, True, True, True], ItemType=0)  # -> Definition, Name

# ---- group: 03 PRESSIONE
# 03 PRESSIONE: -5 kN/m2 in Z globale (Dir=6). Name=ALL, ItemType=1 assegna il carico al gruppo ALL; Definitions porta la mesh nello stesso ramo.
Q = SAPLoadPattern(Name="Q", Type=8, SelfWeight=0)
setloaduniform = SAPAreaLoadUniform(Definitions=_4_quadrilateri, Name="ALL", LoadPat=Q, Value=-5, Dir=6, Replace=True, CSys="Global", ItemType=1)  # -> Definition, Name

# ---- group: 04 MODELLO
# 04 MODELLO: Gli output Definition includono le dipendenze a monte. Collegare tutti i rami finali a Definitions; Build raccoglie una sola volta le dipendenze condivise.
build_model = BuildSAPModel(Definitions=[setloaduniform.Definition, setrestraint.Definition], Units=6, Tolerance=1e-06)  # -> Model, Issues

# ---- group: 05 CONTROLLO / PREVIEW
# RHINO2SAP / 35 Risultati plate forze tensioni deformazioni: Shell: lettura delle azioni per unita di lunghezza, tensioni top/bottom e deformazioni nei singoli elementi.
# Unita: kN, m, C. Leggere le colonne da sinistra a destra. Input e geometria sono incorporati.
# I valori sono didattici. Run e Bake partono da False. Le analisi SAP non sono state eseguite dal generatore.
# 05 CONTROLLO / PREVIEW: Valid = controlli gestiti. Non certifica la stabilita strutturale. Preview espone i Brep disponibili anche quando la visualizzazione e spenta.
preview = BooleanToggle(True)
visualizzazione = SAPDisplaySettings(
    Enabled=preview,
    Geometry=True,
    Sections=True,
    Loads=True,
    Supports=True,
    Springs=True,
    Masses=True,
    Releases=True,
    Offsets=True,
    OtherAttributes=True,
    Axes=True,
    Labels=True,
    Values=True,
    SymbolScale=0.2,
    LoadScale=0.05)
valida = ValidateSAPModel(Model=build_model.Model)  # -> Valid, Errors, Fingerprint
valid = Panel(valida.Valid)
preview_brep = PreviewSAPModel(Model=build_model.Model, Settings=visualizzazione)  # -> Status, Issues, Breps, BrepNames
stato_brep = Panel(preview_brep.Status)
limiti_della_ricostruzione_geometrica = Panel(preview_brep.Issues)

# ---- group: 06 ANALISI SAP
# 06 ANALISI SAP: Scegliere un nuovo file .sdb nel pannello. Run: False > True. Per ripetere tornare prima a False. Overwrite=false. Occorre SAP2000 utilizzabile con API.
run_sap = BooleanToggle(False)
file_di_destinazione = Panel("C:\Users\Public\Documents\Rhino2SAP_35_Risultati_plate_forze_tensioni_deformazioni.sdb")
analisi_e_risultati = SAPAnalyzeAndEmbedResults(Model=build_model.Model, Path=file_di_destinazione, Run=run_sap, Overwrite=False, Cases="Q")  # -> Model, Path, Issues, Beams, Plates
esito_lettura_risultati = Panel(analisi_e_risultati.Issues)

# ---- group: 07 PLATE RISOLTE
# 07 PLATE RISOLTE: Plates contiene quattro elementi, ciascuno con le proprie righe di risultati. Conservare il ramo GH e il nome dell'elemento nell'esportazione dei valori.
f_m_v = SAPPlateResultsForcesAndMoments(Element=analisi_e_risultati.Plates, Case="Q", FilterStep=False, Step=0)  # -> F11, F22, F12, M11, M22, M12, V13, V23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
m11_knm_m = Panel(f_m_v.M11)
decompose_plate = DecomposeSAPPlate(Element=analisi_e_risultati.Plates)  # -> Geometry, Name, Property, Vertices, Results, Quantities, Cases, Issues
nomi_shell = Panel(decompose_plate.Name)

# ---- group: 08 TENSIONI / DEFORMAZIONI
# 08 TENSIONI / DEFORMAZIONI: Top/bottom seguono l'asse locale 3 della shell. Le tensioni sono kN/m2; le deformazioni normali e di taglio sono adimensionali.
tensioni = SAPPlateResultsStresses(Element=analisi_e_risultati.Plates, Case="Q", FilterStep=False, Step=0)  # -> S11Top, S22Top, S12Top, S11Bot, S22Bot, S12Bot, SVMTop, SVMBot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
von_mises_top = Panel(tensioni.SVMTop)
deformazioni = SAPPlateResultsStrains(Element=analisi_e_risultati.Plates, Case="Q", FilterStep=False, Step=0)  # -> E11top, E22top, G12top, E11bot, E22bot, G12bot, G13avg, G23avg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
e11_top = Panel(deformazioni.E11top)
