# Grasshopper definition 37_Risultati_solidi.ghx (Grasshopper 1.0.8)
# plug-ins: Rhino2SAP

# ---- group: 01 MATERIALE / SOLIDO
# 01 MATERIALE / SOLIDO: Calcestruzzo isotropo. Rotazioni del materiale A=B=C=0; Incompatible=false.
calcestruzzo = SAPIsotropicMaterial(Name="C30_DEMO", Type=2, E=30000000, Poisson=0.2, Alpha=1.2e-05, WeightDensity=25)
setprop = SAPPropSolidProp(Name="SOLID", MatProp=calcestruzzo, A=0, B=0, C=0, Incompatible=False, Color=-1)  # -> Definition, Name

# ---- group: 02 CONNETTIVITA
# 02 CONNETTIVITA: Vertici: quattro inferiori antiorari, poi i corrispondenti superiori. Nessuna tetraedrizzazione implicita.
s1 = SAPSolidElement(
    Name="S1",
    Vertices=[Point(0, 0, 0), Point(1, 0, 0), Point(1, 1, 0), Point(0, 1, 0), Point(0, 0, 1), Point(1, 0, 1), Point(1, 1, 1), Point(0, 1, 1)],
    Property=setprop.Definition)  # -> Element, Name
base = SAPNodeElement(Name=["B1", "B2", "B3", "B4"], Point=[Point(0, 0, 0), Point(1, 0, 0), Point(1, 1, 0), Point(0, 1, 0)])  # -> Element, Name
setrestraint = SAPNodeRestraint(Name=base.Element, Value=[True, True, True, True, True, True], ItemType=0)  # -> Definition, Name
sommita = SAPNodeElement(Name=["T1", "T2", "T3", "T4"], Point=[Point(0, 0, 1), Point(1, 0, 1), Point(1, 1, 1), Point(0, 1, 1)])  # -> Element, Name

# ---- group: 03 CARICHI
# 03 CARICHI: Quattro forze FZ=-1 kN. Risultante totale -4 kN; questo non equivale a una mesh raffinata per valutare i picchi.
Q = SAPLoadPattern(Name="Q", Type=8, SelfWeight=0)
setloadforce = SAPNodeLoadForce(Name=sommita.Element, LoadPat=Q, Value=[0, 0, -1, 0, 0, 0], Replace=False, CSys="Global", ItemType=0)  # -> Definition, Name

# ---- group: 04 MODELLO
# 04 MODELLO: Gli output Definition includono le dipendenze a monte. Collegare tutti i rami finali a Definitions; Build raccoglie una sola volta le dipendenze condivise.
build_model = BuildSAPModel(Definitions=[s1.Element, setrestraint.Definition, setloadforce.Definition], Units=6, Tolerance=1e-06)  # -> Model, Issues

# ---- group: 05 CONTROLLO / PREVIEW
# RHINO2SAP / 37 Risultati solidi: Un esaedro 1 x 1 x 1 m, base vincolata e forze verticali sui quattro nodi superiori.
# Unita: kN, m, C. Leggere le colonne da sinistra a destra. Input e geometria sono incorporati.
# I valori sono didattici. Run e Bake partono da False. Le analisi SAP non sono state eseguite dal generatore.
# 05 CONTROLLO / PREVIEW: Valid = controlli gestiti. Non certifica la stabilita strutturale. Preview espone i Brep disponibili anche quando la visualizzazione e spenta.
preview = BooleanToggle(True)
visualizzazione = SAPDisplaySettings(
    Enabled=preview,
    Geometry=True,
    Sections=True,
    Loads=True,
    Supports=True,
    Springs=True,
    Masses=True,
    Releases=True,
    Offsets=True,
    OtherAttributes=True,
    Axes=True,
    Labels=True,
    Values=True,
    SymbolScale=0.2,
    LoadScale=0.05)
valida = ValidateSAPModel(Model=build_model.Model)  # -> Valid, Errors, Fingerprint
valid = Panel(valida.Valid)
preview_brep = PreviewSAPModel(Model=build_model.Model, Settings=visualizzazione)  # -> Status, Issues, Breps, BrepNames
stato_brep = Panel(preview_brep.Status)
limiti_della_ricostruzione_geometrica = Panel(preview_brep.Issues)

# ---- group: 06 ANALISI SAP
# 06 ANALISI SAP: Scegliere un nuovo file .sdb nel pannello. Run: False > True. Per ripetere tornare prima a False. Overwrite=false. Occorre SAP2000 utilizzabile con API.
run_sap = BooleanToggle(False)
file_di_destinazione = Panel("C:\Users\Public\Documents\Rhino2SAP_37_Risultati_solidi.sdb")
analisi_e_risultati = SAPAnalyzeAndEmbedResults(
    Model=build_model.Model,
    Path=file_di_destinazione,
    Run=run_sap,
    Overwrite=False,
    Cases="Q",
    Quantities=["Results.SolidStress", "Results.SolidStrain", "Results.JointDispl"])  # -> Model, Path, Issues, Beams, Plates
esito_lettura_risultati = Panel(analisi_e_risultati.Issues)

# ---- group: 07 TENSIONI / DEFORMAZIONI
# 07 TENSIONI / DEFORMAZIONI: Colonne native riferite ai punti del solido; conservare gli identificativi quando si interpretano i valori.
solidstress = SAPModelSolidStress(Model=analisi_e_risultati.Model)  # -> NumberResults, Obj, Elm, PointElm, LoadCase, StepType, StepNum, S11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
s11_unita_del_modello = Panel(solidstress.S11)
solidstrain = SAPModelSolidStrain(Model=analisi_e_risultati.Model)  # -> NumberResults, Obj, Elm, PointElm, LoadCase, StepType, StepNum, E11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
e11_unita_del_modello = Panel(solidstrain.E11)
