# Grasshopper definition 38_Risultati_modali_masse_forme.ghx (Grasshopper 1.0.8)
# plug-ins: Rhino2SAP

# ---- group: 01 MATERIALE / SEZIONE
# 01 MATERIALE / SEZIONE: Sezione rettangolare 0.20 x 0.10 m. E=210e6 kN/m2. I nomi delle definizioni devono essere univoci.
acciaio = SAPIsotropicMaterial(Name="STEEL", Type=1, E=210000000, Poisson=0.3, Alpha=1.2e-05, WeightDensity=78.5)
setrectangle = SAPFrameSectionRectangle(Name="R20x10", MatProp=acciaio, T3=0.2, T2=0.1, Color=-1)  # -> Definition, Name

# ---- group: 02 ELEMENTI / VINCOLO
# 02 ELEMENTI / VINCOLO: Mensola di 3 m. Incastro al nodo BASE. Il nodo TIP coincide con l'estremita del frame F1.
frame_f1 = SAPFrameElement(Name="F1", Line=Line((0, 0, 0), (0, 0, 3)), Property=setrectangle.Definition)  # -> Element, Name
base = SAPNodeElement(Name="BASE", Point=Point(0, 0, 0))  # -> Element, Name
setrestraint = SAPNodeRestraint(Name=base.Element, Value=[True, True, True, True, True, True], ItemType=0)  # -> Definition, Name
tip = SAPNodeElement(Name="TIP", Point=Point(0, 0, 3))  # -> Element, Name

# ---- group: 03 PATTERN / CARICO
# 03 PATTERN / CARICO: Pattern Q senza peso proprio. Forza al TIP: -1 kN lungo Z per la mensola orizzontale, +1 kN lungo X per quella verticale.
Q = SAPLoadPattern(Name="Q", Type=8, SelfWeight=0)
setloadforce = SAPNodeLoadForce(Name=tip.Element, LoadPat=Q, Value=[1, 0, 0, 0, 0, 0], Replace=False, CSys="Global", ItemType=0)  # -> Definition, Name

# ---- group: 04 MASSA / MODALE
# 04 MASSA / MODALE: Massa unitaria al TIP; caso MODAL con tre modi richiesti. La massa include anche gli elementi. Periodi e masse partecipanti vanno controllati dopo il run.
setmass = SAPNodeMass(Name=tip.Element, M=[1, 1, 1, 0, 0, 0], ItemType=0, IsLocalCSys=False, Replace=False)  # -> Definition, Name
setmasssource = SAPSourceMassMassSource(
    Definitions=setmass.Definition,
    Name="MASS",
    MassFromElements=True,
    MassFromMasses=True,
    MassFromLoads=False,
    IsDefault=True,
    NumberLoads=0,
    LoadPat="Q",
    SF=0)  # -> Definition, Name
setcase = SAPLoadCasesModalEigenCase(Definitions=setmasssource.Definition, Name="MODAL")  # -> Definition, Name
setnumbermodes = SAPLoadCasesModalEigenNumberModes(Name=setcase.Definition, MaxModes=3, MinModes=1)  # -> Definition, Name

# ---- group: 05 MODELLO
# 05 MODELLO: Gli output Definition includono le dipendenze a monte. Collegare tutti i rami finali a Definitions; Build raccoglie una sola volta le dipendenze condivise.
build_model = BuildSAPModel(
    Definitions=[frame_f1.Element, setrestraint.Definition, setloadforce.Definition, setnumbermodes.Definition],
    Units=6,
    Tolerance=1e-06)  # -> Model, Issues

# ---- group: 06 CONTROLLO / PREVIEW
# RHINO2SAP / 38 Risultati modali masse forme: Periodi, rapporti di massa partecipante e forme modali. Caso MODAL su una mensola con massa concentrata.
# Unita: kN, m, C. Leggere le colonne da sinistra a destra. Input e geometria sono incorporati.
# I valori sono didattici. Run e Bake partono da False. Le analisi SAP non sono state eseguite dal generatore.
# 06 CONTROLLO / PREVIEW: Valid = controlli gestiti. Non certifica la stabilita strutturale. Preview espone i Brep disponibili anche quando la visualizzazione e spenta.
preview = BooleanToggle(True)
visualizzazione = SAPDisplaySettings(
    Enabled=preview,
    Geometry=True,
    Sections=True,
    Loads=True,
    Supports=True,
    Springs=True,
    Masses=True,
    Releases=True,
    Offsets=True,
    OtherAttributes=True,
    Axes=True,
    Labels=True,
    Values=True,
    SymbolScale=0.2,
    LoadScale=0.05)
valida = ValidateSAPModel(Model=build_model.Model)  # -> Valid, Errors, Fingerprint
valid = Panel(valida.Valid)
preview_brep = PreviewSAPModel(Model=build_model.Model, Settings=visualizzazione)  # -> Status, Issues, Breps, BrepNames
stato_brep = Panel(preview_brep.Status)
limiti_della_ricostruzione_geometrica = Panel(preview_brep.Issues)

# ---- group: 07 ANALISI SAP
# 07 ANALISI SAP: Scegliere un nuovo file .sdb nel pannello. Run: False > True. Per ripetere tornare prima a False. Overwrite=false. Occorre SAP2000 utilizzabile con API.
run_sap = BooleanToggle(False)
file_di_destinazione = Panel("C:\Users\Public\Documents\Rhino2SAP_38_Risultati_modali_masse_forme.sdb")
analisi_e_risultati = SAPAnalyzeAndEmbedResults(
    Model=build_model.Model,
    Path=file_di_destinazione,
    Run=run_sap,
    Overwrite=False,
    Cases="MODAL",
    Quantities=["Results.ModalPeriod", "Results.ModalParticipatingMassRatios", "Results.ModalParticipationFactors", "Results.ModeShape"])  # -> Model, Path, Issues, Beams, Plates
esito_lettura_risultati = Panel(analisi_e_risultati.Issues)

# ---- group: 08 PERIODI / MASSE
# 08 PERIODI / MASSE: Confrontare StepNum (modo) fra le tabelle. Le forme modali hanno normalizzazione del solver e non sono spostamenti dovuti a un carico statico.
modalperiod = SAPModelModalPeriod(Model=analisi_e_risultati.Model)  # -> NumberResults, LoadCase, StepType, StepNum, Period, Frequency, CircFreq, EigenValue
period_unita_del_modello = Panel(modalperiod.Period)
modalparticipatingmassratios = SAPModelModalParticipatingMassRatios(Model=analisi_e_risultati.Model)  # -> NumberResults, LoadCase, StepType, StepNum, Period, UX, UY, UZ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
sumux_unita_del_modello = Panel(modalparticipatingmassratios.SumUX)
modalparticipationfactors = SAPModelModalParticipationFactors(Model=analisi_e_risultati.Model)  # -> NumberResults, LoadCase, StepType, StepNum, Period, UX, UY, UZ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
ux_unita_del_modello = Panel(modalparticipationfactors.UX)
modeshape = SAPModelModeShape(Model=analisi_e_risultati.Model)  # -> NumberResults, Obj, Elm, LoadCase, StepType, StepNum, U1, U2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
u1_unita_del_modello = Panel(modeshape.U1)
