# Grasshopper definition 39_Utility_firme_unita_query.ghx (Grasshopper 1.0.8)
# plug-ins: Rhino2SAP

# ---- group: 01 MATERIALE / SEZIONE
# 01 MATERIALE / SEZIONE: Sezione rettangolare 0.20 x 0.10 m. E=210e6 kN/m2. I nomi delle definizioni devono essere univoci.
acciaio = SAPIsotropicMaterial(Name="STEEL", Type=1, E=210000000, Poisson=0.3, Alpha=1.2e-05, WeightDensity=78.5)
setrectangle = SAPFrameSectionRectangle(Name="R20x10", MatProp=acciaio, T3=0.2, T2=0.1, Color=-1)  # -> Definition, Name

# ---- group: 02 ELEMENTI / VINCOLO
# 02 ELEMENTI / VINCOLO: Mensola di 3 m. Incastro al nodo BASE. Il nodo TIP coincide con l'estremita del frame F1.
frame_f1 = SAPFrameElement(Name="F1", Line=Line((0, 0, 0), (3, 0, 0)), Property=setrectangle.Definition)  # -> Element, Name
base = SAPNodeElement(Name="BASE", Point=Point(0, 0, 0))  # -> Element, Name
setrestraint = SAPNodeRestraint(Name=base.Element, Value=[True, True, True, True, True, True], ItemType=0)  # -> Definition, Name
tip = SAPNodeElement(Name="TIP", Point=Point(3, 0, 0))  # -> Element, Name

# ---- group: 03 PATTERN / CARICO
# 03 PATTERN / CARICO: Pattern Q senza peso proprio. Forza al TIP: -1 kN lungo Z per la mensola orizzontale, +1 kN lungo X per quella verticale.
Q = SAPLoadPattern(Name="Q", Type=8, SelfWeight=0)
setloadforce = SAPNodeLoadForce(Name=tip.Element, LoadPat=Q, Value=[0, 0, -1, 0, 0, 0], Replace=False, CSys="Global", ItemType=0)  # -> Definition, Name

# ---- group: 04 MODELLO
# 04 MODELLO: Gli output Definition includono le dipendenze a monte. Collegare tutti i rami finali a Definitions; Build raccoglie una sola volta le dipendenze condivise.
build_model = BuildSAPModel(Definitions=[frame_f1.Element, setrestraint.Definition, setloadforce.Definition], Units=6, Tolerance=1e-06)  # -> Model, Issues

# ---- group: 05 CONTROLLO / PREVIEW
# RHINO2SAP / 39 Utility firme unita query: Ispezione delle firme API, delle unita SAP, delle definizioni raccolte e dei dati pronti per verifiche esterne.
# Unita: kN, m, C. Leggere le colonne da sinistra a destra. Input e geometria sono incorporati.
# I valori sono didattici. Run e Bake partono da False. Le analisi SAP non sono state eseguite dal generatore.
# 05 CONTROLLO / PREVIEW: Valid = controlli gestiti. Non certifica la stabilita strutturale. Preview espone i Brep disponibili anche quando la visualizzazione e spenta.
preview = BooleanToggle(True)
visualizzazione = SAPDisplaySettings(
    Enabled=preview,
    Geometry=True,
    Sections=True,
    Loads=True,
    Supports=True,
    Springs=True,
    Masses=True,
    Releases=True,
    Offsets=True,
    OtherAttributes=True,
    Axes=True,
    Labels=True,
    Values=True,
    SymbolScale=0.2,
    LoadScale=0.05)
valida = ValidateSAPModel(Model=build_model.Model)  # -> Valid, Errors, Fingerprint
valid = Panel(valida.Valid)
preview_brep = PreviewSAPModel(Model=build_model.Model, Settings=visualizzazione)  # -> Status, Issues, Breps, BrepNames
stato_brep = Panel(preview_brep.Status)
limiti_della_ricostruzione_geometrica = Panel(preview_brep.Issues)

# ---- group: 08 ANALISI SAP
# 08 ANALISI SAP: Scegliere un nuovo file .sdb nel pannello. Run: False > True. Per ripetere tornare prima a False. Overwrite=false. Occorre SAP2000 utilizzabile con API.
run_sap = BooleanToggle(False)
file_di_destinazione = Panel("C:\Users\Public\Documents\Rhino2SAP_39_Utility_firme_unita_query.sdb")
analisi_e_risultati = SAPAnalyzeAndEmbedResults(Model=build_model.Model, Path=file_di_destinazione, Run=run_sap, Overwrite=False, Cases="Q")  # -> Model, Path, Issues, Beams, Plates
esito_lettura_risultati = Panel(analisi_e_risultati.Issues)

# ---- group: 06 SDK / UNITA
# 06 SDK / UNITA: API Signature usa lo schema dell'SDK installato. Units elenca eUnits: selezionare le unita prima di costruire, senza presumere conversioni automatiche.
firma_sdk = SAPAPISignature(Method="FrameObj.SetLoadDistributed")  # -> Parameters, HelpFile
nomi_tipi_ed_enum = Panel(firma_sdk.Parameters)
unita = SAPModelUnits()  # -> Values, Names
sistemi_unita = Panel(unita.Names)

# ---- group: 07 DEFINIZIONI / CATALOGO
# 07 DEFINIZIONI / CATALOGO: Definition Info rende visibili i comandi differiti. Quantities elenca tutte le tabelle richiedibili al run.
comandi = SAPDefinitionInfo(Definition=build_model.Model)  # -> Methods, Arguments
metodi_raccolti = Panel(comandi.Methods)
quantita_risultati = SAPResultQuantities()  # -> Methods, Columns
metodi_results = Panel(quantita_risultati.Methods)

# ---- group: 09 DATI PER VERIFICHE
# 09 DATI PER VERIFICHE: Verification Data espone risultati e definizioni. Complete indica letture API riuscite, non un giudizio di sicurezza o una verifica normativa.
dati_verifica = SAPModelVerificationData(Model=analisi_e_risultati.Model)  # -> Elements, DefinitionsJSON, R, Units, Issues, Complete
complete = Panel(dati_verifica.Complete)
casi_step = SAPModelResultCases(Model=analisi_e_risultati.Model)  # -> CasesAndSteps, Quantities, Issues
casi_effettivamente_letti = Panel(casi_step.CasesAndSteps)
