# Grasshopper definition 41_Section_Designer.ghx (Grasshopper 1.0.8)
# plug-ins: Rhino2SAP

# ---- group: 01 SEZIONE SD
# 01 SEZIONE SD: Il materiale base e STEEL; DesignType=0. SDShape aggiunge una forma alla sezione esistente.
acciaio = SAPIsotropicMaterial(Name="STEEL", Type=1, E=210000000, Poisson=0.3, Alpha=1.2e-05, WeightDensity=78.5)
setsdsection = SAPFrameSectionSDSection(Name="SD_RECT", MatProp=acciaio, DesignType=0, Color=-1)  # -> Definition, Name

# ---- group: 02 FORMA
# 02 FORMA: Rettangolo centrato: H=.30, W=.20, nessuna rotazione. La preview fisica di Section Designer non e supportata; consultare Issues.
setsolidrect = SAPPropFrameSDShapeSolidRect(
    Name=setsdsection.Definition,
    ShapeName="RECT1",
    MatProp=acciaio,
    SSOverwrite="Default",
    XCenter=0,
    YCenter=0,
    H=0.3,
    W=0.2,
    Rotation=0,
    Color=-1,
    Reinf=False)  # -> Definition, Name
sd_f1 = SAPFrameElement(Name="F1", Line=Line((0, 0, 0), (3, 0, 0)), Property=setsolidrect.Definition)  # -> Element, Name

# ---- group: 03 MODELLO
# 03 MODELLO: Gli output Definition includono le dipendenze a monte. Collegare tutti i rami finali a Definitions; Build raccoglie una sola volta le dipendenze condivise.
build_model = BuildSAPModel(Definitions=sd_f1.Element, Units=6, Tolerance=1e-06)  # -> Model, Issues

# ---- group: 04 CONTROLLO / PREVIEW
# RHINO2SAP / 41 Section Designer: Sezione Section Designer con una forma rettangolare piena. Esempio di definizioni dipendenti.
# Unita: kN, m, C. Leggere le colonne da sinistra a destra. Input e geometria sono incorporati.
# I valori sono didattici. Run e Bake partono da False. Le analisi SAP non sono state eseguite dal generatore.
# 04 CONTROLLO / PREVIEW: Valid = controlli gestiti. Non certifica la stabilita strutturale. Preview espone i Brep disponibili anche quando la visualizzazione e spenta.
preview = BooleanToggle(True)
visualizzazione = SAPDisplaySettings(
    Enabled=preview,
    Geometry=True,
    Sections=True,
    Loads=True,
    Supports=True,
    Springs=True,
    Masses=True,
    Releases=True,
    Offsets=True,
    OtherAttributes=True,
    Axes=True,
    Labels=True,
    Values=True,
    SymbolScale=0.2,
    LoadScale=0.05)
valida = ValidateSAPModel(Model=build_model.Model)  # -> Valid, Errors, Fingerprint
valid = Panel(valida.Valid)
preview_brep = PreviewSAPModel(Model=build_model.Model, Settings=visualizzazione)  # -> Status, Issues, Breps, BrepNames
stato_brep = Panel(preview_brep.Status)
limiti_della_ricostruzione_geometrica = Panel(preview_brep.Issues)
