# Grasshopper definition FEM_02_SAP_Portale.ghx (Grasshopper 1.0.8)
# plug-ins: Rhino2SAP
# Portale nel piano XZ: L = 6 m, H = 3 m, sezione 0.25 x 0.35 m, basi incastrate. Unita: kN / m.
# G = peso proprio; Q = carico GZ sulla sola trave. ULS = 1.35 G + 1.50 Q. I comandi API restano nel Model.

# ---- group: 01 PARAMETRI
l_m = Slider(6, range=2..12)
h_m = Slider(3, range=2..6)
h_sezione_m = Slider(0.35, range=0.2..0.8)
b_sezione_m = Slider(0.25, range=0.15..0.6)
q_gz_kn_m = Slider(-8, range=-40..0)

# ---- group: 02 GEOMETRIA E PROPRIETA
# 02 / SAP2000 - Portale parametrico: Portale nel piano XZ: L = 6 m, H = 3 m, sezione 0.25 x 0.35 m, basi incastrate. Unita: kN / m.
# G = peso proprio; Q = carico GZ sulla sola trave. ULS = 1.35 G + 1.50 Q. I comandi API restano nel Model.
A = ConstructPoint(XCoordinate=0, YCoordinate=0, ZCoordinate=0)
B = ConstructPoint(XCoordinate=0, YCoordinate=0, ZCoordinate=h_m)
C = ConstructPoint(XCoordinate=l_m, YCoordinate=0, ZCoordinate=h_m)
D = ConstructPoint(XCoordinate=l_m, YCoordinate=0, ZCoordinate=0)
asse = Line(StartPoint=A, EndPoint=B)
asse_2 = Line(StartPoint=B, EndPoint=C)
asse_3 = Line(StartPoint=C, EndPoint=D)
material = SAPIsotropicMaterial(Name="C30", Type=2, E=30000000, Poisson=0.2, Alpha=1.2e-05, WeightDensity=25)
sap_frame_section_rectangle = SAPFrameSectionRectangle(Name="R250x350", MatProp=material, T3=h_sezione_m, T2=b_sezione_m, Color=-1)  # -> Definition, Name
sap_frame_element = SAPFrameElement(Name=["ColL", "Beam", "ColR"], Line=[asse, asse_2, asse_3], Property=sap_frame_section_rectangle.Definition)  # -> Element, Name

# ---- group: 03 VINCOLI E CARICHI
sap_node_element = SAPNodeElement(Name=["N1", "N2"], Point=[A, D])  # -> Element, Name
sap_node_restraint = SAPNodeRestraint(Name=sap_node_element.Element, Value=[True, True, True, True, True, True], ItemType=0)  # -> Definition, Name
pattern = SAPLoadPattern(Name="G", Type=1, SelfWeight=1)
pattern_2 = SAPLoadPattern(Name="Q", Type=3, SelfWeight=0)
sap_frame_load_distributed = SAPFrameLoadDistributed(
    Definitions=sap_frame_element.Element,
    Name="Beam",
    LoadPat=pattern_2,
    MyType=1,
    Dir=6,
    Dist1=0,
    Dist2=1,
    Val1=q_gz_kn_m,
    Val2=q_gz_kn_m,
    CSys="Global",
    RelDist=True,
    Replace=True,
    ItemType=0)  # -> Definition, Name

# ---- group: 04 MODELLO E COMBINAZIONE
combination = SAPLoadCombination(Name="ULS", Type=0, Cases=["G", "Q"], Factors=[1.35, 1.5])
unita_kn_m_c = ValueList({"kN_m_C": 6}, selected="kN_m_C")
model = BuildSAPModel(
    Definitions=[sap_frame_load_distributed.Definition, sap_node_restraint.Definition, pattern, combination],
    Units=unita_kn_m_c,
    Tolerance=1e-06)  # -> Model, Issues

# ---- group: 05 CONTROLLI, PREVIEW E GEOMETRIA
validate = ValidateSAPModel(Model=model.Model)  # -> Valid, Errors, Fingerprint
summary = SAPModelSummary(Model=model.Model)
display_settings = SAPDisplaySettings(
    Enabled=True,
    Geometry=True,
    Sections=True,
    Loads=True,
    Supports=True,
    Springs=True,
    Masses=True,
    Releases=True,
    Offsets=True,
    OtherAttributes=True,
    Axes=False,
    Labels=False,
    Values=True,
    SymbolScale=0.2,
    LoadScale=0.05)
preview = PreviewSAPModel(Model=model.Model, Settings=display_settings)  # -> Status, Issues, Breps, BrepNames
physical_geometry = SAPModelPhysicalGeometry(Model=model.Model)  # -> Geometry, Names, Issues
decompose = DecomposeSAPModel(Model=model.Model)  # -> Node, Frame, Area, Solid, Link, Cable, Operations, Units, Results
decompose_sap_beam = DecomposeSAPBeam(Element=decompose.Frame)  # -> Geometry, Name, Property, Vertices, Results, Quantities, Cases, Issues
validazione = Panel(validate.Valid)
riepilogo_modello = Panel(summary)
