# Grasshopper definition 01_Frame_polilinea.ghx (Grasshopper 1.0.8)
# plug-ins: Rhino2SAP
# Una polilinea genera tre elementi di un portale 4 x 3 m. Materiale e sezione si propagano agli elementi. Cambia b e h e controlla nodi, elementi e solidi.

# ---- group: 01 | INPUT E ISTRUZIONI
# COME USARE: Una polilinea genera tre elementi di un portale 4 x 3 m. Materiale e sezione si propagano agli elementi. Cambia b e h e controlla nodi, elementi e solidi.
polilinea_portale = Curve(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)
h_m = Slider(0.3, range=0.1..0.8)
b_m = Slider(0.2, range=0.05..0.6)

# ---- group: 02 | PROPRIETA / GEOMETRIA
# Frame, materiali e sezioni: Rhino2SAP | Frame, materiali e sezioni
# Una polilinea genera tre elementi di un portale 4 x 3 m. Materiale e sezione si propagano agli elementi. Cambia b e h e controlla nodi, elementi e solidi.
# Unita: kN / m / C. Geometrie incorporate. Le combinazioni sono didattiche.
material = SAPIsotropicMaterial(Name="S355_DEMO", Type=1, E=210000000, Poisson=0.3, Alpha=1.2e-05, WeightDensity=78.5)
sap_frame_section_rectangle = SAPFrameSectionRectangle(Name="R200x300", MatProp=material, T3=h_m, T2=b_m, Color=-1)  # -> Definition, Name
sap_node_element = SAPNodeElement(Name="BASE100", Point=Point(0, 0, 0))  # -> Element, Name
sap_node_element_2 = SAPNodeElement(Name="TIP101", Point=Point(4, 0, 0))  # -> Element, Name

# ---- group: 03 | ATTRIBUTI / CARICHI
polyline_frames = PolylineToSAPFrames(Polyline=polilinea_portale, Prefix="F1_", Property=sap_frame_section_rectangle.Definition)
sap_node_restraint = SAPNodeRestraint(Name=sap_node_element.Element, Value=[True, True, True, True, True, True], ItemType=0)  # -> Definition, Name
sap_node_restraint_2 = SAPNodeRestraint(Name=sap_node_element_2.Element, Value=[True, True, True, True, True, True], ItemType=0)  # -> Definition, Name

# ---- group: 04 | MODEL / OPERAZIONI
model = BuildSAPModel(
    Definitions=flatten([polyline_frames, sap_node_restraint.Definition, sap_node_element_2.Element, sap_node_restraint_2.Definition]),
    Units=6,
    Tolerance=1e-06)  # -> Model, Issues

# ---- group: 05 | VERIFICA / LETTURA
validate = ValidateSAPModel(Model=model.Model)  # -> Valid, Errors, Fingerprint
summary = SAPModelSummary(Model=model.Model)
preview = PreviewSAPModel(Model=model.Model)  # -> Status, Issues, Breps, BrepNames
decompose = DecomposeSAPModel(Model=model.Model)  # -> Node, Frame, Area, Solid, Link, Cable, Operations, Units, Results
physical_geometry = SAPModelPhysicalGeometry(Model=model.Model)  # -> Geometry, Names, Issues
valido_dati_e_riferimenti = Panel(validate.Valid)
riepilogo = Panel(summary)
