# Grasshopper definition 02_Mesh_quad.ghx (Grasshopper 1.0.8)
# plug-ins: Rhino2SAP
# Piastra 4 x 3 m: 9 nodi, 4 facce Quad4, spessore 0.20 m. Pressione -5 kN/m2 in Z globale e bordo incastrato. La discretizzazione serve a illustrare il flusso.

# ---- group: 01 | INPUT E ISTRUZIONI
# COME USARE: Piastra 4 x 3 m: 9 nodi, 4 facce Quad4, spessore 0.20 m. Pressione -5 kN/m2 in Z globale e bordo incastrato. La discretizzazione serve a illustrare il flusso.
mesh_incorporata = Mesh(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)
spessore_t_m = Slider(0.2, range=0.05..0.5)

# ---- group: 02 | PROPRIETA / GEOMETRIA
# Mesh quadrangolare e pressione: Rhino2SAP | Mesh quadrangolare e pressione
# Piastra 4 x 3 m: 9 nodi, 4 facce Quad4, spessore 0.20 m. Pressione -5 kN/m2 in Z globale e bordo incastrato. La discretizzazione serve a illustrare il flusso.
# Unita: kN / m / C. Geometrie incorporate. Le combinazioni sono didattiche.
material = SAPIsotropicMaterial(Name="C30_DEMO", Type=2, E=30000000, Poisson=0.2, Alpha=1.2e-05, WeightDensity=25)
sap_area_property_shell_1 = SAPAreaPropertyShell1(
    Name="Shell20",
    ShellType=1,
    IncludeDrillingDOF=True,
    MatProp=material,
    MatAng=0,
    Thickness=spessore_t_m,
    Bending=spessore_t_m,
    Color=-1)  # -> Definition, Name
sap_node_element = SAPNodeElement(
    Name=["B100", "B101", "B102", "B103", "B104", "B105", "B106", "B107"],
    Point=[Point(0, 0, 0), Point(2, 0, 0), Point(4, 0, 0), Point(0, 1.5, 0), Point(4, 1.5, 0), Point(0, 3, 0), Point(2, 3, 0), Point(4, 3, 0)])  # -> Element, Name
pattern = SAPLoadPattern(Name="Q", Type=3, SelfWeight=0)

# ---- group: 03 | ATTRIBUTI / CARICHI
mesh_areas = MeshToSAPAreas(Mesh=mesh_incorporata, Prefix="A", Property=sap_area_property_shell_1.Definition)
sap_node_restraint = SAPNodeRestraint(Name=sap_node_element.Element, Value=[True, True, True, True, True, True], ItemType=0)  # -> Definition, Name
sap_area_load_uniform = SAPAreaLoadUniform(Definitions=mesh_areas, Name="ALL", LoadPat=pattern, Value=-5, Dir=6, Replace=True, CSys="Global", ItemType=1)  # -> Definition, Name

# ---- group: 04 | MODEL / OPERAZIONI
model = BuildSAPModel(
    Definitions=flatten([sap_area_load_uniform.Definition, sap_node_restraint.Definition, pattern]),
    Units=6,
    Tolerance=1e-06)  # -> Model, Issues

# ---- group: 05 | VERIFICA / LETTURA
validate = ValidateSAPModel(Model=model.Model)  # -> Valid, Errors, Fingerprint
summary = SAPModelSummary(Model=model.Model)
preview = PreviewSAPModel(Model=model.Model)  # -> Status, Issues, Breps, BrepNames
decompose = DecomposeSAPModel(Model=model.Model)  # -> Node, Frame, Area, Solid, Link, Cable, Operations, Units, Results
physical_geometry = SAPModelPhysicalGeometry(Model=model.Model)  # -> Geometry, Names, Issues
valido_dati_e_riferimenti = Panel(validate.Valid)
riepilogo = Panel(summary)
