# Grasshopper definition 04_Solidi.ghx (Grasshopper 1.0.8)
# plug-ins: Rhino2SAP
# Un cubo di lato 1 m, otto vertici ordinati, materiale elastico e base incastrata. Il Brep fisico deve essere chiuso. La connettivita conta: non riordinare casualmente i vertici.

# ---- group: 02 | PROPRIETA / GEOMETRIA
# Solidi Hexa8: Rhino2SAP | Solidi Hexa8
# Un cubo di lato 1 m, otto vertici ordinati, materiale elastico e base incastrata. Il Brep fisico deve essere chiuso. La connettivita conta: non riordinare casualmente i vertici.
# Unita: kN / m / C. Geometrie incorporate. Le combinazioni sono didattiche.
# COME USARE: Un cubo di lato 1 m, otto vertici ordinati, materiale elastico e base incastrata. Il Brep fisico deve essere chiuso. La connettivita conta: non riordinare casualmente i vertici.
material = SAPIsotropicMaterial(Name="C30_DEMO", Type=2, E=30000000, Poisson=0.2, Alpha=1.2e-05, WeightDensity=25)
sap_node_element = SAPNodeElement(
    Name=["N1", "N2", "N3", "N4", "N5", "N6", "N7", "N8"],
    Point=[Point(0, 0, 0), Point(1, 0, 0), Point(1, 1, 0), Point(0, 1, 0), Point(0, 0, 1), Point(1, 0, 1), Point(1, 1, 1), Point(0, 1, 1)])  # -> Element, Name
sap_node_element_2 = SAPNodeElement(Name=["N1", "N2", "N3", "N4"], Point=[Point(0, 0, 0), Point(1, 0, 0), Point(1, 1, 0), Point(0, 1, 0)])  # -> Element, Name
sap_prop_solid_prop = SAPPropSolidProp(Name="SOLID", MatProp=material, A=0, B=0, C=0, Incompatible=True, Color=-1)  # -> Definition, Name

# ---- group: 03 | ATTRIBUTI / CARICHI
sap_node_restraint = SAPNodeRestraint(Name=sap_node_element_2.Element, Value=[True, True, True, True, True, True], ItemType=0)  # -> Definition, Name
sap_solid_element = SAPSolidElement(
    Name="S1",
    Vertices=[Point(0, 0, 0), Point(1, 0, 0), Point(1, 1, 0), Point(0, 1, 0), Point(0, 0, 1), Point(1, 0, 1), Point(1, 1, 1), Point(0, 1, 1)],
    Property=sap_prop_solid_prop.Definition)  # -> Element, Name

# ---- group: 04 | MODEL / OPERAZIONI
model = BuildSAPModel(Definitions=flatten([sap_solid_element.Element, sap_node_restraint.Definition]), Units=6, Tolerance=1e-06)  # -> Model, Issues

# ---- group: 05 | VERIFICA / LETTURA
validate = ValidateSAPModel(Model=model.Model)  # -> Valid, Errors, Fingerprint
summary = SAPModelSummary(Model=model.Model)
preview = PreviewSAPModel(Model=model.Model)  # -> Status, Issues, Breps, BrepNames
decompose = DecomposeSAPModel(Model=model.Model)  # -> Node, Frame, Area, Solid, Link, Cable, Operations, Units, Results
physical_geometry = SAPModelPhysicalGeometry(Model=model.Model)  # -> Geometry, Names, Issues
valido_dati_e_riferimenti = Panel(validate.Valid)
riepilogo = Panel(summary)
