# Grasshopper definition 05_Link_elastico.ghx (Grasshopper 1.0.8)
# plug-ins: Rhino2SAP
# Due nodi distinti collegati da un link elastico. Il primo e vincolato, il secondo e libero. Le prime tre rigidezze sono kN/m, le ultime tre kN m/rad.

# ---- group: 01 | INPUT E ISTRUZIONI
# COME USARE: Due nodi distinti collegati da un link elastico. Il primo e vincolato, il secondo e libero. Le prime tre rigidezze sono kN/m, le ultime tre kN m/rad.
# LETTURA: Il link e rappresentato dall'asse. Non equivale a una trave con volume fisico. Per un collegamento rigido usare il tipo dedicato o l'opzione Rigid in MIDAS.
k_tx_ty_tz_rx_ry_rz = Panel("""100000
100000
100000
1000
1000
1000""")

# ---- group: 02 | PROPRIETA / GEOMETRIA
# Link e rigidezze: Rhino2SAP | Link e rigidezze
# Due nodi distinti collegati da un link elastico. Il primo e vincolato, il secondo e libero. Le prime tre rigidezze sono kN/m, le ultime tre kN m/rad.
# Unita: kN / m / C. Geometrie incorporate. Le combinazioni sono didattiche.
sap_node_element = SAPNodeElement(Name="BASE1", Point=Point(0, 0, 0))  # -> Element, Name
sap_node_element_2 = SAPNodeElement(Name="TIP2", Point=Point(0, 0, 1))  # -> Element, Name
sap_link_property_linear = SAPLinkPropertyLinear(
    Name="ELASTIC",
    DOF=[True, True, True, True, True, True],
    Fixed=[False, False, False, False, False, False],
    Ke=k_tx_ty_tz_rx_ry_rz,
    Ce=[0, 0, 0, 0, 0, 0],
    DJ2=0,
    DJ3=0,
    KeCoupled=False,
    CeCoupled=False)  # -> Definition, Name

# ---- group: 03 | ATTRIBUTI / CARICHI
sap_node_restraint = SAPNodeRestraint(Name=sap_node_element.Element, Value=[True, True, True, True, True, True], ItemType=0)  # -> Definition, Name
sap_link_element = SAPLinkElement(Name="L1", Line=Line((0, 0, 0), (0, 0, 1)), Property=sap_link_property_linear.Definition)  # -> Element, Name

# ---- group: 04 | MODEL / OPERAZIONI
model = BuildSAPModel(
    Definitions=flatten([sap_link_element.Element, sap_node_restraint.Definition, sap_node_element_2.Element]),
    Units=6,
    Tolerance=1e-06)  # -> Model, Issues

# ---- group: 05 | VERIFICA / LETTURA
validate = ValidateSAPModel(Model=model.Model)  # -> Valid, Errors, Fingerprint
summary = SAPModelSummary(Model=model.Model)
preview = PreviewSAPModel(Model=model.Model)  # -> Status, Issues, Breps, BrepNames
decompose = DecomposeSAPModel(Model=model.Model)  # -> Node, Frame, Area, Solid, Link, Cable, Operations, Units, Results
valido_dati_e_riferimenti = Panel(validate.Valid)
riepilogo = Panel(summary)
