# Grasshopper definition 06_Molle_masse.ghx (Grasshopper 1.0.8)
# plug-ins: Rhino2SAP
# Mensola con incastro alla base, molla Kz e massa concentrata in punta. Distinguere sempre masse e forze.

# ---- group: 01 | INPUT E ISTRUZIONI
# COME USARE: Mensola con incastro alla base, molla Kz e massa concentrata in punta. Distinguere sempre masse e forze.
asse_trave = Curve(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)
h_m = Slider(0.3, range=0.1..0.8)
b_m = Slider(0.2, range=0.05..0.6)

# ---- group: 02 | PROPRIETA / GEOMETRIA
# Vincoli, molle e masse: Rhino2SAP | Vincoli, molle e masse
# Mensola con incastro alla base, molla Kz e massa concentrata in punta. Distinguere sempre masse e forze.
# Unita: kN / m / C. Geometrie incorporate. Le combinazioni sono didattiche.
material = SAPIsotropicMaterial(Name="S355_DEMO", Type=1, E=210000000, Poisson=0.3, Alpha=1.2e-05, WeightDensity=78.5)
sap_frame_section_rectangle = SAPFrameSectionRectangle(Name="R200x300", MatProp=material, T3=h_m, T2=b_m, Color=-1)  # -> Definition, Name
sap_node_element = SAPNodeElement(Name="BASE100", Point=Point(0, 0, 0))  # -> Element, Name
sap_node_element_2 = SAPNodeElement(Name="TIP101", Point=Point(3, 0, 0))  # -> Element, Name
pattern = SAPLoadPattern(Name="Q", Type=3, SelfWeight=0)

# ---- group: 03 | ATTRIBUTI / CARICHI
sap_frame_element = SAPFrameElement(Name="F1", Line=Line((0, 0, 0), (3, 0, 0)), Property=sap_frame_section_rectangle.Definition)  # -> Element, Name
sap_node_restraint = SAPNodeRestraint(Name=sap_node_element.Element, Value=[True, True, True, True, True, True], ItemType=0)  # -> Definition, Name
sap_node_load_force = SAPNodeLoadForce(Name=sap_node_element_2.Element, LoadPat=pattern, Value=[0, 0, -10, 0, 0, 0], Replace=False, CSys="Global", ItemType=0)  # -> Definition, Name
sap_node_spring = SAPNodeSpring(Name=sap_node_element_2.Element, K=[0, 0, 1000, 0, 0, 0], ItemType=0, IsLocalCSys=True, Replace=False)  # -> Definition, Name
sap_node_mass = SAPNodeMass(Name=sap_node_spring.Definition, M=[0.1, 0.1, 0.1, 0, 0, 0], ItemType=0, IsLocalCSys=True, Replace=False)  # -> Definition, Name

# ---- group: 04 | MODEL / OPERAZIONI
model = BuildSAPModel(
    Definitions=flatten([sap_frame_element.Element, sap_node_restraint.Definition, sap_node_load_force.Definition, pattern, sap_node_mass.Definition]),
    Units=6,
    Tolerance=1e-06)  # -> Model, Issues

# ---- group: 05 | VERIFICA / LETTURA
validate = ValidateSAPModel(Model=model.Model)  # -> Valid, Errors, Fingerprint
summary = SAPModelSummary(Model=model.Model)
preview = PreviewSAPModel(Model=model.Model)  # -> Status, Issues, Breps, BrepNames
decompose = DecomposeSAPModel(Model=model.Model)  # -> Node, Frame, Area, Solid, Link, Cable, Operations, Units, Results
physical_geometry = SAPModelPhysicalGeometry(Model=model.Model)  # -> Geometry, Names, Issues
valido_dati_e_riferimenti = Panel(validate.Valid)
riepilogo = Panel(summary)
