# Grasshopper definition 07_Assi_offset_svincoli.ghx (Grasshopper 1.0.8)
# plug-ins: Rhino2SAP
# Una catena modifica lo stesso elemento: orientamento, eccentricita, rilascio terminale. Build riceve soltanto l'ultima versione.

# ---- group: 01 | INPUT E ISTRUZIONI
# COME USARE: Una catena modifica lo stesso elemento: orientamento, eccentricita, rilascio terminale. Build riceve soltanto l'ultima versione.
# OFFSET SAP: Per gli insertion/end offset SAP la preview attuale restituisce assi analitici e segnala la limitazione in Issues; non inventa un solido fisico.
# SVINCOLO DIDATTICO: Prima dell'analisi verificare che non introduca gradi di liberta isolati. Gli offset spostano la sezione fisica rispetto all'asse.
asse_trave = Curve(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)
h_m = Slider(0.3, range=0.1..0.8)
b_m = Slider(0.2, range=0.05..0.6)

# ---- group: 02 | PROPRIETA / GEOMETRIA
# Assi locali, offset e svincoli: Rhino2SAP | Assi locali, offset e svincoli
# Una catena modifica lo stesso elemento: orientamento, eccentricita, rilascio terminale. Build riceve soltanto l'ultima versione.
# Unita: kN / m / C. Geometrie incorporate. Le combinazioni sono didattiche.
material = SAPIsotropicMaterial(Name="S355_DEMO", Type=1, E=210000000, Poisson=0.3, Alpha=1.2e-05, WeightDensity=78.5)
sap_frame_section_rectangle = SAPFrameSectionRectangle(Name="R200x300", MatProp=material, T3=h_m, T2=b_m, Color=-1)  # -> Definition, Name
sap_node_element = SAPNodeElement(Name="BASE100", Point=Point(0, 0, 0))  # -> Element, Name
sap_node_element_2 = SAPNodeElement(Name="TIP101", Point=Point(3, 0, 0))  # -> Element, Name

# ---- group: 03 | ATTRIBUTI / CARICHI
sap_frame_element = SAPFrameElement(Name="F1", Line=Line((0, 0, 0), (3, 0, 0)), Property=sap_frame_section_rectangle.Definition)  # -> Element, Name
sap_node_restraint = SAPNodeRestraint(Name=sap_node_element.Element, Value=[True, True, True, True, True, True], ItemType=0)  # -> Definition, Name
align_sap_frame_local_axis = AlignSAPFrameLocalAxis(Definition=sap_frame_element.Element, Direction=Vector(0, 0, 1))
sap_frame_insertion_point = SAPFrameInsertionPoint(
    Name=align_sap_frame_local_axis,
    CardinalPoint=10,
    Mirror2=False,
    StiffTransform=True,
    Offset1=[0, 0, 0.05],
    Offset2=[0, 0, 0.05],
    CSys="Global",
    ItemType=0)  # -> Definition, Name
sap_frame_releases = SAPFrameReleases(
    Name=sap_frame_insertion_point.Definition,
    II=[False, False, False, False, False, False],
    JJ=[False, False, False, False, False, True],
    StartValue=[0, 0, 0, 0, 0, 0],
    EndValue=[0, 0, 0, 0, 0, 0],
    ItemType=0)  # -> Definition, Name

# ---- group: 04 | MODEL / OPERAZIONI
model = BuildSAPModel(
    Definitions=flatten([sap_node_restraint.Definition, sap_node_element_2.Element, sap_frame_releases.Definition]),
    Units=6,
    Tolerance=1e-06)  # -> Model, Issues

# ---- group: 05 | VERIFICA / LETTURA
validate = ValidateSAPModel(Model=model.Model)  # -> Valid, Errors, Fingerprint
summary = SAPModelSummary(Model=model.Model)
preview = PreviewSAPModel(Model=model.Model)  # -> Status, Issues, Breps, BrepNames
decompose = DecomposeSAPModel(Model=model.Model)  # -> Node, Frame, Area, Solid, Link, Cable, Operations, Units, Results
valido_dati_e_riferimenti = Panel(validate.Valid)
riepilogo = Panel(summary)

# ---- group: 06 | RISULTATI
physical_geometry = SAPModelPhysicalGeometry(Model=model.Model)  # -> Geometry, Names, Issues
limiti_preview_offset = Panel(physical_geometry.Issues)
