# Grasshopper definition 08_Carichi_combinazioni.ghx (Grasshopper 1.0.8)
# plug-ins: Rhino2SAP
# Peso proprio G, carico Q e ULS_DEMO = 1.35 G + 1.50 Q. Coefficienti didattici; non sommare copie intermedie dello stesso carico.

# ---- group: 01 | INPUT E ISTRUZIONI
# COME USARE: Peso proprio G, carico Q e ULS_DEMO = 1.35 G + 1.50 Q. Coefficienti didattici; non sommare copie intermedie dello stesso carico.
asse_trave = Curve(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)
h_m = Slider(0.3, range=0.1..0.8)
b_m = Slider(0.2, range=0.05..0.6)

# ---- group: 02 | PROPRIETA / GEOMETRIA
# Casi e combinazioni: Rhino2SAP | Casi e combinazioni
# Peso proprio G, carico Q e ULS_DEMO = 1.35 G + 1.50 Q. Coefficienti didattici; non sommare copie intermedie dello stesso carico.
# Unita: kN / m / C. Geometrie incorporate. Le combinazioni sono didattiche.
material = SAPIsotropicMaterial(Name="S355_DEMO", Type=1, E=210000000, Poisson=0.3, Alpha=1.2e-05, WeightDensity=78.5)
sap_frame_section_rectangle = SAPFrameSectionRectangle(Name="R200x300", MatProp=material, T3=h_m, T2=b_m, Color=-1)  # -> Definition, Name
sap_node_element = SAPNodeElement(Name="BASE100", Point=Point(0, 0, 0))  # -> Element, Name
sap_node_element_2 = SAPNodeElement(Name="TIP101", Point=Point(3, 0, 0))  # -> Element, Name
pattern = SAPLoadPattern(Name="Q", Type=3, SelfWeight=0)
pattern_2 = SAPLoadPattern(Name="G", Type=1, SelfWeight=1)

# ---- group: 03 | ATTRIBUTI / CARICHI
sap_frame_element = SAPFrameElement(Name="F1", Line=Line((0, 0, 0), (3, 0, 0)), Property=sap_frame_section_rectangle.Definition)  # -> Element, Name
sap_node_restraint = SAPNodeRestraint(Name=sap_node_element.Element, Value=[True, True, True, True, True, True], ItemType=0)  # -> Definition, Name
sap_node_load_force = SAPNodeLoadForce(Name=sap_node_element_2.Element, LoadPat=pattern, Value=[0, 0, -10, 0, 0, 0], Replace=False, CSys="Global", ItemType=0)  # -> Definition, Name
combination = SAPLoadCombination(Name="ULS_DEMO", Type=0, Cases=["G", "Q"], Factors=[1.35, 1.5])

# ---- group: 04 | MODEL / OPERAZIONI
model = BuildSAPModel(
    Definitions=flatten([sap_frame_element.Element, sap_node_restraint.Definition, sap_node_load_force.Definition, pattern, pattern_2, combination]),
    Units=6,
    Tolerance=1e-06)  # -> Model, Issues

# ---- group: 05 | VERIFICA / LETTURA
validate = ValidateSAPModel(Model=model.Model)  # -> Valid, Errors, Fingerprint
summary = SAPModelSummary(Model=model.Model)
preview = PreviewSAPModel(Model=model.Model)  # -> Status, Issues, Breps, BrepNames
decompose = DecomposeSAPModel(Model=model.Model)  # -> Node, Frame, Area, Solid, Link, Cable, Operations, Units, Results
physical_geometry = SAPModelPhysicalGeometry(Model=model.Model)  # -> Geometry, Names, Issues
valido_dati_e_riferimenti = Panel(validate.Valid)
riepilogo = Panel(summary)
