# Grasshopper definition 09_Unione_filtri.ghx (Grasshopper 1.0.8)
# plug-ins: Rhino2SAP
# Due mensole indipendenti, con ID coordinati, confluiscono in un Model. Decomposizione e filtro recuperano un sottoinsieme.

# ---- group: 01 | INPUT E ISTRUZIONI
# COME USARE: Due mensole indipendenti, con ID coordinati, confluiscono in un Model. Decomposizione e filtro recuperano un sottoinsieme.
# ID E DIPENDENZE: I due modelli condividono materiale e sezione; gli elementi hanno ID distinti. Straus puo rinumerare, SAP/MIDAS richiedono riferimenti coordinati. Il merge invalida risultati precedenti.
asse_trave = Curve(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)
asse_trave_2 = Curve(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)
h_m = Slider(0.3, range=0.1..0.8)
b_m = Slider(0.2, range=0.05..0.6)

# ---- group: 02 | PROPRIETA / GEOMETRIA
# Unione, decomposizione e filtri: Rhino2SAP | Unione, decomposizione e filtri
# Due mensole indipendenti, con ID coordinati, confluiscono in un Model. Decomposizione e filtro recuperano un sottoinsieme.
# Unita: kN / m / C. Geometrie incorporate. Le combinazioni sono didattiche.
material = SAPIsotropicMaterial(Name="S355_DEMO", Type=1, E=210000000, Poisson=0.3, Alpha=1.2e-05, WeightDensity=78.5)
sap_frame_section_rectangle = SAPFrameSectionRectangle(Name="R200x300", MatProp=material, T3=h_m, T2=b_m, Color=-1)  # -> Definition, Name
sap_node_element = SAPNodeElement(Name="BASE100", Point=Point(0, 0, 0))  # -> Element, Name
sap_node_element_2 = SAPNodeElement(Name="TIP101", Point=Point(3, 0, 0))  # -> Element, Name
sap_node_element_3 = SAPNodeElement(Name="BASE200", Point=Point(4, 0, 0))  # -> Element, Name
sap_node_element_4 = SAPNodeElement(Name="TIP201", Point=Point(7, 0, 0))  # -> Element, Name

# ---- group: 03 | ATTRIBUTI / CARICHI
sap_frame_element = SAPFrameElement(Name="F1", Line=Line((0, 0, 0), (3, 0, 0)), Property=sap_frame_section_rectangle.Definition)  # -> Element, Name
sap_node_restraint = SAPNodeRestraint(Name=sap_node_element.Element, Value=[True, True, True, True, True, True], ItemType=0)  # -> Definition, Name
sap_frame_element_2 = SAPFrameElement(Name="F2", Line=Line((4, 0, 0), (7, 0, 0)), Property=sap_frame_section_rectangle.Definition)  # -> Element, Name
sap_node_restraint_2 = SAPNodeRestraint(Name=sap_node_element_3.Element, Value=[True, True, True, True, True, True], ItemType=0)  # -> Definition, Name

# ---- group: 04 | MODEL / OPERAZIONI
model = BuildSAPModel(
    Definitions=flatten([sap_frame_element.Element, sap_node_restraint.Definition, sap_node_element_2.Element]),
    Units=6,
    Tolerance=1e-06)  # -> Model, Issues
model_2 = BuildSAPModel(
    Definitions=flatten([sap_frame_element_2.Element, sap_node_restraint_2.Definition, sap_node_element_4.Element]),
    Units=6,
    Tolerance=1e-06)  # -> Model, Issues
merge = MergeSAPModels(Models=[model.Model, model_2.Model])

# ---- group: 05 | VERIFICA / LETTURA
validate = ValidateSAPModel(Model=merge)  # -> Valid, Errors, Fingerprint
summary = SAPModelSummary(Model=merge)
preview = PreviewSAPModel(Model=merge)  # -> Status, Issues, Breps, BrepNames
decompose = DecomposeSAPModel(Model=merge)  # -> Node, Frame, Area, Solid, Link, Cable, Operations, Units, Results
physical_geometry = SAPModelPhysicalGeometry(Model=merge)  # -> Geometry, Names, Issues
valido_dati_e_riferimenti = Panel(validate.Valid)
riepilogo = Panel(summary)

# ---- group: 06 | RISULTATI
filter = FilterSAPElements(Definition=merge, Kind=1, Names="F1")
elementi_filtrati = Panel(filter)
