# Grasshopper definition 11_Import_model.ghx (Grasshopper 1.0.8)
# plug-ins: Rhino2SAP
# Leggi il modello nativo e ottieni il Model associato. Controlla Issues per conoscere dati importati e limiti.

# ---- group: 01 | INPUT E ISTRUZIONI
# Modello esistente verso Grasshopper: Rhino2SAP | Modello esistente verso Grasshopper
# Leggi il modello nativo e ottieni il Model associato. Controlla Issues per conoscere dati importati e limiti.
# Unita: quelle restituite dal lettore; vedere Summary.
# COME USARE: Leggi il modello nativo e ottieni il Model associato. Controlla Issues per conoscere dati importati e limiti.
# UNITA DEL MODELLO: Il Model mantiene le unita del documento nativo. Controllare Summary e non forzare kN/m su dati in altre unita.
# SORGENTE ASSOCIATA: Conservare il file .sdb: il Model mantiene il collegamento alla versione verificata del sorgente. Per modificare dati nativi aggiornare SAP e importare nuovamente.
read_model = BooleanToggle(False)
path_percorso_locale_modificabile = Panel("C:\Users\g.pacini\Documents\Rhino2FEM_Examples\Rhino2SAP\10_Export.sdb")

# ---- group: 03 | ATTRIBUTI / CARICHI
import_model = ImportSAPModel(Path=path_percorso_locale_modificabile, Run=read_model)  # -> Model, Units, Cases, Combinations, Issues, SourceHash

# ---- group: 04 | MODEL / OPERAZIONI
gate = StreamGate(Stream=import_model.Model, Gate=read_model)  # -> Target0, Target1
import_limiti = Panel(import_model.Issues)

# ---- group: 05 | VERIFICA / LETTURA
validate = ValidateSAPModel(Model=gate.Target1)  # -> Valid, Errors, Fingerprint
summary = SAPModelSummary(Model=gate.Target1)
preview = PreviewSAPModel(Model=gate.Target1)  # -> Status, Issues, Breps, BrepNames
decompose = DecomposeSAPModel(Model=gate.Target1)  # -> Node, Frame, Area, Solid, Link, Cable, Operations, Units, Results
physical_geometry = SAPModelPhysicalGeometry(Model=gate.Target1)  # -> Geometry, Names, Issues
valido_dati_e_riferimenti = Panel(validate.Valid)
riepilogo = Panel(summary)
