# Grasshopper definition 13_Analisi_mesh.ghx (Grasshopper 1.0.8)
# plug-ins: Rhino2SAP
# Piastra Quad4 con pressione: Model -> solver -> azioni di piastra, spostamenti e reazioni. Nessun risultato e simulato.

# ---- group: 01 | INPUT E ISTRUZIONI
# COME USARE: Piastra Quad4 con pressione: Model -> solver -> azioni di piastra, spostamenti e reazioni. Nessun risultato e simulato.
# LETTORI IN ATTESA: Stream Gate chiude il ramo finche RUN/READ=false. Dopo il calcolo scegli un caso reale. MIDAS usa etichette come Q(ST): controlla quelle restituite. Gli inviluppi non sono una deformata simultanea.
mesh_incorporata = Mesh(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)
# Analisi e risultati delle piastre: Rhino2SAP | Analisi e risultati delle piastre
# Piastra Quad4 con pressione: Model -> solver -> azioni di piastra, spostamenti e reazioni. Nessun risultato e simulato.
# Unita: kN / m / C. Geometrie incorporate. Le combinazioni sono didattiche.
run_analisi = BooleanToggle(False)
overwrite_sostituisci_file = BooleanToggle(False)
path_percorso_locale_modificabile = Panel("C:\Users\g.pacini\Documents\Rhino2FEM_Examples\Rhino2SAP\13_Analisi_mesh.sdb")
spessore_t_m = Slider(0.2, range=0.05..0.5)

# ---- group: 02 | PROPRIETA / GEOMETRIA
material = SAPIsotropicMaterial(Name="C30_DEMO", Type=2, E=30000000, Poisson=0.2, Alpha=1.2e-05, WeightDensity=25)
sap_area_property_shell_1 = SAPAreaPropertyShell1(
    Name="Shell20",
    ShellType=1,
    IncludeDrillingDOF=True,
    MatProp=material,
    MatAng=0,
    Thickness=spessore_t_m,
    Bending=spessore_t_m,
    Color=-1)  # -> Definition, Name
sap_node_element = SAPNodeElement(
    Name=["B100", "B101", "B102", "B103", "B104", "B105", "B106", "B107"],
    Point=[Point(0, 0, 0), Point(2, 0, 0), Point(4, 0, 0), Point(0, 1.5, 0), Point(4, 1.5, 0), Point(0, 3, 0), Point(2, 3, 0), Point(4, 3, 0)])  # -> Element, Name
pattern = SAPLoadPattern(Name="Q", Type=3, SelfWeight=0)

# ---- group: 03 | ATTRIBUTI / CARICHI
mesh_areas = MeshToSAPAreas(Mesh=mesh_incorporata, Prefix="A", Property=sap_area_property_shell_1.Definition)
sap_node_restraint = SAPNodeRestraint(Name=sap_node_element.Element, Value=[True, True, True, True, True, True], ItemType=0)  # -> Definition, Name
sap_area_load_uniform = SAPAreaLoadUniform(Definitions=mesh_areas, Name="ALL", LoadPat=pattern, Value=-5, Dir=6, Replace=True, CSys="Global", ItemType=1)  # -> Definition, Name

# ---- group: 04 | MODEL / OPERAZIONI
model = BuildSAPModel(
    Definitions=flatten([sap_area_load_uniform.Definition, sap_node_restraint.Definition, pattern]),
    Units=6,
    Tolerance=1e-06)  # -> Model, Issues
sap_analyze_and_embed_results = SAPAnalyzeAndEmbedResults(Model=model.Model, Path=path_percorso_locale_modificabile, Run=run_analisi, Overwrite=overwrite_sostituisci_file)  # -> Model, Path, Issues, Beams, Plates
esito_operazione = Panel(sap_analyze_and_embed_results.Issues)

# ---- group: 05 | VERIFICA / LETTURA
validate = ValidateSAPModel(Model=model.Model)  # -> Valid, Errors, Fingerprint
summary = SAPModelSummary(Model=model.Model)
preview = PreviewSAPModel(Model=model.Model)  # -> Status, Issues, Breps, BrepNames
decompose = DecomposeSAPModel(Model=model.Model)  # -> Node, Frame, Area, Solid, Link, Cable, Operations, Units, Results
physical_geometry = SAPModelPhysicalGeometry(Model=model.Model)  # -> Geometry, Names, Issues
gate = StreamGate(Stream=sap_analyze_and_embed_results.Model, Gate=run_analisi)  # -> Target0, Target1
valido_dati_e_riferimenti = Panel(validate.Valid)
riepilogo = Panel(summary)

# ---- group: 06 | RISULTATI
cases = SAPModelResultCases(Model=gate.Target1)  # -> CasesAndSteps, Quantities, Issues
decompose_2 = DecomposeSAPModel(Model=gate.Target1)  # -> Node, Frame, Area, Solid, Link, Cable, Operations, Units, Results
sap_plate_results_forces_and_moments = SAPPlateResultsForcesAndMoments(Element=decompose_2.Area, FilterStep=False, Step=0)  # -> F11, F22, F12, M11, M22, M12, V13, V23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
casi_stati = Panel(cases.CasesAndSteps)
azioni_di_piastra = Panel(sap_plate_results_forces_and_moments.F11)

# ---- group: 07 | APPROFONDIMENTI
deformed = SAPModelDeformedGeometry(Model=gate.Target1, Case="Q", Step=0, Scale=100)  # -> Geometry, Translations
