# Grasshopper definition 14_Rilettura_risultati.ghx (Grasshopper 1.0.8)
# plug-ins: Rhino2SAP
# Seleziona il risultato/archivio dell'esempio 12. Il Model deve essere identico a quello dell'analisi; READ legge senza rilanciare il solver.

# ---- group: 01 | INPUT E ISTRUZIONI
# COME USARE: Seleziona il risultato/archivio dell'esempio 12. Il Model deve essere identico a quello dell'analisi; READ legge senza rilanciare il solver.
# LETTORI IN ATTESA: Stream Gate chiude il ramo finche RUN/READ=false. Dopo il calcolo scegli un caso reale. MIDAS usa etichette come Q(ST): controlla quelle restituite. Gli inviluppi non sono una deformata simultanea.
# PROVENIENZA: Gli archivi verificano impronta e file sorgente. In caso di mismatch ripristinare il Model corretto o ricalcolare; non disattivare la verifica per attribuire risultati a geometrie diverse.
asse_trave = Curve(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)
# Risultati gia calcolati: Rhino2SAP | Risultati gia calcolati
# Seleziona il risultato/archivio dell'esempio 12. Il Model deve essere identico a quello dell'analisi; READ legge senza rilanciare il solver.
# Unita: kN / m / C. Geometrie incorporate. Le combinazioni sono didattiche.
read_risultati = BooleanToggle(False)
path_percorso_locale_modificabile = Panel("C:\Users\g.pacini\Documents\Rhino2FEM_Examples\Rhino2SAP\12_Analisi_frame.sdb.results.json")
h_m = Slider(0.3, range=0.1..0.8)
b_m = Slider(0.2, range=0.05..0.6)

# ---- group: 02 | PROPRIETA / GEOMETRIA
material = SAPIsotropicMaterial(Name="S355_DEMO", Type=1, E=210000000, Poisson=0.3, Alpha=1.2e-05, WeightDensity=78.5)
sap_frame_section_rectangle = SAPFrameSectionRectangle(Name="R200x300", MatProp=material, T3=h_m, T2=b_m, Color=-1)  # -> Definition, Name
sap_node_element = SAPNodeElement(Name="BASE100", Point=Point(0, 0, 0))  # -> Element, Name
sap_node_element_2 = SAPNodeElement(Name="TIP101", Point=Point(3, 0, 0))  # -> Element, Name
pattern = SAPLoadPattern(Name="Q", Type=3, SelfWeight=0)

# ---- group: 03 | ATTRIBUTI / CARICHI
sap_frame_element = SAPFrameElement(Name="F1", Line=Line((0, 0, 0), (3, 0, 0)), Property=sap_frame_section_rectangle.Definition)  # -> Element, Name
sap_node_restraint = SAPNodeRestraint(Name=sap_node_element.Element, Value=[True, True, True, True, True, True], ItemType=0)  # -> Definition, Name
sap_node_load_force = SAPNodeLoadForce(Name=sap_node_element_2.Element, LoadPat=pattern, Value=[0, 0, -10, 0, 0, 0], Replace=False, CSys="Global", ItemType=0)  # -> Definition, Name
gate = StreamGate(Stream=path_percorso_locale_modificabile, Gate=read_risultati)  # -> Target0, Target1

# ---- group: 04 | MODEL / OPERAZIONI
model = BuildSAPModel(
    Definitions=flatten([sap_frame_element.Element, sap_node_restraint.Definition, sap_node_load_force.Definition, pattern]),
    Units=6,
    Tolerance=1e-06)  # -> Model, Issues
read_results = ReadSAPResultsIntoModel(Model=model.Model, Archive=gate.Target1)

# ---- group: 05 | VERIFICA / LETTURA
validate = ValidateSAPModel(Model=model.Model)  # -> Valid, Errors, Fingerprint
summary = SAPModelSummary(Model=model.Model)
preview = PreviewSAPModel(Model=model.Model)  # -> Status, Issues, Breps, BrepNames
decompose = DecomposeSAPModel(Model=model.Model)  # -> Node, Frame, Area, Solid, Link, Cable, Operations, Units, Results
physical_geometry = SAPModelPhysicalGeometry(Model=model.Model)  # -> Geometry, Names, Issues
gate_2 = StreamGate(Stream=read_results, Gate=read_risultati)  # -> Target0, Target1
valido_dati_e_riferimenti = Panel(validate.Valid)
riepilogo = Panel(summary)

# ---- group: 06 | RISULTATI
cases = SAPModelResultCases(Model=gate_2.Target1)  # -> CasesAndSteps, Quantities, Issues
decompose_2 = DecomposeSAPModel(Model=gate_2.Target1)  # -> Node, Frame, Area, Solid, Link, Cable, Operations, Units, Results
sap_beam_results_n_v_t_m = SAPBeamResultsNVTM(Element=decompose_2.Frame, FilterStep=False, Step=0)  # -> NP, V2, V3, T, M2, M3, ObjSta, Cases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
casi_stati = Panel(cases.CasesAndSteps)
azioni_di_trave = Panel(sap_beam_results_n_v_t_m.NP)

# ---- group: 07 | APPROFONDIMENTI
deformed = SAPModelDeformedGeometry(Model=gate_2.Target1, Case="Q", Step=0, Scale=100)  # -> Geometry, Translations
diagram = SAPModelFrameForceDiagram(Model=gate_2.Target1, Frame="F1", Case="Q", Column="M3", Step=0, Direction=Vector(0, 0, 1), Scale=1)  # -> Diagram, Ordinates, Stations, Values
extrema = SAPModelResultExtrema(Model=gate_2.Target1, Quantity="Results.FrameForce", Column="M3")  # -> Minimum, Maximum, GoverningRows
estremi_firmati = Panel(extrema.Minimum)
