# Grasshopper definition 16_Analisi_avanzate.ghx (Grasshopper 1.0.8)
# plug-ins: Rhino2SAP
# Collegamenti per analisi modale, non lineare e buckling dove disponibili. Controllare massa, casi e stato iniziale; i solver restano spenti.

# ---- group: 01 | INPUT E ISTRUZIONI
# COME USARE: Collegamenti per analisi modale, non lineare e buckling dove disponibili. Controllare massa, casi e stato iniziale; i solver restano spenti.
# STEP DEI RISULTATI: Per casi non lineari selezionare lo step. Controllare nel catalogo native le quantita disponibili; il ramo di analisi riporta le mancanze in Issues.
asse_trave = Curve(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)
# Analisi avanzate: Rhino2SAP | Analisi avanzate
# Collegamenti per analisi modale, non lineare e buckling dove disponibili. Controllare massa, casi e stato iniziale; i solver restano spenti.
# Unita: kN / m / C. Geometrie incorporate. Le combinazioni sono didattiche.
run_analisi = BooleanToggle(False)
overwrite_sostituisci_file = BooleanToggle(False)
path_percorso_locale_modificabile = Panel("C:\Users\g.pacini\Documents\Rhino2FEM_Examples\Rhino2SAP\16_Analisi_avanzate.sdb")
h_m = Slider(0.3, range=0.1..0.8)
b_m = Slider(0.2, range=0.05..0.6)

# ---- group: 02 | PROPRIETA / GEOMETRIA
material = SAPIsotropicMaterial(Name="S355_DEMO", Type=1, E=210000000, Poisson=0.3, Alpha=1.2e-05, WeightDensity=78.5)
sap_frame_section_rectangle = SAPFrameSectionRectangle(Name="R200x300", MatProp=material, T3=h_m, T2=b_m, Color=-1)  # -> Definition, Name
sap_node_element = SAPNodeElement(Name="BASE100", Point=Point(0, 0, 0))  # -> Element, Name
sap_node_element_2 = SAPNodeElement(Name="TIP101", Point=Point(3, 0, 0))  # -> Element, Name
pattern = SAPLoadPattern(Name="Q", Type=3, SelfWeight=0)

# ---- group: 03 | ATTRIBUTI / CARICHI
sap_frame_element = SAPFrameElement(Name="F1", Line=Line((0, 0, 0), (3, 0, 0)), Property=sap_frame_section_rectangle.Definition)  # -> Element, Name
sap_node_restraint = SAPNodeRestraint(Name=sap_node_element.Element, Value=[True, True, True, True, True, True], ItemType=0)  # -> Definition, Name
sap_node_load_force = SAPNodeLoadForce(Name=sap_node_element_2.Element, LoadPat=pattern, Value=[0, 0, -10, 0, 0, 0], Replace=False, CSys="Global", ItemType=0)  # -> Definition, Name
sap_nonlinear_static_case = SAPNonlinearStaticCase(Name="NL_DEMO", Patterns="Q", Factors=1, Definitions=pattern)
sap_buckling_case = SAPBucklingCase(Name="BUCKLING_DEMO", Patterns="Q", Factors=1, Definitions=pattern)

# ---- group: 04 | MODEL / OPERAZIONI
model = BuildSAPModel(
    Definitions=flatten([sap_frame_element.Element, sap_node_restraint.Definition, sap_node_load_force.Definition, pattern, sap_nonlinear_static_case, sap_buckling_case]),
    Units=6,
    Tolerance=1e-06)  # -> Model, Issues
sap_analyze_and_embed_results = SAPAnalyzeAndEmbedResults(
    Model=model.Model,
    Path=path_percorso_locale_modificabile,
    Run=run_analisi,
    Overwrite=overwrite_sostituisci_file,
    Cases=["NL_DEMO", "BUCKLING_DEMO"])  # -> Model, Path, Issues, Beams, Plates
esito_operazione = Panel(sap_analyze_and_embed_results.Issues)

# ---- group: 05 | VERIFICA / LETTURA
validate = ValidateSAPModel(Model=model.Model)  # -> Valid, Errors, Fingerprint
summary = SAPModelSummary(Model=model.Model)
preview = PreviewSAPModel(Model=model.Model)  # -> Status, Issues, Breps, BrepNames
decompose = DecomposeSAPModel(Model=model.Model)  # -> Node, Frame, Area, Solid, Link, Cable, Operations, Units, Results
physical_geometry = SAPModelPhysicalGeometry(Model=model.Model)  # -> Geometry, Names, Issues
valido_dati_e_riferimenti = Panel(validate.Valid)
riepilogo = Panel(summary)
